% Simulink data dictionary ADK_IDS.sldd
% references Common_Definition.sldd
% references Model_Config.sldd

InputSerial = Simulink.Bus()  % 输入串口
  GNSS2IDS_bus: Bus: GNSS2IDS  % GNSS到IDS的输入接口

GNSS_Status = enum(DefaultValue="Initialization")  % 组合惯导工作状态
  Initialization = 0  % 初始化
  Single_Point_Location = 3  % 单点定位
  Single_Point_Orientation = 4  % 单点定向
  RTK_INT_Location = 69  % RTK固定解定位
  RTK_INT_Orientation = 75  % RTK固定解定向
  RTK_FLOAT_Location = 85  % RTK浮点解定位
  RTK_FLOAT_Orientation = 91  % RTK浮点解定向

GNSS2IDS = Simulink.Bus()  % GNSS到IDS的输入接口
  GNSSTime: double, Min=0, Unit="s"  % 组合惯导秒数（从本周日0:00:00至当前的秒数，精确到毫秒）
  Heading: double, Min=0, Max=359.99, Unit="°"  % 组合惯导航向角
  Pitch: double, Min=-90, Max=90, Unit="°"  % 组合惯导俯仰角
  Roll: double, Min=-180, Max=180, Unit="°"  % 组合惯导横滚角
  Latitude: double, Min=-90, Max=90, Unit="°"  % 组合惯导纬度
  Longitude: double, Min=-180, Max=180, Unit="°"  % 组合惯导经度
  Altitude: double, Min=-200, Max=8000, Unit="m"  % 组合惯导高度
  GNSSWorkStatus: Enum: GNSS_Status  % 组合惯导工作状态
  AngleSpeedX: double, Min=-360, Max=360, Unit="°/s"  % 组合惯导X角速度
  AngleSpeedY: double, Min=-360, Max=360, Unit="°/s"  % 组合惯导Y角速度
  AngleSpeedZ: double, Min=-360, Max=360, Unit="°/s"  % 组合惯导Z角速度
  AccelerationX: double, Min=-1, Max=1, Unit="g"  % 组合惯导X加速度
  AccelerationY: double, Min=-1, Max=1, Unit="g"  % 组合惯导Y加速度
  AccelerationZ: double, Min=-1, Max=1, Unit="g"  % 组合惯导Z加速度

CONTROL_CYCLE_TIME = 0.05

IDSWorkStatus = enum(DefaultValue="Manual_Driving")  % 智能驾驶系统工作状态
  Manual_Driving = 0  % 手动驾驶
  Auto_Tracking = 1  % 自动循迹

START_SPEED_THRESHOLD = 0.8333333

GNSS_Info = Simulink.Bus()  % 组合惯导信息
  GNSS_life: Bus: Key_Life_Info  % 组合惯导生命信号
  ENU_yaw_angle: double, Min=0, Max=360, Unit="°"  % 东北天坐标系下的横摆角（正实数，deg）
  ENU_x: double, Unit="m"  % 东北天坐标系下的x坐标（实数，m）
  ENU_y: double, Unit="m"  % 东北天坐标系下的y坐标（实数，m）
  location_valid_status: Enum: Validation  % 定位有效状态(正整数,无量纲)

KMPH2MPS = 0.2777778
HIGH_SPEED_THRESHOLD = 6.388889
DEGREE2RAD = 0.01745329
TRAJECTORY_UPDATE_CYCLE_TIME = 1
IDS_GNSS_CYCLE_TIME = 0.05
control_method = 0
pure_pursuit_calculate_method = 0
O_ALTITUDE = 38.682
COMMUNICATION_CYCLE_TIME = 0.05
K_speed = 5
K_steering_axle_angle = 0
preview_calculate_method = 1
GNSS_preview_time = 1

InputPort = Simulink.Bus()  % IDS输入端口
  InputCAN_bus: Bus: InputCAN  % 输入CAN数据
  InputSerial_bus: Bus: InputSerial  % 输入串口

InputCAN = Simulink.Bus()  % 输入CAN接口
  VCU2IDS_bus: Bus: VCU2IDS  % VCU到IDS的输入接口

OutputCAN = Simulink.Bus()  % 输出CAN接口
  IDS2VCU_bus: Bus: IDS2VCU  % IDS到VCU的输出接口

OutputPort = Simulink.Bus()  % IDS输出端口
  OutputCAN_bus: Bus: OutputCAN  % 输出CAN接口

Steering_Axle_Info = Simulink.Bus()  % 转向轴信息
  actual_angle: Bus: Key_Signal_Info  % 实际转向轴转角(实数,deg)
  set_angle: Bus: Key_Signal_Info  % 目标转向轴转角(实数,deg)

VCU2IDS = Simulink.Bus()  % VCU到IDS的输入接口
  VCU2IDS_brake_status: Bus: VCU2IDS_Brake_Status  % VCU发给IDS的制动状态报文
  VCU2IDS_gear_status: Bus: VCU2IDS_Gear_Status  % VCU发到IDS的档位状态报文
  VCU2IDS_status1: Bus: VCU2IDS_Status1  % VCU发给IDS的反馈状态1报文
  VCU2IDS_steer_status: Bus: VCU2IDS_Steer_Status  % VCU发到IDS的转向状态报文
  VCU2IDS_throttle_status: Bus: VCU2IDS_Throttle_Status  % VCU发到IDS的驱动状态报文

VCU2IDS_Status1 = Simulink.Bus()  % VCU发给IDS的反馈状态1报文
  vehicle_speed: double, Unit="m/s"  % 整车速度（实数，m/s）

VCU2IDS_Gear_Status = Simulink.Bus()  % VCU发到IDS的档位状态报文
  gear_status: Enum: Gear  % 档位状态（正整数，无量纲）

Gear = enum(DefaultValue="P")  % 档位
  P = 1  % P档
  R = 2  % R档
  N = 3  % N档
  D = 4  % D档

IDS2VCU = Simulink.Bus()  % IDS到VCU的输出接口
  IDS2VCU_brake_command: Bus: IDS2VCU_Brake_Command  % IDS发给VCU的制动控制报文
  IDS2VCU_gear_command: Bus: IDS2VCU_Gear_Command  % IDS发给VCU的档位控制报文
  IDS2VCU_steer_command: Bus: IDS2VCU_Steer_Command  % VCU发到IDS的转向指令报文
  IDS2VCU_throttle_command: Bus: IDS2VCU_Throttle_Command  % IDS发给VCU的驱动控制报文

IDS2VCU_Gear_Command = Simulink.Bus()  % IDS发给VCU的档位控制报文
  gear_command: Enum: Gear  % 档位指令（正整数，无量纲）

IDS_VCU_CYCLE_TIME = 0.05
RAD2DEGREE = 57.29578
STEERING_AXLE_ANGLE_LIMIT = 20

DrivingMode = enum(DefaultValue="Manual")  % 驾驶模式
  Manual = 0  % 手动驾驶
  Autopilot = 1  % 自动驾驶
  Intervention = 2  % 手动接管

IDS2VCU_Brake_Command = Simulink.Bus()  % IDS发给VCU的制动控制报文
  brake_pedal_enable_command: Enum: DrivingMode  % 总线控制虚拟制动踏板使能指令（正整数，无量纲）
  brake_pedal_command: double, Min=0, Max=100, Unit="%"  % 总线控制虚拟制动踏板指令（正实数，%）

IDS2VCU_Steer_Command = Simulink.Bus()  % VCU发到IDS的转向指令报文
  steer_angle_enable_command: Enum: DrivingMode  % 总线控制转向角度使能指令（正整数，无量纲）
  steer_angle_command: double, Min=-0.35, Max=0.35, Unit="rad"  % 转向角度指令（实数，rad）

IDS2VCU_Throttle_Command = Simulink.Bus()  % IDS发给VCU的驱动控制报文
  throttle_pedal_enable_command: Enum: DrivingMode  % 总线控制虚拟驱动踏板使能指令（正整数，无量纲）
  throttle_pedal_command: double, Min=0, Max=100, Unit="%"  % 总线控制虚拟驱动踏板指令（正实数，%）

VCU2IDS_Brake_Status = Simulink.Bus()  % VCU发给IDS的制动状态报文
  brake_pedal_enable_status: Enum: DrivingMode  % 总线控制虚拟制动踏板使能状态（正整数，无量纲）
  brake_pedal_status: double, Min=0, Max=100, Unit="%"  % 总线控制虚拟制动踏板状态（正实数，%）

VCU2IDS_Steer_Status = Simulink.Bus()  % VCU发到IDS的转向状态报文
  steer_angle_enable_status: Enum: DrivingMode  % 总线控制转向角度使能状态（正整数，无量纲）
  steer_angle_status: double, Unit="rad"  % 转向角度状态（实数，rad）

VCU2IDS_Throttle_Status = Simulink.Bus()  % VCU发到IDS的驱动状态报文
  throttle_pedal_enable_status: Enum: DrivingMode  % 总线控制虚拟驱动踏板使能状态（正整数，无量纲）
  throttle_pedal_status: double, Min=0, Max=100, Unit="%"  % 总线控制虚拟驱动踏板状态（正实数，%）

Tram_Info = Simulink.Bus()  % 列车信息
  speed: Bus: Key_Signal_Info  % 整车车速
  Lf: double, Unit="m"  % 前轴距（正实数，m）
  Lr: double, Unit="m"  % 后轴距（正实数，m）
  driving_mode: Enum: DrivingMode  % 自动驾驶状态（正整数，无量纲）

MASS_CENTER2FRONT_AXLE_DISTANCE = 0.48
MASS_CENTER2REAR_AXLE_DISTANCE = 0.48
O_LATITUDE = 27.90334414
O_LONGITUDE = 113.11753247

Longitudinal_Control_Info = Simulink.Bus()  % 纵向控制信息
  set_brake_pedal: double, Min=0, Max=100, Unit="%"  % 目标制动踏板（正实数，%）
  set_gear: Enum: Gear  % 目标档位（正整数，无量纲）
  set_throttle_pedal: double, Min=0, Max=100, Unit="%"  % 目标驱动踏板（正实数，%）

ApplicationBus = Simulink.Bus()  % IDS应用层总线
  IDS_work_status: Enum: IDSWorkStatus  % 智能驾驶系统工作状态（正整数，无量纲）
  tram_info: Bus: Tram_Info  % 列车信息
  steering_axle_info: Bus: Steering_Axle_Info  % 转向轴信息
  GNSS_info: Bus: GNSS_Info  % 组合惯导信息
  reference_trajectory_info: Bus: Reference_Trajectory_Info  % 参考轨迹信息
  GNSS_control_info: Bus: GNSS_Control_Info  % GNSS控制方法相关信息
  longitudinal_control_info: Bus: Longitudinal_Control_Info  % 纵向控制信息

desired_trajectory_index = 1
test_fixed_steering_axle_angle = 6
curvature_threshold1 = 0.07
curvature_threshold2 = 0.14
curvature_threshold3 = 0.21
curvature_threshold4 = 0.28
curvature_threshold5 = 0.35
curvature_threshold6 = 0.42
set_speed = 5
test_mode = 1
K_lateral_offset_level1 = 1.5
K_lateral_offset_level2 = 1.5
K_lateral_offset_level3 = 1.5
K_lateral_offset_level4 = 1.5
K_lateral_offset_level5 = 1.5
K_lateral_offset_level6 = 1.5
preview_distance_level2 = 0.9
preview_distance_level1 = 0.9
preview_distance_level3 = 0.9
preview_distance_level6 = 0.9
preview_distance_level5 = 0.9
preview_distance_level4 = 0.9

Reference_Trajectory_Info = Simulink.Bus()  % 参考轨迹信息
  way_point_number: double  % 局部路径路点个数（正整数，无量纲）模型中采用double类型便于m函数中直接参与计算
  segment_length: double[MAX_TRAJECTORY_WAY_POINT_NUMBER,1], Unit="m"  % 路点间隔长度（正实数，m）
  trajectory_yaw_angle: double[MAX_TRAJECTORY_WAY_POINT_NUMBER,1], Unit="°"  % 局部路径预存横摆角（实数，deg）
  trajectory_x: double[MAX_TRAJECTORY_WAY_POINT_NUMBER,1], Unit="m"  % 局部路径预存x坐标（实数，m）
  trajectory_y: double[MAX_TRAJECTORY_WAY_POINT_NUMBER,1], Unit="m"  % 局部路径预存y坐标（实数，m）
  trajectory_curvature: double[MAX_TRAJECTORY_WAY_POINT_NUMBER,1], Unit="1/m"  % 局部路径预存曲率（实数，1/m）

GNSS_Control_Info = Simulink.Bus()  % GNSS控制方法相关信息
  set_steering_axle_angle: Bus: Key_Signal_Info  % 目标转向轴转角（实数，deg）
  stanley_set_axle_angle: Bus: Key_Signal_Info  % stanley算法目标轴转角（实数，deg）
  preview_time: double, Unit="s"  % 预瞄时间(正实数,s)
  preview_distance: double, Unit="m"  % 预瞄距离(正实数,m)
  preview_chord_length: double, Unit="m"  % 本周期预瞄弦长(正实数,m)
  near_lateral_offset: double, Unit="m"  % 近处横向偏差（实数，m）
  preview_angle_offset: double, Unit="°"  % 预瞄处角度偏差（实数，deg）
  closest_point_x: double, Unit="m"  % 最近点x坐标（实数，m）
  closest_point_y: double, Unit="m"  % 最近点y坐标（实数，m）
  closest_point_curvature: double, Unit="1/m"  % 最近点曲率（实数，1/m）
  faraway_point_curvature: double, Unit="1/m"  % 远处路点曲率（实数，1/m）
  closest_segment_start_point_index: double  % 本周期最近线段起始点索引(正整数,无量纲)实际采用double型方便在m函数中直接计算
  preview_point_x: double, Unit="m"  % 预瞄点x坐标（实数，m）
  preview_point_y: double, Unit="m"  % 预瞄点y坐标（实数，m）
  min_preview_distance: double, Unit="m"  % 最小预瞄距离（实数，m）
  K_lateral_offset: double  % 横向偏差矫正系数（正实数，无量纲）

task_ID = 0