% Simulink data dictionary ART_IDS_TUNING.sldd
% references Model_Config.sldd
% references Common_Definition.sldd

TRDP_COM_ID_MC2_MMU2IDS_SEGMENT = Simulink.Parameter(30133, DataType="uint32")  % MC2端MMU发给IDS的区间配置TRDP过程数据COM ID（正整数，无量纲）
TRDP_COM_ID_MC2_MMU2IDS_POINT = Simulink.Parameter(30134, DataType="uint32")  % MC2端MMU发给IDS的路点属性TRDP过程数据COM ID（正整数，无量纲）
TRDP_COM_ID_MC1_MMU2IDS_SEGMENT = Simulink.Parameter(10133, DataType="uint32")  % MC1端MMU发给IDS的区间配置TRDP过程数据COM ID（正整数，无量纲）
TRDP_COM_ID_MC1_MMU2IDS_POINT = Simulink.Parameter(10134, DataType="uint32")  % MC1端MMU发给IDS的路点属性TRDP过程数据COM ID（正整数，无量纲）

CONFIG_MC1_CCU2IDS = Simulink.Bus()  % MC1_CCU2IDS
  byte_order: uint32[29 1]  % byte_order
  factor: double[29 1]  % factor
  offset: double[29 1]  % offset
  type: uint32[29 1]  % type
  start_byte: uint32[29 1]  % start_byte
  start_bit: uint32[29 1]  % start_bit
  bit_length: uint32[29 1]  % bit_length
  min: double[29 1]  % min
  max: double[29 1]  % max

CONFIG_MC1_IDS2CCU = Simulink.Bus()  % MC1_IDS2CCU
  byte_order: uint32[296 1]  % byte_order
  factor: double[296 1]  % factor
  offset: double[296 1]  % offset
  type: uint32[296 1]  % type
  start_byte: uint32[296 1]  % start_byte
  start_bit: uint32[296 1]  % start_bit
  bit_length: uint32[296 1]  % bit_length
  min: double[296 1]  % min
  max: double[296 1]  % max

CONFIG_MC1_MMU2IDS_POINT = Simulink.Bus()  % MC1_MMU2IDS_POINT
  byte_order: uint32[307 1]  % byte_order
  factor: double[307 1]  % factor
  offset: double[307 1]  % offset
  type: uint32[307 1]  % type
  start_byte: uint32[307 1]  % start_byte
  start_bit: uint32[307 1]  % start_bit
  bit_length: uint32[307 1]  % bit_length
  min: double[307 1]  % min
  max: double[307 1]  % max

CONFIG_MC1_MMU2IDS_SEGMENT = Simulink.Bus()  % MC1_MMU2IDS_SEGMENT
  byte_order: uint32[243 1]  % byte_order
  factor: double[243 1]  % factor
  offset: double[243 1]  % offset
  type: uint32[243 1]  % type
  start_byte: uint32[243 1]  % start_byte
  start_bit: uint32[243 1]  % start_bit
  bit_length: uint32[243 1]  % bit_length
  min: double[243 1]  % min
  max: double[243 1]  % max

MC1_CCU2IDS = Simulink.Bus()  % MC1_CCU2IDS
  Hour: double, Min=0, Max=23  % 时间轴 时
  Minute: double, Min=0, Max=59  % 时间轴 分
  Second: double, Min=0, Max=59  % 时间轴 秒
  TramSpeed: double, Min=0, Max=80  % 整车车速
  MC1ArticulatedAngle: double, Min=-60, Max=60  % MC1与TP间铰接盘角度
  MC2ArticulatedAngle: double, Min=-60, Max=60  % MC2与TP间铰接盘角度
  SteeringAxle1Angle: double, Min=-25, Max=25  % 轴1转向角度
  SteeringAxle6Angle: double, Min=-25, Max=25  % 轴6转向角度
  TGS1FaultStatus: double, Min=0, Max=1  % 无轨导向控制器1故障状态（指代MC1端收到的无轨导向系统故障状态）
  MC1AutonomousTracking: double, Min=0, Max=1  % MC1自动循迹
  MC1TurnLeftIndicator: double, Min=0, Max=1  % MC1左转向灯
  MC1TurnRightIndicator: double, Min=0, Max=1  % MC1右转向灯
  MC1OccupiedStatus: double, Min=0, Max=1  % MC1占有状态
  MC1DriveBackward: double, Min=0, Max=1  % MC1行车方向向后
  MC1OilPumpStatus: double, Min=0, Max=1  % MC1助力油泵状态
  MC1ParkingStatus: double, Min=0, Max=1  % MC1驻车状态
  MC2AutonomousTracking: double, Min=0, Max=1  % MC2自动循迹
  MC2TurnLeftIndicator: double, Min=0, Max=1  % MC2左转向灯
  MC2TurnRightIndicator: double, Min=0, Max=1  % MC2右转向灯
  MC2OccupiedStatus: double, Min=0, Max=1  % MC2占有状态
  MC2DriveBackward: double, Min=0, Max=1  % MC2行车方向向后
  MC2OilPumpStatus: double, Min=0, Max=1  % MC2助力油泵状态
  MC2ParkingStatus: double, Min=0, Max=1  % MC2驻车状态
  TCSNLife: double, Min=0, Max=255  % 整车网络控制系统生命信号
  Year: double, Min=0, Max=99  % 时间轴 年
  Month: double, Min=1, Max=12  % 时间轴 月
  Day: double, Min=1, Max=31  % 时间轴 日
  SteeringAxle2Angle: double, Min=-25, Max=25  % 轴2转向角度
  SteeringAxle5Angle: double, Min=-25, Max=25  % 轴5转向角度

MC1_IDS2CCU = Simulink.Bus()  % MC1_IDS2CCU
  LateralRadar1YellowAlarm: double, Min=0, Max=1  % 1号侧向毫米波雷达黄色预警
  LateralRadar2YellowAlarm: double, Min=0, Max=1  % 2号侧向毫米波雷达黄色预警
  LateralRadar3YellowAlarm: double, Min=0, Max=1  % 3号侧向毫米波雷达黄色预警
  LateralRadar4YellowAlarm: double, Min=0, Max=1  % 4号侧向毫米波雷达黄色预警
  LateralRadar5YellowAlarm: double, Min=0, Max=1  % 5号侧向毫米波雷达黄色预警
  LateralRadar6YellowAlarm: double, Min=0, Max=1  % 6号侧向毫米波雷达黄色预警
  LateralRadar7YellowAlarm: double, Min=0, Max=1  % 7号侧向毫米波雷达黄色预警
  LateralRadar8YellowAlarm: double, Min=0, Max=1  % 8号侧向毫米波雷达黄色预警
  LateralRadar9YellowAlarm: double, Min=0, Max=1  % 9号侧向毫米波雷达黄色预警
  LateralRadar10YellowAlarm: double, Min=0, Max=1  % 10号侧向毫米波雷达黄色预警
  LateralRadar11YellowAlarm: double, Min=0, Max=1  % 11号侧向毫米波雷达黄色预警
  LateralRadar12YellowAlarm: double, Min=0, Max=1  % 12号侧向毫米波雷达黄色预警
  LateralRadar13YellowAlarm: double, Min=0, Max=1  % 13号侧向毫米波雷达黄色预警
  LateralRadar14YellowAlarm: double, Min=0, Max=1  % 14号侧向毫米波雷达黄色预警
  LateralRadar15YellowAlarm: double, Min=0, Max=1  % 15号侧向毫米波雷达黄色预警
  LateralRadar16YellowAlarm: double, Min=0, Max=1  % 16号侧向毫米波雷达黄色预警
  LateralRadar17YellowAlarm: double, Min=0, Max=1  % 17号侧向毫米波雷达黄色预警
  LateralRadar18YellowAlarm: double, Min=0, Max=1  % 18号侧向毫米波雷达黄色预警
  LateralRadar1Fault: double, Min=0, Max=1  % 1号侧向毫米波雷达故障
  LateralRadar2Fault: double, Min=0, Max=1  % 2号侧向毫米波雷达故障
  LateralRadar3Fault: double, Min=0, Max=1  % 3号侧向毫米波雷达故障
  LateralRadar4Fault: double, Min=0, Max=1  % 4号侧向毫米波雷达故障
  LateralRadar5Fault: double, Min=0, Max=1  % 5号侧向毫米波雷达故障
  LateralRadar6Fault: double, Min=0, Max=1  % 6号侧向毫米波雷达故障
  LateralRadar7Fault: double, Min=0, Max=1  % 7号侧向毫米波雷达故障
  LateralRadar8Fault: double, Min=0, Max=1  % 8号侧向毫米波雷达故障
  LateralRadar9Fault: double, Min=0, Max=1  % 9号侧向毫米波雷达故障
  LateralRadar10Fault: double, Min=0, Max=1  % 10号侧向毫米波雷达故障
  LateralRadar11Fault: double, Min=0, Max=1  % 11号侧向毫米波雷达故障
  LateralRadar12Fault: double, Min=0, Max=1  % 12号侧向毫米波雷达故障
  LateralRadar13Fault: double, Min=0, Max=1  % 13号侧向毫米波雷达故障
  LateralRadar14Fault: double, Min=0, Max=1  % 14号侧向毫米波雷达故障
  LateralRadar15Fault: double, Min=0, Max=1  % 15号侧向毫米波雷达故障
  LateralRadar16Fault: double, Min=0, Max=1  % 16号侧向毫米波雷达故障
  LateralRadar17Fault: double, Min=0, Max=1  % 17号侧向毫米波雷达故障
  LateralRadar18Fault: double, Min=0, Max=1  % 18号侧向毫米波雷达故障
  GNSSWeek: double, Min=0, Max=9999  % 组合惯导接收到的自1980-1-6 至当前的星期数（接收机时间）
  GNSSTime: double, Min=0, Max=999999.999  % 组合惯导接收到的当前星期内经过的秒数（接收机时间）
  GNSSHeadingAngle: double, Min=0, Max=359.99  % 组合惯导航向角
  GNSSPitchAngle: double, Min=-90, Max=90  % 组合惯导俯仰角
  GNSSRollAngle: double, Min=-180, Max=180  % 组合惯导横滚角
  GNSSLatitude: double, Min=-90, Max=90  % 组合惯导纬度
  GNSSLongitude: double, Min=-180, Max=180  % 组合惯导经度
  GNSSAltitude: double, Min=-200, Max=8000  % 组合惯导高度
  GNSSEastSpeed: double, Min=-20, Max=20  % 组合惯导东向速度
  GNSSNorthSpeed: double, Min=-20, Max=20  % 组合惯导北向速度
  GNSSUpperSpeed: double, Min=-20, Max=20  % 组合惯导天向速度
  GNSSBaseline: double, Min=0, Max=30  % 组合惯导基线长度
  GNSSFrontAntennaSatelliteNumber: double, Min=0, Max=99  % 组合惯导前天线可用卫星数
  GNSSRearAntennaSatelliteNumber: double, Min=0, Max=99  % 组合惯导后天线可用卫星数
  GNSSWorkStatus: double, Min=0, Max=255  % 组合惯导工作状态
  LateralControlExecuteWord: double, Min=0, Max=65535  % 横向控制执行状态字
  IDSSetTractionBlock: double, Min=0, Max=1  % 智能驾驶系统输出牵引封锁
  IDSSetSafeBrake: double, Min=0, Max=1  % 智能驾驶系统输出安全制动
  GNSSAngleSpeedX: double, Min=-360, Max=360  % 组合惯导X角速度
  GNSSAngleSpeedY: double, Min=-360, Max=360  % 组合惯导Y角速度
  GNSSAngleSpeedZ: double, Min=-360, Max=360  % 组合惯导Z角速度
  GNSSAccelerationX: double, Min=-1, Max=1  % 组合惯导X加速度
  GNSSAccelerationY: double, Min=-1, Max=1  % 组合惯导Y加速度
  GNSSAccelerationZ: double, Min=-1, Max=1  % 组合惯导Z加速度
  GNSSTemperature: double, Min=-40, Max=55  % 组合惯导温度
  A0Offset: double, Min=-0.5, Max=0.5  % 循迹线轨迹偏差A0偏置
  A1Offset: double, Min=-0.1, Max=0.1  % 循迹线斜率A1偏置
  SteeringWheelAngleOffset: double, Min=-128, Max=127  % 方向盘转向角度偏置
  FilteredA0: double, Min=-10.24, Max=10.23  % 滤波后的循迹线轨迹偏差A0
  FilteredA1: double, Min=-1.024, Max=1.023  % 滤波后的循迹线斜率A1
  FilteredA2: double, Min=-0.08192, Max=0.08191  % 滤波后的循迹线曲率A2
  FilteredA3: double, Min=-0.0002048, Max=0.0002047  % 滤波后的循迹线曲率变化率A3
  PreviewLateralOffset: double, Min=-10.24, Max=10.23  % 预瞄处的横向轨迹偏差
  PreviewAngleOffset: double, Min=-1.024, Max=1.023  % 预瞄处的角度偏差
  LDWImageStatus: double, Min=0, Max=4  % 车道偏离预警图标状态显示
  AutonomousTrackingAlarmSound: double, Min=0, Max=15  % 自动循迹声音报警
  TrackingCameraSoftwareVersionHigh4Byte: double, Min=0, Max=4294967295  % 循迹摄像头软件版本高4字节
  TrackingCameraSoftwareVersionlow4Byte: double, Min=0, Max=4294967295  % 循迹摄像头软件版本低4字节
  TrackingCameraCommunicationFault: double, Min=0, Max=1  % 循迹摄像头通信故障
  EPSFault: double, Min=0, Max=1  % 线控转向控制器故障
  GNSSFault: double, Min=0, Max=1  % 组合惯导故障
  TCSNCommunicationFault: double, Min=0, Max=1  % 整车网络通信故障
  EPS_FL1_TQS_OVERFLOW: double, Min=0, Max=1  % 线控转向系统副力矩不在设计范围内
  EPS_FL1_TQM_OVERFLOW: double, Min=0, Max=1  % 线控转向系统主力矩不在设计范围内
  EPS_FL1_TQ_NOT_MATCH: double, Min=0, Max=1  % 线控转向系统主副力矩信号不匹配
  EPS_FL1_VSENSOR_F: double, Min=0, Max=1  % 线控转向系统传感器电源电压不正常
  EPS_FL1_VMOTOR_F: double, Min=0, Max=1  % 线控转向系统电机电压不正常
  EPS_FL1_CMOTOR_F: double, Min=0, Max=1  % 线控转向系统电机电流不正常
  EPS_FL1_DRIVER_CIR_F: double, Min=0, Max=1  % 线控转向系统驱动电路失效
  EPS_FL1_CDIFF_EX: double, Min=0, Max=1  % 线控转向系统实际和目标电流差异过大
  EPS_FL1_RELAY_FAIL: double, Min=0, Max=1  % 线控转向系统控制器继电器失效
  EPS_FL1_SIGN_AD_FAIL: double, Min=0, Max=1  % 线控转向系统控制器信号调理电路失效
  EPS_FL2_BAT_VHIGH: double, Min=0, Max=1  % 线控转向系统电源电压过高
  EPS_FL2_BAT_VLOW: double, Min=0, Max=1  % 线控转向系统电源电压过低
  EPS_FL2_VSPD_F: double, Min=0, Max=1  % 线控转向系统车速信号异常
  EPS_FL2_SPD_LOST: double, Min=0, Max=1  % 线控转向系统CAN车速报文丢失
  EPS_FL3_CAN_Lost: double, Min=0, Max=1  % 线控转向系统CAN指令丢失
  LateralRadar1Fault_2: double, Min=0, Max=1  % 1号侧向毫米波雷达故障
  LateralRadar2Fault_2: double, Min=0, Max=1  % 2号侧向毫米波雷达故障
  LateralRadar3Fault_2: double, Min=0, Max=1  % 3号侧向毫米波雷达故障
  LateralRadar4Fault_2: double, Min=0, Max=1  % 4号侧向毫米波雷达故障
  LateralRadar5Fault_2: double, Min=0, Max=1  % 5号侧向毫米波雷达故障
  LateralRadar6Fault_2: double, Min=0, Max=1  % 6号侧向毫米波雷达故障
  LateralRadar7Fault_2: double, Min=0, Max=1  % 7号侧向毫米波雷达故障
  LateralRadar8Fault_2: double, Min=0, Max=1  % 8号侧向毫米波雷达故障
  LateralRadar9Fault_2: double, Min=0, Max=1  % 9号侧向毫米波雷达故障
  LateralRadar10Fault_2: double, Min=0, Max=1  % 10号侧向毫米波雷达故障
  LateralRadar11Fault_2: double, Min=0, Max=1  % 11号侧向毫米波雷达故障
  LateralRadar12Fault_2: double, Min=0, Max=1  % 12号侧向毫米波雷达故障
  LateralRadar13Fault_2: double, Min=0, Max=1  % 13号侧向毫米波雷达故障
  LateralRadar14Fault_2: double, Min=0, Max=1  % 14号侧向毫米波雷达故障
  LateralRadar15Fault_2: double, Min=0, Max=1  % 15号侧向毫米波雷达故障
  LateralRadar16Fault_2: double, Min=0, Max=1  % 16号侧向毫米波雷达故障
  LateralRadar17Fault_2: double, Min=0, Max=1  % 17号侧向毫米波雷达故障
  LateralRadar18Fault_2: double, Min=0, Max=1  % 18号侧向毫米波雷达故障
  EPS_FL1_UVW_F: double, Min=0, Max=1  % 线控转向系统位置传感器UVW信号错误
  EPS_FL1_SIGN_AB_F: double, Min=0, Max=1  % 线控转向系统位置传感器AB信号错误
  EPS_FL1_VPOS_SEN_F: double, Min=0, Max=1  % 线控转向系统位置传感器电压不正常
  EPS_FL1_MotorCur_F: double, Min=0, Max=1  % 线控转向系统电机电流不正常S1
  EPS_FL1_AD_OFFSET_DF: double, Min=0, Max=1  % 线控转向系统AD上电offset检测错误
  EPS_FL1_V_F: double, Min=0, Max=1  % 线控转向系统电压不正常S1
  EPS_FL1_Vbus_Short: double, Min=0, Max=1  % 线控转向系统上电Vbus短路
  EPS_FL1_Relay_Bonding: double, Min=0, Max=1  % 线控转向系统继电器粘连错误
  EPS_FL1_V_Diff_F: double, Min=0, Max=1  % 线控转向系统电源电压前后电路检测不一致
  EPS_FL1_V_F_longtime: double, Min=0, Max=1  % 线控转向系统长时间电压不正常错误
  EPS_FL1_IG_F: double, Min=0, Max=1  % 线控转向系统点火电路故障
  EPS_FL1_5V_abnormal: double, Min=0, Max=1  % 线控转向系统Power 5V abnormal
  EPS_FL1_5V_from_65381: double, Min=0, Max=1  % 线控转向系统Power 5V from 65381
  EPS_FL3_CAN_ANGOVERFLOW: double, Min=0, Max=1  % 线控转向系统CAN指令角度不在设计范围
  EPS_FL3_CALIB_ERR: double, Min=0, Max=1  % 线控转向系统标定错误
  EPS_FL3_TEMP_PROT_L1: double, Min=0, Max=1  % 线控转向系统温度保护Level1
  EPS_FL3_AB_CAL_ERR: double, Min=0, Max=1  % 线控转向系统AB值角度计算错误
  EPS_FL2_TEMP_PROT_L2: double, Min=0, Max=1  % 线控转向系统温度保护Level2
  EPS_FL3_SIGNA_F: double, Min=0, Max=1  % 线控转向系统转角A信号不正常
  EPS_FL3_SIGNR_F: double, Min=0, Max=1  % 线控转向系统转角R信号不正常
  EPS_FL3_ANG_SEN_LOST: double, Min=0, Max=1  % 线控转向系统或者CAN转角传感器丢失
  EPS_FL3_LOGIC_ANG_ER: double, Min=0, Max=1  % 线控转向系统转角计算逻辑异常
  EPS_FL2_DVSPD_F: double, Min=0, Max=1  % 线控转向系统车速信号变化异常
  EPS_FL2_CAN_BUSOFF: double, Min=0, Max=1  % 线控转向系统CAN-BUSOFF
  EPS_FL2_ENGSPD_F: double, Min=0, Max=1  % 线控转向系统CAN发动机转速报文异常
  EPS_FL2_ENGSPD_LOST: double, Min=0, Max=1  % 线控转向系统CAN发动机转速报文丢失
  EPS_FL1_Motor_PhaseLost: double, Min=0, Max=1  % 线控转向系统电机缺相
  EPS_FL1_Motor_PhaseLost_BC: double, Min=0, Max=1  % 线控转向系统电机缺相BC
  EPSCommunicationFault: double, Min=0, Max=1  % 线控转向控制器通信故障
  AutonomousTrackingCameraConfidenceLowFault: double, Min=0, Max=1  % 循迹视觉输入置信度低故障
  SteeringAxleAngleSensorFault: double, Min=0, Max=1  % 转向轴角度传感器故障
  AutonomousTrackingCameraDataUnchangedAbnormalFault: double, Min=0, Max=1  % 前视道路标识线摄像头识别数据不变异常故障
  LaneDeviationOutOfBoundaryFault: double, Min=0, Max=1  % 车道偏离超过边界故障
  TCSNLife: double, Min=0, Max=255  % 整车网络控制系统生命信号
  Year: double, Min=0, Max=99  % 时间轴 年
  Month: double, Min=1, Max=12  % 时间轴 月
  Day: double, Min=1, Max=31  % 时间轴 日
  Hour: double, Min=0, Max=23  % 时间轴 时
  Minute: double, Min=0, Max=59  % 时间轴 分
  Second: double, Min=0, Max=59  % 时间轴 秒
  TramSpeed: double, Min=0, Max=80  % 整车车速
  MC1ArticulatedAngle: double, Min=-60, Max=60  % MC1与TP间铰接盘角度
  MC2ArticulatedAngle: double, Min=-60, Max=60  % MC2与TP间铰接盘角度
  SteeringAxle1Angle: double, Min=-25, Max=25  % 轴1转向角度
  SteeringAxle6Angle: double, Min=-25, Max=25  % 轴6转向角度
  TGS1FaultStatus: double, Min=0, Max=1  % 无轨导向控制器1故障状态（指代MC1端收到的无轨导向系统故障状态）
  MC1AutonomousTracking: double, Min=0, Max=1  % MC1自动循迹
  MC1TurnLeftIndicator: double, Min=0, Max=1  % MC1左转向灯
  MC1TurnRightIndicator: double, Min=0, Max=1  % MC1右转向灯
  MC1OccupiedStatus: double, Min=0, Max=1  % MC1占有状态
  MC1DriveBackward: double, Min=0, Max=1  % MC1行车方向向后
  MC1OilPumpStatus: double, Min=0, Max=1  % MC1助力油泵状态
  MC1ParkingStatus: double, Min=0, Max=1  % MC1驻车状态
  MC2AutonomousTracking: double, Min=0, Max=1  % MC2自动循迹
  MC2TurnLeftIndicator: double, Min=0, Max=1  % MC2左转向灯
  MC2TurnRightIndicator: double, Min=0, Max=1  % MC2右转向灯
  MC2OccupiedStatus: double, Min=0, Max=1  % MC2占有状态
  MC2DriveBackward: double, Min=0, Max=1  % MC2行车方向向后
  MC2OilPumpStatus: double, Min=0, Max=1  % MC2助力油泵状态
  MC2ParkingStatus: double, Min=0, Max=1  % MC2驻车状态
  LateralControlWarning: double, Min=0, Max=4294967295  % 横向控制警告（不构成手动接管条件，关注的状态位集合）
  VisionSetFirstSteeringAxleAngle: double, Min=-25, Max=25  % 视觉循迹设置头轴转向角度
  SteeringWheelAngle: double, Min=-1575, Max=1575  % 方向盘转向角度
  DesiredAdditionalTorque: double, Min=-12.8, Max=12.7  % 期望电机叠加扭矩
  MotorPowerTorque: double, Min=-5, Max=4.96132  % 线控转向系统电机助力扭矩
  SteeringWheelTorque: double, Min=-8.96, Max=8.89  % 方向盘转向扭矩
  LateralRadarAlarmSound: double, Min=0, Max=3  % 侧向毫米波雷达声音报警
  LateralRadar1RedAlarm: double, Min=0, Max=1  % 1号侧向毫米波雷达红色预警
  LateralRadar2RedAlarm: double, Min=0, Max=1  % 2号侧向毫米波雷达红色预警
  LateralRadar3RedAlarm: double, Min=0, Max=1  % 3号侧向毫米波雷达红色预警
  LateralRadar4RedAlarm: double, Min=0, Max=1  % 4号侧向毫米波雷达红色预警
  LateralRadar5RedAlarm: double, Min=0, Max=1  % 5号侧向毫米波雷达红色预警
  LateralRadar6RedAlarm: double, Min=0, Max=1  % 6号侧向毫米波雷达红色预警
  LateralRadar7RedAlarm: double, Min=0, Max=1  % 7号侧向毫米波雷达红色预警
  LateralRadar8RedAlarm: double, Min=0, Max=1  % 8号侧向毫米波雷达红色预警
  LateralRadar9RedAlarm: double, Min=0, Max=1  % 9号侧向毫米波雷达红色预警
  LateralRadar10RedAlarm: double, Min=0, Max=1  % 10号侧向毫米波雷达红色预警
  LateralRadar11RedAlarm: double, Min=0, Max=1  % 11号侧向毫米波雷达红色预警
  LateralRadar12RedAlarm: double, Min=0, Max=1  % 12号侧向毫米波雷达红色预警
  LateralRadar13RedAlarm: double, Min=0, Max=1  % 13号侧向毫米波雷达红色预警
  LateralRadar14RedAlarm: double, Min=0, Max=1  % 14号侧向毫米波雷达红色预警
  LateralRadar15RedAlarm: double, Min=0, Max=1  % 15号侧向毫米波雷达红色预警
  LateralRadar16RedAlarm: double, Min=0, Max=1  % 16号侧向毫米波雷达红色预警
  LateralRadar17RedAlarm: double, Min=0, Max=1  % 17号侧向毫米波雷达红色预警
  LateralRadar18RedAlarm: double, Min=0, Max=1  % 18号侧向毫米波雷达红色预警
  GNSSCommunicationFault: double, Min=0, Max=1  % 组合惯导通信故障
  TramYawRate: double, Min=-100.59776, Max=100.59469  % 列车横摆角速度(转发给摄像头)
  SteeringAxle2Angle: double, Min=-25, Max=25  % 轴2转向角度
  SteeringAxle5Angle: double, Min=-25, Max=25  % 轴5转向角度
  IDSLife: double, Min=0, Max=255  % 智能驾驶系统生命信号
  SurroundingCameraDisplaySwitch: double, Min=90, Max=165  % 周界环视画面切换指令
  LateralControlSoftwareVersion: double, Min=0, Max=65535  % 横向控制程序版本
  LDWImageStatus_2: double, Min=0, Max=4  % 车道偏离预警图标状态显示
  AutonomousTrackingWorkStatus: double, Min=0, Max=1  % 自动循迹工作状态
  AutonomousTrackingFaultStatus: double, Min=0, Max=1  % 自动循迹故障状态
  AutonomousTrackingAlarmSound_2: double, Min=0, Max=15  % 自动循迹声音报警
  OriginalA0: double, Min=-10.24, Max=10.23  % 循迹线轨迹偏差A0
  OriginalA1: double, Min=-1.024, Max=1.023  % 循迹线斜率A1
  OriginalA2: double, Min=-0.08192, Max=0.08191  % 循迹线曲率A2
  OriginalA3: double, Min=-0.0002048, Max=0.0002047  % 循迹线曲率变化率A3
  GNSSLife: double, Min=0, Max=255  % 组合惯导生命信号
  TrackingCameraLife: double, Min=0, Max=255  % 循迹摄像头生命信号
  EPSLife: double, Min=0, Max=255  % 线控转向系统生命信号
  GNSSLocationInvalidFault: double, Min=0, Max=1  % 组合惯导定位无效故障
  GNSSPositionOutOfBoundaryFault: double, Min=0, Max=1  % 组合惯导当前位置超过边界故障
  SteeringAxleAngleJumpAbnormalFault: double, Min=0, Max=1  % 转向轴角度异常突变故障
  SteeringWheelAngleJumpAbnormalFault: double, Min=0, Max=1  % 方向盘角度异常突变故障
  TramSpeedJumpAbnormalFault: double, Min=0, Max=1  % 整车速度异常突变故障
  A0JumpAbnormalFault: double, Min=0, Max=1  % A0异常突变故障
  A1JumpAbnormalFault: double, Min=0, Max=1  % A1异常突变故障
  A2JumpAbnormalFault: double, Min=0, Max=1  % A2异常突变故障
  ENUYawAngleJumpAbnormalFault: double, Min=0, Max=1  % 东北天坐标系下横摆角异常突变故障
  ENUXJumpAbnormalFault: double, Min=0, Max=1  % 东北天坐标系下x坐标异常突变故障
  ENUYJumpAbnormalFault: double, Min=0, Max=1  % 东北天坐标系下y坐标异常突变故障
  MMUCommunicationFault: double, Min=0, Max=1  % 地图管理单元通信故障
  EPSWorkStatus: double, Min=0, Max=15  % 线控转向系统工作状态
  DesiredEPSWorkMode: double, Min=0, Max=15  % 期望线控转向系统工作模式
  AutonomousTrackingCameraConfidence: double, Min=0, Max=1  % 循迹摄像头置信度
  LocationValidStatus: double, Min=0, Max=1  % 定位有效状态
  PreventAutoTrackingStatus: double, Min=0, Max=1  % 阻止自动循迹状态
  TaskIndex: double, Min=0, Max=255  % 任务代号
  BaseInterventionCondition: double, Min=0, Max=4294967295  % 基本手动接管条件
  VisionInterventionCondition: double, Min=0, Max=4294967295  % 视觉循迹手动接管条件
  GNSSInterventionCondition: double, Min=0, Max=4294967295  % GNSS循迹手动接管条件
  TramTypeIndex: double, Min=0, Max=255  % 车型索引
  StateFlowLateralControlMethod: double, Min=0, Max=255  % 横向控制方法转移到的状态
  StateFlowLateralControlMode: double, Min=0, Max=255  % 横向控制模式转移到的状态
  StateFlowManualDrivingMode: double, Min=0, Max=255  % 手动驾驶模式转移到的状态
  StateFlowAutoTrackingMode: double, Min=0, Max=255  % 循迹驾驶模式转移到的状态
  StateFlowWaitInterventionMode: double, Min=0, Max=255  % 等待接管模式转移到的状态
  VisionPriorityCurrent: double, Min=0, Max=3  % 当前视觉循迹优先级
  GNSSPriorityCurrent: double, Min=0, Max=3  % 当前GNSS循迹优先级
  LateralControlMethodCurrent: double, Min=0, Max=2  % 本周期横向控制方法
  LaneDeviationTolerance: double, Min=0.3, Max=0.6  % 列车偏离循迹线的阈值
  StateFlowAlarmVoiceMode: double, Min=0, Max=255  % 报警声音模式转移到的状态
  StateFlowManualDrivingAlarmVoice: double, Min=0, Max=255  % 手动驾驶时报警声音转移到的状态
  StateFlowAutoTrackingAlarmVoice: double, Min=0, Max=255  % 循迹驾驶时报警声音转移到的状态
  DesiredSteeringWheelAngle: double, Min=-600, Max=600  % 期望方向盘转向角度
  DesiredSteeringAxleAngle: double, Min=-15, Max=15  % 目标转向轴转角
  StateFlowSetSteeringWheelAngleSignalProcessingMode: double, Min=0, Max=255  % 目标方向盘转角信号处理模式转移到的状态
  StateFlowConfidenceCheck: double, Min=0, Max=255  % 前视道路标识线摄像头置信度检查转移到的状态
  StateFlowDataUnchangedAbnormalCheck: double, Min=0, Max=255  % 前视道路标识线摄像头识别数据不变异常检查转移到的状态
  DistanceOffsetPreviewPointYawAngle: double, Min=-179.99, Max=180  % 本周期距离偏差预瞄点横摆角
  DistanceOffsetPreviewPointX: double, Min=-10000000, Max=10000000  % 本周期距离偏差预瞄点x坐标
  DistanceOffsetPreviewPointY: double, Min=-10000000, Max=10000000  % 本周期距离偏差预瞄点y坐标
  TramKinematicModelYawRate: double, Min=-100, Max=100  % 根据列车运动学模型计算得到的横摆角速度
  TramKinematicModelSpeedX: double, Min=-22.22, Max=22.22  % 根据列车运动学模型计算得到的x轴向速度
  TramKinematicModelSpeedY: double, Min=-22.22, Max=22.22  % 根据列车运动学模型计算得到的y轴向速度
  TramKinematicModelSlipAngle: double, Min=-100, Max=100  % 根据列车运动学模型计算得到的侧偏角度
  ExecuteDelayEstimatedYawAngle: double, Min=-1000000000, Max=1000000000  % 考虑执行滞后而估计的东北天坐标系下横摆角
  ExecuteDelayEstimatedX: double, Min=-10000000, Max=10000000  % 考虑执行滞后而估计的东北天坐标系下x坐标
  ExecuteDelayEstimatedY: double, Min=-10000000, Max=10000000  % 考虑执行滞后而估计的东北天坐标系下y坐标
  StateFlowTramSpeedCheck: double, Min=0, Max=255  % 列车速度检查转移到的状态
  StateFlowLaneCurvatureCheck: double, Min=0, Max=255  % 标识线曲率检查转移到的状态
  StateFlowLaneSlopeCheck: double, Min=0, Max=255  % 标识线斜率率检查转移到的状态
  StateFlowLaneSmallCurvatureCheck: double, Min=0, Max=255  % 标识线小曲率检查转移到的状态
  GNSSPreviewTime: double, Min=0, Max=10  % GNSS预瞄时间
  GNSSMinPreviewDistance: double, Min=0, Max=20  % GNSS最小预瞄距离
  StanleyLateralOffsetFactor: double, Min=0, Max=20  % Stanley横向偏差矫正系数
  SteeringAxleAngleFactor: double, Min=0, Max=20  % 转向轴转角矫正系数
  StanleySetSteeringAxleAngle: double, Min=-15, Max=15  % Stanley输出目标转向轴转角
  ClosestPointYawAngle: double, Min=-179.99, Max=180  % 参考轨迹上的最近点横摆角
  ClosestPointX: double, Min=-10000000, Max=10000000  % 参考轨迹上的最近点x坐标
  ClosestPointY: double, Min=-10000000, Max=10000000  % 参考轨迹上的最近点y坐标
  ClosestPointCurvature: double, Min=-0.0667, Max=0.0667  % 参考轨迹上的最近点曲率
  ClosestPointSegmentIndex: double, Min=1, Max=120  % 参考轨迹上的最近点隶属区间代号
  AngleOffsetPreviewPointYawAngle: double, Min=-179.99, Max=180  % 本周期角度偏差预瞄点横摆角
  AngleOffsetPreviewPointX: double, Min=-10000000, Max=10000000  % 本周期角度偏差预瞄点x坐标
  AngleOffsetPreviewPointY: double, Min=-10000000, Max=10000000  % 本周期角度偏差预瞄点y坐标
  GNSSPreviewLateralOffset: double, Min=-10000000, Max=10000000  % GNSS预瞄处横向偏差
  NearLateralOffsetCurrent: double, Min=-10000000, Max=10000000  % 在线规划之后的本周期近处横向偏差
  GNSSPreviewAngleOffset: double, Min=-179.99, Max=180  % GNSS预瞄处角度偏差
  GNSSAngleOffsetPreviewDistance: double, Min=0, Max=30  % GNSS角度偏差预瞄距离
  ReferenceTrajectoryClosestSegmentStartPointIndex: double, Min=0, Max=6000  % 本周期最近线段起始点索引
  GNSSDistanceOffsetPreviewDistance: double, Min=0, Max=30  % GNSS距离偏差预瞄距离
  DesiredSteeringWheelAngleSpeed: double, Min=50, Max=540  % 期望方向盘角速度
  LocalReferenceTrajectoryPointNumber2Control: double, Min=0, Max=6000  % 输入给控制的局部参考轨迹路点数量
  LocalReferenceTrajectoryPoint1X2Control: double, Min=-10000000, Max=10000000  % 输入给控制的局部参考轨迹第1个点x坐标
  LocalReferenceTrajectoryPoint1Y2Control: double, Min=-10000000, Max=10000000  % 输入给控制的局部参考轨迹第1个点y坐标
  AngleOffsetPreviewPointCurvature: double, Min=-0.0667, Max=0.0667  % 本周期角度偏差预瞄点曲率
  MaxAbsoluteCurvature: double, Min=0, Max=0.0667  % 最近点和预瞄点曲率绝对值之间的最大值
  SteeringWheelAngleSpeed: double, Min=50, Max=540  % 方向盘转向角速度
  DistanceOffsetPreviewPointCurvature: double, Min=-0.0667, Max=0.0667  % 本周期距离偏差预瞄点曲率
  FilteredTramSpeed: double, Min=0, Max=22.3  % 滤波后的整车车速
  GNSSTrajectoryDeviationTolerance: double, Min=0.3, Max=2  % 列车偏离GNSS参考轨迹的阈值

MC1_MMU2IDS_POINT = Simulink.Bus()  % MC1_MMU2IDS_POINT
  WayPointDataLife: double, Min=0, Max=255  % 路点属性数据生命信号
  WayPointNumber: double, Min=0, Max=60  % 有效路点总数
  WayPoint1YawAngle: double, Min=-179.99, Max=180  % 第1个路点横摆角
  WayPoint1X: double, Min=-10000000, Max=10000000  % 第1个路点x坐标
  WayPoint1Y: double, Min=-10000000, Max=10000000  % 第1个路点y坐标
  WayPoint1Curvature: double, Min=-0.0667, Max=0.0667  % 第1个路点曲率
  WayPoint2YawAngle: double, Min=-179.99, Max=180  % 第2个路点横摆角
  WayPoint2X: double, Min=-10000000, Max=10000000  % 第2个路点x坐标
  WayPoint2Y: double, Min=-10000000, Max=10000000  % 第2个路点y坐标
  WayPoint2Curvature: double, Min=-0.0667, Max=0.0667  % 第2个路点曲率
  WayPoint3YawAngle: double, Min=-179.99, Max=180  % 第3个路点横摆角
  WayPoint3X: double, Min=-10000000, Max=10000000  % 第3个路点x坐标
  WayPoint3Y: double, Min=-10000000, Max=10000000  % 第3个路点y坐标
  WayPoint3Curvature: double, Min=-0.0667, Max=0.0667  % 第3个路点曲率
  WayPoint4YawAngle: double, Min=-179.99, Max=180  % 第4个路点横摆角
  WayPoint4X: double, Min=-10000000, Max=10000000  % 第4个路点x坐标
  WayPoint4Y: double, Min=-10000000, Max=10000000  % 第4个路点y坐标
  WayPoint4Curvature: double, Min=-0.0667, Max=0.0667  % 第4个路点曲率
  WayPoint5YawAngle: double, Min=-179.99, Max=180  % 第5个路点横摆角
  WayPoint5X: double, Min=-10000000, Max=10000000  % 第5个路点x坐标
  WayPoint5Y: double, Min=-10000000, Max=10000000  % 第5个路点y坐标
  WayPoint5Curvature: double, Min=-0.0667, Max=0.0667  % 第5个路点曲率
  WayPoint6YawAngle: double, Min=-179.99, Max=180  % 第6个路点横摆角
  WayPoint6X: double, Min=-10000000, Max=10000000  % 第6个路点x坐标
  WayPoint6Y: double, Min=-10000000, Max=10000000  % 第6个路点y坐标
  WayPoint6Curvature: double, Min=-0.0667, Max=0.0667  % 第6个路点曲率
  WayPoint7YawAngle: double, Min=-179.99, Max=180  % 第7个路点横摆角
  WayPoint7X: double, Min=-10000000, Max=10000000  % 第7个路点x坐标
  WayPoint7Y: double, Min=-10000000, Max=10000000  % 第7个路点y坐标
  WayPoint7Curvature: double, Min=-0.0667, Max=0.0667  % 第7个路点曲率
  WayPoint8YawAngle: double, Min=-179.99, Max=180  % 第8个路点横摆角
  WayPoint8X: double, Min=-10000000, Max=10000000  % 第8个路点x坐标
  WayPoint8Y: double, Min=-10000000, Max=10000000  % 第8个路点y坐标
  WayPoint8Curvature: double, Min=-0.0667, Max=0.0667  % 第8个路点曲率
  WayPoint9YawAngle: double, Min=-179.99, Max=180  % 第9个路点横摆角
  WayPoint9X: double, Min=-10000000, Max=10000000  % 第9个路点x坐标
  WayPoint9Y: double, Min=-10000000, Max=10000000  % 第9个路点y坐标
  WayPoint9Curvature: double, Min=-0.0667, Max=0.0667  % 第9个路点曲率
  WayPoint10YawAngle: double, Min=-179.99, Max=180  % 第10个路点横摆角
  WayPoint10X: double, Min=-10000000, Max=10000000  % 第10个路点x坐标
  WayPoint10Y: double, Min=-10000000, Max=10000000  % 第10个路点y坐标
  WayPoint10Curvature: double, Min=-0.0667, Max=0.0667  % 第10个路点曲率
  WayPoint11YawAngle: double, Min=-179.99, Max=180  % 第11个路点横摆角
  WayPoint11X: double, Min=-10000000, Max=10000000  % 第11个路点x坐标
  WayPoint11Y: double, Min=-10000000, Max=10000000  % 第11个路点y坐标
  WayPoint11Curvature: double, Min=-0.0667, Max=0.0667  % 第11个路点曲率
  WayPoint12YawAngle: double, Min=-179.99, Max=180  % 第12个路点横摆角
  WayPoint12X: double, Min=-10000000, Max=10000000  % 第12个路点x坐标
  WayPoint12Y: double, Min=-10000000, Max=10000000  % 第12个路点y坐标
  WayPoint12Curvature: double, Min=-0.0667, Max=0.0667  % 第12个路点曲率
  WayPoint13YawAngle: double, Min=-179.99, Max=180  % 第13个路点横摆角
  WayPoint13X: double, Min=-10000000, Max=10000000  % 第13个路点x坐标
  WayPoint13Y: double, Min=-10000000, Max=10000000  % 第13个路点y坐标
  WayPoint13Curvature: double, Min=-0.0667, Max=0.0667  % 第13个路点曲率
  WayPoint14YawAngle: double, Min=-179.99, Max=180  % 第14个路点横摆角
  WayPoint14X: double, Min=-10000000, Max=10000000  % 第14个路点x坐标
  WayPoint14Y: double, Min=-10000000, Max=10000000  % 第14个路点y坐标
  WayPoint14Curvature: double, Min=-0.0667, Max=0.0667  % 第14个路点曲率
  WayPoint15YawAngle: double, Min=-179.99, Max=180  % 第15个路点横摆角
  WayPoint15X: double, Min=-10000000, Max=10000000  % 第15个路点x坐标
  WayPoint15Y: double, Min=-10000000, Max=10000000  % 第15个路点y坐标
  WayPoint15Curvature: double, Min=-0.0667, Max=0.0667  % 第15个路点曲率
  WayPoint16YawAngle: double, Min=-179.99, Max=180  % 第16个路点横摆角
  WayPoint16X: double, Min=-10000000, Max=10000000  % 第16个路点x坐标
  WayPoint16Y: double, Min=-10000000, Max=10000000  % 第16个路点y坐标
  WayPoint16Curvature: double, Min=-0.0667, Max=0.0667  % 第16个路点曲率
  WayPoint17YawAngle: double, Min=-179.99, Max=180  % 第17个路点横摆角
  WayPoint17X: double, Min=-10000000, Max=10000000  % 第17个路点x坐标
  WayPoint17Y: double, Min=-10000000, Max=10000000  % 第17个路点y坐标
  WayPoint17Curvature: double, Min=-0.0667, Max=0.0667  % 第17个路点曲率
  WayPoint18YawAngle: double, Min=-179.99, Max=180  % 第18个路点横摆角
  WayPoint18X: double, Min=-10000000, Max=10000000  % 第18个路点x坐标
  WayPoint18Y: double, Min=-10000000, Max=10000000  % 第18个路点y坐标
  WayPoint18Curvature: double, Min=-0.0667, Max=0.0667  % 第18个路点曲率
  WayPoint19YawAngle: double, Min=-179.99, Max=180  % 第19个路点横摆角
  WayPoint19X: double, Min=-10000000, Max=10000000  % 第19个路点x坐标
  WayPoint19Y: double, Min=-10000000, Max=10000000  % 第19个路点y坐标
  WayPoint19Curvature: double, Min=-0.0667, Max=0.0667  % 第19个路点曲率
  WayPoint20YawAngle: double, Min=-179.99, Max=180  % 第20个路点横摆角
  WayPoint20X: double, Min=-10000000, Max=10000000  % 第20个路点x坐标
  WayPoint20Y: double, Min=-10000000, Max=10000000  % 第20个路点y坐标
  WayPoint20Curvature: double, Min=-0.0667, Max=0.0667  % 第20个路点曲率
  WayPoint21YawAngle: double, Min=-179.99, Max=180  % 第21个路点横摆角
  WayPoint21X: double, Min=-10000000, Max=10000000  % 第21个路点x坐标
  WayPoint21Y: double, Min=-10000000, Max=10000000  % 第21个路点y坐标
  WayPoint21Curvature: double, Min=-0.0667, Max=0.0667  % 第21个路点曲率
  WayPoint22YawAngle: double, Min=-179.99, Max=180  % 第22个路点横摆角
  WayPoint22X: double, Min=-10000000, Max=10000000  % 第22个路点x坐标
  WayPoint22Y: double, Min=-10000000, Max=10000000  % 第22个路点y坐标
  WayPoint22Curvature: double, Min=-0.0667, Max=0.0667  % 第22个路点曲率
  WayPoint23YawAngle: double, Min=-179.99, Max=180  % 第23个路点横摆角
  WayPoint23X: double, Min=-10000000, Max=10000000  % 第23个路点x坐标
  WayPoint23Y: double, Min=-10000000, Max=10000000  % 第23个路点y坐标
  WayPoint23Curvature: double, Min=-0.0667, Max=0.0667  % 第23个路点曲率
  WayPoint24YawAngle: double, Min=-179.99, Max=180  % 第24个路点横摆角
  WayPoint24X: double, Min=-10000000, Max=10000000  % 第24个路点x坐标
  WayPoint24Y: double, Min=-10000000, Max=10000000  % 第24个路点y坐标
  WayPoint24Curvature: double, Min=-0.0667, Max=0.0667  % 第24个路点曲率
  WayPoint25YawAngle: double, Min=-179.99, Max=180  % 第25个路点横摆角
  WayPoint25X: double, Min=-10000000, Max=10000000  % 第25个路点x坐标
  WayPoint25Y: double, Min=-10000000, Max=10000000  % 第25个路点y坐标
  WayPoint25Curvature: double, Min=-0.0667, Max=0.0667  % 第25个路点曲率
  WayPoint26YawAngle: double, Min=-179.99, Max=180  % 第26个路点横摆角
  WayPoint26X: double, Min=-10000000, Max=10000000  % 第26个路点x坐标
  WayPoint26Y: double, Min=-10000000, Max=10000000  % 第26个路点y坐标
  WayPoint26Curvature: double, Min=-0.0667, Max=0.0667  % 第26个路点曲率
  WayPoint27YawAngle: double, Min=-179.99, Max=180  % 第27个路点横摆角
  WayPoint27X: double, Min=-10000000, Max=10000000  % 第27个路点x坐标
  WayPoint27Y: double, Min=-10000000, Max=10000000  % 第27个路点y坐标
  WayPoint27Curvature: double, Min=-0.0667, Max=0.0667  % 第27个路点曲率
  WayPoint28YawAngle: double, Min=-179.99, Max=180  % 第28个路点横摆角
  WayPoint28X: double, Min=-10000000, Max=10000000  % 第28个路点x坐标
  WayPoint28Y: double, Min=-10000000, Max=10000000  % 第28个路点y坐标
  WayPoint28Curvature: double, Min=-0.0667, Max=0.0667  % 第28个路点曲率
  WayPoint29YawAngle: double, Min=-179.99, Max=180  % 第29个路点横摆角
  WayPoint29X: double, Min=-10000000, Max=10000000  % 第29个路点x坐标
  WayPoint29Y: double, Min=-10000000, Max=10000000  % 第29个路点y坐标
  WayPoint29Curvature: double, Min=-0.0667, Max=0.0667  % 第29个路点曲率
  WayPoint30YawAngle: double, Min=-179.99, Max=180  % 第30个路点横摆角
  WayPoint30X: double, Min=-10000000, Max=10000000  % 第30个路点x坐标
  WayPoint30Y: double, Min=-10000000, Max=10000000  % 第30个路点y坐标
  WayPoint30Curvature: double, Min=-0.0667, Max=0.0667  % 第30个路点曲率
  WayPoint31YawAngle: double, Min=-179.99, Max=180  % 第31个路点横摆角
  WayPoint31X: double, Min=-10000000, Max=10000000  % 第31个路点x坐标
  WayPoint31Y: double, Min=-10000000, Max=10000000  % 第31个路点y坐标
  WayPoint31Curvature: double, Min=-0.0667, Max=0.0667  % 第31个路点曲率
  WayPoint32YawAngle: double, Min=-179.99, Max=180  % 第32个路点横摆角
  WayPoint32X: double, Min=-10000000, Max=10000000  % 第32个路点x坐标
  WayPoint32Y: double, Min=-10000000, Max=10000000  % 第32个路点y坐标
  WayPoint32Curvature: double, Min=-0.0667, Max=0.0667  % 第32个路点曲率
  WayPoint33YawAngle: double, Min=-179.99, Max=180  % 第33个路点横摆角
  WayPoint33X: double, Min=-10000000, Max=10000000  % 第33个路点x坐标
  WayPoint33Y: double, Min=-10000000, Max=10000000  % 第33个路点y坐标
  WayPoint33Curvature: double, Min=-0.0667, Max=0.0667  % 第33个路点曲率
  WayPoint34YawAngle: double, Min=-179.99, Max=180  % 第34个路点横摆角
  WayPoint34X: double, Min=-10000000, Max=10000000  % 第34个路点x坐标
  WayPoint34Y: double, Min=-10000000, Max=10000000  % 第34个路点y坐标
  WayPoint34Curvature: double, Min=-0.0667, Max=0.0667  % 第34个路点曲率
  WayPoint35YawAngle: double, Min=-179.99, Max=180  % 第35个路点横摆角
  WayPoint35X: double, Min=-10000000, Max=10000000  % 第35个路点x坐标
  WayPoint35Y: double, Min=-10000000, Max=10000000  % 第35个路点y坐标
  WayPoint35Curvature: double, Min=-0.0667, Max=0.0667  % 第35个路点曲率
  WayPoint36YawAngle: double, Min=-179.99, Max=180  % 第36个路点横摆角
  WayPoint36X: double, Min=-10000000, Max=10000000  % 第36个路点x坐标
  WayPoint36Y: double, Min=-10000000, Max=10000000  % 第36个路点y坐标
  WayPoint36Curvature: double, Min=-0.0667, Max=0.0667  % 第36个路点曲率
  WayPoint37YawAngle: double, Min=-179.99, Max=180  % 第37个路点横摆角
  WayPoint37X: double, Min=-10000000, Max=10000000  % 第37个路点x坐标
  WayPoint37Y: double, Min=-10000000, Max=10000000  % 第37个路点y坐标
  WayPoint37Curvature: double, Min=-0.0667, Max=0.0667  % 第37个路点曲率
  WayPoint38YawAngle: double, Min=-179.99, Max=180  % 第38个路点横摆角
  WayPoint38X: double, Min=-10000000, Max=10000000  % 第38个路点x坐标
  WayPoint38Y: double, Min=-10000000, Max=10000000  % 第38个路点y坐标
  WayPoint38Curvature: double, Min=-0.0667, Max=0.0667  % 第38个路点曲率
  WayPoint39YawAngle: double, Min=-179.99, Max=180  % 第39个路点横摆角
  WayPoint39X: double, Min=-10000000, Max=10000000  % 第39个路点x坐标
  WayPoint39Y: double, Min=-10000000, Max=10000000  % 第39个路点y坐标
  WayPoint39Curvature: double, Min=-0.0667, Max=0.0667  % 第39个路点曲率
  WayPoint40YawAngle: double, Min=-179.99, Max=180  % 第40个路点横摆角
  WayPoint40X: double, Min=-10000000, Max=10000000  % 第40个路点x坐标
  WayPoint40Y: double, Min=-10000000, Max=10000000  % 第40个路点y坐标
  WayPoint40Curvature: double, Min=-0.0667, Max=0.0667  % 第40个路点曲率
  WayPoint41YawAngle: double, Min=-179.99, Max=180  % 第41个路点横摆角
  WayPoint41X: double, Min=-10000000, Max=10000000  % 第41个路点x坐标
  WayPoint41Y: double, Min=-10000000, Max=10000000  % 第41个路点y坐标
  WayPoint41Curvature: double, Min=-0.0667, Max=0.0667  % 第41个路点曲率
  WayPoint42YawAngle: double, Min=-179.99, Max=180  % 第42个路点横摆角
  WayPoint42X: double, Min=-10000000, Max=10000000  % 第42个路点x坐标
  WayPoint42Y: double, Min=-10000000, Max=10000000  % 第42个路点y坐标
  WayPoint42Curvature: double, Min=-0.0667, Max=0.0667  % 第42个路点曲率
  WayPoint43YawAngle: double, Min=-179.99, Max=180  % 第43个路点横摆角
  WayPoint43X: double, Min=-10000000, Max=10000000  % 第43个路点x坐标
  WayPoint43Y: double, Min=-10000000, Max=10000000  % 第43个路点y坐标
  WayPoint43Curvature: double, Min=-0.0667, Max=0.0667  % 第43个路点曲率
  WayPoint44YawAngle: double, Min=-179.99, Max=180  % 第44个路点横摆角
  WayPoint44X: double, Min=-10000000, Max=10000000  % 第44个路点x坐标
  WayPoint44Y: double, Min=-10000000, Max=10000000  % 第44个路点y坐标
  WayPoint44Curvature: double, Min=-0.0667, Max=0.0667  % 第44个路点曲率
  WayPoint45YawAngle: double, Min=-179.99, Max=180  % 第45个路点横摆角
  WayPoint45X: double, Min=-10000000, Max=10000000  % 第45个路点x坐标
  WayPoint45Y: double, Min=-10000000, Max=10000000  % 第45个路点y坐标
  WayPoint45Curvature: double, Min=-0.0667, Max=0.0667  % 第45个路点曲率
  WayPoint46YawAngle: double, Min=-179.99, Max=180  % 第46个路点横摆角
  WayPoint46X: double, Min=-10000000, Max=10000000  % 第46个路点x坐标
  WayPoint46Y: double, Min=-10000000, Max=10000000  % 第46个路点y坐标
  WayPoint46Curvature: double, Min=-0.0667, Max=0.0667  % 第46个路点曲率
  WayPoint47YawAngle: double, Min=-179.99, Max=180  % 第47个路点横摆角
  WayPoint47X: double, Min=-10000000, Max=10000000  % 第47个路点x坐标
  WayPoint47Y: double, Min=-10000000, Max=10000000  % 第47个路点y坐标
  WayPoint47Curvature: double, Min=-0.0667, Max=0.0667  % 第47个路点曲率
  WayPoint48YawAngle: double, Min=-179.99, Max=180  % 第48个路点横摆角
  WayPoint48X: double, Min=-10000000, Max=10000000  % 第48个路点x坐标
  WayPoint48Y: double, Min=-10000000, Max=10000000  % 第48个路点y坐标
  WayPoint48Curvature: double, Min=-0.0667, Max=0.0667  % 第48个路点曲率
  WayPoint49YawAngle: double, Min=-179.99, Max=180  % 第49个路点横摆角
  WayPoint49X: double, Min=-10000000, Max=10000000  % 第49个路点x坐标
  WayPoint49Y: double, Min=-10000000, Max=10000000  % 第49个路点y坐标
  WayPoint49Curvature: double, Min=-0.0667, Max=0.0667  % 第49个路点曲率
  WayPoint50YawAngle: double, Min=-179.99, Max=180  % 第50个路点横摆角
  WayPoint50X: double, Min=-10000000, Max=10000000  % 第50个路点x坐标
  WayPoint50Y: double, Min=-10000000, Max=10000000  % 第50个路点y坐标
  WayPoint50Curvature: double, Min=-0.0667, Max=0.0667  % 第50个路点曲率
  WayPoint51YawAngle: double, Min=-179.99, Max=180  % 第51个路点横摆角
  WayPoint51X: double, Min=-10000000, Max=10000000  % 第51个路点x坐标
  WayPoint51Y: double, Min=-10000000, Max=10000000  % 第51个路点y坐标
  WayPoint51Curvature: double, Min=-0.0667, Max=0.0667  % 第51个路点曲率
  WayPoint52YawAngle: double, Min=-179.99, Max=180  % 第52个路点横摆角
  WayPoint52X: double, Min=-10000000, Max=10000000  % 第52个路点x坐标
  WayPoint52Y: double, Min=-10000000, Max=10000000  % 第52个路点y坐标
  WayPoint52Curvature: double, Min=-0.0667, Max=0.0667  % 第52个路点曲率
  WayPoint53YawAngle: double, Min=-179.99, Max=180  % 第53个路点横摆角
  WayPoint53X: double, Min=-10000000, Max=10000000  % 第53个路点x坐标
  WayPoint53Y: double, Min=-10000000, Max=10000000  % 第53个路点y坐标
  WayPoint53Curvature: double, Min=-0.0667, Max=0.0667  % 第53个路点曲率
  WayPoint54YawAngle: double, Min=-179.99, Max=180  % 第54个路点横摆角
  WayPoint54X: double, Min=-10000000, Max=10000000  % 第54个路点x坐标
  WayPoint54Y: double, Min=-10000000, Max=10000000  % 第54个路点y坐标
  WayPoint54Curvature: double, Min=-0.0667, Max=0.0667  % 第54个路点曲率
  WayPoint55YawAngle: double, Min=-179.99, Max=180  % 第55个路点横摆角
  WayPoint55X: double, Min=-10000000, Max=10000000  % 第55个路点x坐标
  WayPoint55Y: double, Min=-10000000, Max=10000000  % 第55个路点y坐标
  WayPoint55Curvature: double, Min=-0.0667, Max=0.0667  % 第55个路点曲率
  WayPoint56YawAngle: double, Min=-179.99, Max=180  % 第56个路点横摆角
  WayPoint56X: double, Min=-10000000, Max=10000000  % 第56个路点x坐标
  WayPoint56Y: double, Min=-10000000, Max=10000000  % 第56个路点y坐标
  WayPoint56Curvature: double, Min=-0.0667, Max=0.0667  % 第56个路点曲率
  WayPoint57YawAngle: double, Min=-179.99, Max=180  % 第57个路点横摆角
  WayPoint57X: double, Min=-10000000, Max=10000000  % 第57个路点x坐标
  WayPoint57Y: double, Min=-10000000, Max=10000000  % 第57个路点y坐标
  WayPoint57Curvature: double, Min=-0.0667, Max=0.0667  % 第57个路点曲率
  WayPoint58YawAngle: double, Min=-179.99, Max=180  % 第58个路点横摆角
  WayPoint58X: double, Min=-10000000, Max=10000000  % 第58个路点x坐标
  WayPoint58Y: double, Min=-10000000, Max=10000000  % 第58个路点y坐标
  WayPoint58Curvature: double, Min=-0.0667, Max=0.0667  % 第58个路点曲率
  WayPoint59YawAngle: double, Min=-179.99, Max=180  % 第59个路点横摆角
  WayPoint59X: double, Min=-10000000, Max=10000000  % 第59个路点x坐标
  WayPoint59Y: double, Min=-10000000, Max=10000000  % 第59个路点y坐标
  WayPoint59Curvature: double, Min=-0.0667, Max=0.0667  % 第59个路点曲率
  WayPoint60YawAngle: double, Min=-179.99, Max=180  % 第60个路点横摆角
  WayPoint60X: double, Min=-10000000, Max=10000000  % 第60个路点x坐标
  WayPoint60Y: double, Min=-10000000, Max=10000000  % 第60个路点y坐标
  WayPoint60Curvature: double, Min=-0.0667, Max=0.0667  % 第60个路点曲率
  ENUYawAngle: double, Min=-179.99, Max=180  % 当前时刻列车在东北天坐标系下的横摆角
  ENUX: double, Min=-10000000, Max=10000000  % 当前时刻列车在东北天坐标系下的x坐标
  ENUY: double, Min=-10000000, Max=10000000  % 当前时刻列车在东北天坐标系下的y坐标
  WayPoint1SegmentIndex: double, Min=1, Max=120  % 第1个路点隶属区间代号
  WayPoint2SegmentIndex: double, Min=1, Max=120  % 第2个路点隶属区间代号
  WayPoint3SegmentIndex: double, Min=1, Max=120  % 第3个路点隶属区间代号
  WayPoint4SegmentIndex: double, Min=1, Max=120  % 第4个路点隶属区间代号
  WayPoint5SegmentIndex: double, Min=1, Max=120  % 第5个路点隶属区间代号
  WayPoint6SegmentIndex: double, Min=1, Max=120  % 第6个路点隶属区间代号
  WayPoint7SegmentIndex: double, Min=1, Max=120  % 第7个路点隶属区间代号
  WayPoint8SegmentIndex: double, Min=1, Max=120  % 第8个路点隶属区间代号
  WayPoint9SegmentIndex: double, Min=1, Max=120  % 第9个路点隶属区间代号
  WayPoint10SegmentIndex: double, Min=1, Max=120  % 第10个路点隶属区间代号
  WayPoint11SegmentIndex: double, Min=1, Max=120  % 第11个路点隶属区间代号
  WayPoint12SegmentIndex: double, Min=1, Max=120  % 第12个路点隶属区间代号
  WayPoint13SegmentIndex: double, Min=1, Max=120  % 第13个路点隶属区间代号
  WayPoint14SegmentIndex: double, Min=1, Max=120  % 第14个路点隶属区间代号
  WayPoint15SegmentIndex: double, Min=1, Max=120  % 第15个路点隶属区间代号
  WayPoint16SegmentIndex: double, Min=1, Max=120  % 第16个路点隶属区间代号
  WayPoint17SegmentIndex: double, Min=1, Max=120  % 第17个路点隶属区间代号
  WayPoint18SegmentIndex: double, Min=1, Max=120  % 第18个路点隶属区间代号
  WayPoint19SegmentIndex: double, Min=1, Max=120  % 第19个路点隶属区间代号
  WayPoint20SegmentIndex: double, Min=1, Max=120  % 第20个路点隶属区间代号
  WayPoint21SegmentIndex: double, Min=1, Max=120  % 第21个路点隶属区间代号
  WayPoint22SegmentIndex: double, Min=1, Max=120  % 第22个路点隶属区间代号
  WayPoint23SegmentIndex: double, Min=1, Max=120  % 第23个路点隶属区间代号
  WayPoint24SegmentIndex: double, Min=1, Max=120  % 第24个路点隶属区间代号
  WayPoint25SegmentIndex: double, Min=1, Max=120  % 第25个路点隶属区间代号
  WayPoint26SegmentIndex: double, Min=1, Max=120  % 第26个路点隶属区间代号
  WayPoint27SegmentIndex: double, Min=1, Max=120  % 第27个路点隶属区间代号
  WayPoint28SegmentIndex: double, Min=1, Max=120  % 第28个路点隶属区间代号
  WayPoint29SegmentIndex: double, Min=1, Max=120  % 第29个路点隶属区间代号
  WayPoint30SegmentIndex: double, Min=1, Max=120  % 第30个路点隶属区间代号
  WayPoint31SegmentIndex: double, Min=1, Max=120  % 第31个路点隶属区间代号
  WayPoint32SegmentIndex: double, Min=1, Max=120  % 第32个路点隶属区间代号
  WayPoint33SegmentIndex: double, Min=1, Max=120  % 第33个路点隶属区间代号
  WayPoint34SegmentIndex: double, Min=1, Max=120  % 第34个路点隶属区间代号
  WayPoint35SegmentIndex: double, Min=1, Max=120  % 第35个路点隶属区间代号
  WayPoint36SegmentIndex: double, Min=1, Max=120  % 第36个路点隶属区间代号
  WayPoint37SegmentIndex: double, Min=1, Max=120  % 第37个路点隶属区间代号
  WayPoint38SegmentIndex: double, Min=1, Max=120  % 第38个路点隶属区间代号
  WayPoint39SegmentIndex: double, Min=1, Max=120  % 第39个路点隶属区间代号
  WayPoint40SegmentIndex: double, Min=1, Max=120  % 第40个路点隶属区间代号
  WayPoint41SegmentIndex: double, Min=1, Max=120  % 第41个路点隶属区间代号
  WayPoint42SegmentIndex: double, Min=1, Max=120  % 第42个路点隶属区间代号
  WayPoint43SegmentIndex: double, Min=1, Max=120  % 第43个路点隶属区间代号
  WayPoint44SegmentIndex: double, Min=1, Max=120  % 第44个路点隶属区间代号
  WayPoint45SegmentIndex: double, Min=1, Max=120  % 第45个路点隶属区间代号
  WayPoint46SegmentIndex: double, Min=1, Max=120  % 第46个路点隶属区间代号
  WayPoint47SegmentIndex: double, Min=1, Max=120  % 第47个路点隶属区间代号
  WayPoint48SegmentIndex: double, Min=1, Max=120  % 第48个路点隶属区间代号
  WayPoint49SegmentIndex: double, Min=1, Max=120  % 第49个路点隶属区间代号
  WayPoint50SegmentIndex: double, Min=1, Max=120  % 第50个路点隶属区间代号
  WayPoint51SegmentIndex: double, Min=1, Max=120  % 第51个路点隶属区间代号
  WayPoint52SegmentIndex: double, Min=1, Max=120  % 第52个路点隶属区间代号
  WayPoint53SegmentIndex: double, Min=1, Max=120  % 第53个路点隶属区间代号
  WayPoint54SegmentIndex: double, Min=1, Max=120  % 第54个路点隶属区间代号
  WayPoint55SegmentIndex: double, Min=1, Max=120  % 第55个路点隶属区间代号
  WayPoint56SegmentIndex: double, Min=1, Max=120  % 第56个路点隶属区间代号
  WayPoint57SegmentIndex: double, Min=1, Max=120  % 第57个路点隶属区间代号
  WayPoint58SegmentIndex: double, Min=1, Max=120  % 第58个路点隶属区间代号
  WayPoint59SegmentIndex: double, Min=1, Max=120  % 第59个路点隶属区间代号
  WayPoint60SegmentIndex: double, Min=1, Max=120  % 第60个路点隶属区间代号
  TrajectoryUpdateEnable: double, Min=0, Max=1  % 轨迹更新使能状态
  NearLateralOffsetOriginal: double, Min=-10000000, Max=10000000  % 在线规划之前的原始近处横向偏差

MC1_MMU2IDS_SEGMENT = Simulink.Bus()  % MC1_MMU2IDS_SEGMENT
  SegmentDataLife: double, Min=0, Max=255  % 区间属性数据生命信号
  Segment1VisioinPriority: double, Min=0, Max=2  % 第1个区间的视觉循迹优先级
  Segment1GNSSPriority: double, Min=0, Max=2  % 第1个区间的GNSS循迹优先级
  Segment2VisioinPriority: double, Min=0, Max=2  % 第2个区间的视觉循迹优先级
  Segment2GNSSPriority: double, Min=0, Max=2  % 第2个区间的GNSS循迹优先级
  Segment3VisioinPriority: double, Min=0, Max=2  % 第3个区间的视觉循迹优先级
  Segment3GNSSPriority: double, Min=0, Max=2  % 第3个区间的GNSS循迹优先级
  Segment4VisioinPriority: double, Min=0, Max=2  % 第4个区间的视觉循迹优先级
  Segment4GNSSPriority: double, Min=0, Max=2  % 第4个区间的GNSS循迹优先级
  Segment5VisioinPriority: double, Min=0, Max=2  % 第5个区间的视觉循迹优先级
  Segment5GNSSPriority: double, Min=0, Max=2  % 第5个区间的GNSS循迹优先级
  Segment6VisioinPriority: double, Min=0, Max=2  % 第6个区间的视觉循迹优先级
  Segment6GNSSPriority: double, Min=0, Max=2  % 第6个区间的GNSS循迹优先级
  Segment7VisioinPriority: double, Min=0, Max=2  % 第7个区间的视觉循迹优先级
  Segment7GNSSPriority: double, Min=0, Max=2  % 第7个区间的GNSS循迹优先级
  Segment8VisioinPriority: double, Min=0, Max=2  % 第8个区间的视觉循迹优先级
  Segment8GNSSPriority: double, Min=0, Max=2  % 第8个区间的GNSS循迹优先级
  Segment9VisioinPriority: double, Min=0, Max=2  % 第9个区间的视觉循迹优先级
  Segment9GNSSPriority: double, Min=0, Max=2  % 第9个区间的GNSS循迹优先级
  Segment10VisioinPriority: double, Min=0, Max=2  % 第10个区间的视觉循迹优先级
  Segment10GNSSPriority: double, Min=0, Max=2  % 第10个区间的GNSS循迹优先级
  Segment11VisioinPriority: double, Min=0, Max=2  % 第11个区间的视觉循迹优先级
  Segment11GNSSPriority: double, Min=0, Max=2  % 第11个区间的GNSS循迹优先级
  Segment12VisioinPriority: double, Min=0, Max=2  % 第12个区间的视觉循迹优先级
  Segment12GNSSPriority: double, Min=0, Max=2  % 第12个区间的GNSS循迹优先级
  Segment13VisioinPriority: double, Min=0, Max=2  % 第13个区间的视觉循迹优先级
  Segment13GNSSPriority: double, Min=0, Max=2  % 第13个区间的GNSS循迹优先级
  Segment14VisioinPriority: double, Min=0, Max=2  % 第14个区间的视觉循迹优先级
  Segment14GNSSPriority: double, Min=0, Max=2  % 第14个区间的GNSS循迹优先级
  Segment15VisioinPriority: double, Min=0, Max=2  % 第15个区间的视觉循迹优先级
  Segment15GNSSPriority: double, Min=0, Max=2  % 第15个区间的GNSS循迹优先级
  Segment16VisioinPriority: double, Min=0, Max=2  % 第16个区间的视觉循迹优先级
  Segment16GNSSPriority: double, Min=0, Max=2  % 第16个区间的GNSS循迹优先级
  Segment17VisioinPriority: double, Min=0, Max=2  % 第17个区间的视觉循迹优先级
  Segment17GNSSPriority: double, Min=0, Max=2  % 第17个区间的GNSS循迹优先级
  Segment18VisioinPriority: double, Min=0, Max=2  % 第18个区间的视觉循迹优先级
  Segment18GNSSPriority: double, Min=0, Max=2  % 第18个区间的GNSS循迹优先级
  Segment19VisioinPriority: double, Min=0, Max=2  % 第19个区间的视觉循迹优先级
  Segment19GNSSPriority: double, Min=0, Max=2  % 第19个区间的GNSS循迹优先级
  Segment20VisioinPriority: double, Min=0, Max=2  % 第20个区间的视觉循迹优先级
  Segment20GNSSPriority: double, Min=0, Max=2  % 第20个区间的GNSS循迹优先级
  Segment21VisioinPriority: double, Min=0, Max=2  % 第21个区间的视觉循迹优先级
  Segment21GNSSPriority: double, Min=0, Max=2  % 第21个区间的GNSS循迹优先级
  Segment22VisioinPriority: double, Min=0, Max=2  % 第22个区间的视觉循迹优先级
  Segment22GNSSPriority: double, Min=0, Max=2  % 第22个区间的GNSS循迹优先级
  Segment23VisioinPriority: double, Min=0, Max=2  % 第23个区间的视觉循迹优先级
  Segment23GNSSPriority: double, Min=0, Max=2  % 第23个区间的GNSS循迹优先级
  Segment24VisioinPriority: double, Min=0, Max=2  % 第24个区间的视觉循迹优先级
  Segment24GNSSPriority: double, Min=0, Max=2  % 第24个区间的GNSS循迹优先级
  Segment25VisioinPriority: double, Min=0, Max=2  % 第25个区间的视觉循迹优先级
  Segment25GNSSPriority: double, Min=0, Max=2  % 第25个区间的GNSS循迹优先级
  Segment26VisioinPriority: double, Min=0, Max=2  % 第26个区间的视觉循迹优先级
  Segment26GNSSPriority: double, Min=0, Max=2  % 第26个区间的GNSS循迹优先级
  Segment27VisioinPriority: double, Min=0, Max=2  % 第27个区间的视觉循迹优先级
  Segment27GNSSPriority: double, Min=0, Max=2  % 第27个区间的GNSS循迹优先级
  Segment28VisioinPriority: double, Min=0, Max=2  % 第28个区间的视觉循迹优先级
  Segment28GNSSPriority: double, Min=0, Max=2  % 第28个区间的GNSS循迹优先级
  Segment29VisioinPriority: double, Min=0, Max=2  % 第29个区间的视觉循迹优先级
  Segment29GNSSPriority: double, Min=0, Max=2  % 第29个区间的GNSS循迹优先级
  Segment30VisioinPriority: double, Min=0, Max=2  % 第30个区间的视觉循迹优先级
  Segment30GNSSPriority: double, Min=0, Max=2  % 第30个区间的GNSS循迹优先级
  Segment31VisioinPriority: double, Min=0, Max=2  % 第31个区间的视觉循迹优先级
  Segment31GNSSPriority: double, Min=0, Max=2  % 第31个区间的GNSS循迹优先级
  Segment32VisioinPriority: double, Min=0, Max=2  % 第32个区间的视觉循迹优先级
  Segment32GNSSPriority: double, Min=0, Max=2  % 第32个区间的GNSS循迹优先级
  Segment33VisioinPriority: double, Min=0, Max=2  % 第33个区间的视觉循迹优先级
  Segment33GNSSPriority: double, Min=0, Max=2  % 第33个区间的GNSS循迹优先级
  Segment34VisioinPriority: double, Min=0, Max=2  % 第34个区间的视觉循迹优先级
  Segment34GNSSPriority: double, Min=0, Max=2  % 第34个区间的GNSS循迹优先级
  Segment35VisioinPriority: double, Min=0, Max=2  % 第35个区间的视觉循迹优先级
  Segment35GNSSPriority: double, Min=0, Max=2  % 第35个区间的GNSS循迹优先级
  Segment36VisioinPriority: double, Min=0, Max=2  % 第36个区间的视觉循迹优先级
  Segment36GNSSPriority: double, Min=0, Max=2  % 第36个区间的GNSS循迹优先级
  Segment37VisioinPriority: double, Min=0, Max=2  % 第37个区间的视觉循迹优先级
  Segment37GNSSPriority: double, Min=0, Max=2  % 第37个区间的GNSS循迹优先级
  Segment38VisioinPriority: double, Min=0, Max=2  % 第38个区间的视觉循迹优先级
  Segment38GNSSPriority: double, Min=0, Max=2  % 第38个区间的GNSS循迹优先级
  Segment39VisioinPriority: double, Min=0, Max=2  % 第39个区间的视觉循迹优先级
  Segment39GNSSPriority: double, Min=0, Max=2  % 第39个区间的GNSS循迹优先级
  Segment40VisioinPriority: double, Min=0, Max=2  % 第40个区间的视觉循迹优先级
  Segment40GNSSPriority: double, Min=0, Max=2  % 第40个区间的GNSS循迹优先级
  Segment41VisioinPriority: double, Min=0, Max=2  % 第41个区间的视觉循迹优先级
  Segment41GNSSPriority: double, Min=0, Max=2  % 第41个区间的GNSS循迹优先级
  Segment42VisioinPriority: double, Min=0, Max=2  % 第42个区间的视觉循迹优先级
  Segment42GNSSPriority: double, Min=0, Max=2  % 第42个区间的GNSS循迹优先级
  Segment43VisioinPriority: double, Min=0, Max=2  % 第43个区间的视觉循迹优先级
  Segment43GNSSPriority: double, Min=0, Max=2  % 第43个区间的GNSS循迹优先级
  Segment44VisioinPriority: double, Min=0, Max=2  % 第44个区间的视觉循迹优先级
  Segment44GNSSPriority: double, Min=0, Max=2  % 第44个区间的GNSS循迹优先级
  Segment45VisioinPriority: double, Min=0, Max=2  % 第45个区间的视觉循迹优先级
  Segment45GNSSPriority: double, Min=0, Max=2  % 第45个区间的GNSS循迹优先级
  Segment46VisioinPriority: double, Min=0, Max=2  % 第46个区间的视觉循迹优先级
  Segment46GNSSPriority: double, Min=0, Max=2  % 第46个区间的GNSS循迹优先级
  Segment47VisioinPriority: double, Min=0, Max=2  % 第47个区间的视觉循迹优先级
  Segment47GNSSPriority: double, Min=0, Max=2  % 第47个区间的GNSS循迹优先级
  Segment48VisioinPriority: double, Min=0, Max=2  % 第48个区间的视觉循迹优先级
  Segment48GNSSPriority: double, Min=0, Max=2  % 第48个区间的GNSS循迹优先级
  Segment49VisioinPriority: double, Min=0, Max=2  % 第49个区间的视觉循迹优先级
  Segment49GNSSPriority: double, Min=0, Max=2  % 第49个区间的GNSS循迹优先级
  Segment50VisioinPriority: double, Min=0, Max=2  % 第50个区间的视觉循迹优先级
  Segment50GNSSPriority: double, Min=0, Max=2  % 第50个区间的GNSS循迹优先级
  Segment51VisioinPriority: double, Min=0, Max=2  % 第51个区间的视觉循迹优先级
  Segment51GNSSPriority: double, Min=0, Max=2  % 第51个区间的GNSS循迹优先级
  Segment52VisioinPriority: double, Min=0, Max=2  % 第52个区间的视觉循迹优先级
  Segment52GNSSPriority: double, Min=0, Max=2  % 第52个区间的GNSS循迹优先级
  Segment53VisioinPriority: double, Min=0, Max=2  % 第53个区间的视觉循迹优先级
  Segment53GNSSPriority: double, Min=0, Max=2  % 第53个区间的GNSS循迹优先级
  Segment54VisioinPriority: double, Min=0, Max=2  % 第54个区间的视觉循迹优先级
  Segment54GNSSPriority: double, Min=0, Max=2  % 第54个区间的GNSS循迹优先级
  Segment55VisioinPriority: double, Min=0, Max=2  % 第55个区间的视觉循迹优先级
  Segment55GNSSPriority: double, Min=0, Max=2  % 第55个区间的GNSS循迹优先级
  Segment56VisioinPriority: double, Min=0, Max=2  % 第56个区间的视觉循迹优先级
  Segment56GNSSPriority: double, Min=0, Max=2  % 第56个区间的GNSS循迹优先级
  Segment57VisioinPriority: double, Min=0, Max=2  % 第57个区间的视觉循迹优先级
  Segment57GNSSPriority: double, Min=0, Max=2  % 第57个区间的GNSS循迹优先级
  Segment58VisioinPriority: double, Min=0, Max=2  % 第58个区间的视觉循迹优先级
  Segment58GNSSPriority: double, Min=0, Max=2  % 第58个区间的GNSS循迹优先级
  Segment59VisioinPriority: double, Min=0, Max=2  % 第59个区间的视觉循迹优先级
  Segment59GNSSPriority: double, Min=0, Max=2  % 第59个区间的GNSS循迹优先级
  Segment60VisioinPriority: double, Min=0, Max=2  % 第60个区间的视觉循迹优先级
  Segment60GNSSPriority: double, Min=0, Max=2  % 第60个区间的GNSS循迹优先级
  Segment61VisioinPriority: double, Min=0, Max=2  % 第61个区间的视觉循迹优先级
  Segment61GNSSPriority: double, Min=0, Max=2  % 第61个区间的GNSS循迹优先级
  Segment62VisioinPriority: double, Min=0, Max=2  % 第62个区间的视觉循迹优先级
  Segment62GNSSPriority: double, Min=0, Max=2  % 第62个区间的GNSS循迹优先级
  Segment63VisioinPriority: double, Min=0, Max=2  % 第63个区间的视觉循迹优先级
  Segment63GNSSPriority: double, Min=0, Max=2  % 第63个区间的GNSS循迹优先级
  Segment64VisioinPriority: double, Min=0, Max=2  % 第64个区间的视觉循迹优先级
  Segment64GNSSPriority: double, Min=0, Max=2  % 第64个区间的GNSS循迹优先级
  Segment65VisioinPriority: double, Min=0, Max=2  % 第65个区间的视觉循迹优先级
  Segment65GNSSPriority: double, Min=0, Max=2  % 第65个区间的GNSS循迹优先级
  Segment66VisioinPriority: double, Min=0, Max=2  % 第66个区间的视觉循迹优先级
  Segment66GNSSPriority: double, Min=0, Max=2  % 第66个区间的GNSS循迹优先级
  Segment67VisioinPriority: double, Min=0, Max=2  % 第67个区间的视觉循迹优先级
  Segment67GNSSPriority: double, Min=0, Max=2  % 第67个区间的GNSS循迹优先级
  Segment68VisioinPriority: double, Min=0, Max=2  % 第68个区间的视觉循迹优先级
  Segment68GNSSPriority: double, Min=0, Max=2  % 第68个区间的GNSS循迹优先级
  Segment69VisioinPriority: double, Min=0, Max=2  % 第69个区间的视觉循迹优先级
  Segment69GNSSPriority: double, Min=0, Max=2  % 第69个区间的GNSS循迹优先级
  Segment70VisioinPriority: double, Min=0, Max=2  % 第70个区间的视觉循迹优先级
  Segment70GNSSPriority: double, Min=0, Max=2  % 第70个区间的GNSS循迹优先级
  Segment71VisioinPriority: double, Min=0, Max=2  % 第71个区间的视觉循迹优先级
  Segment71GNSSPriority: double, Min=0, Max=2  % 第71个区间的GNSS循迹优先级
  Segment72VisioinPriority: double, Min=0, Max=2  % 第72个区间的视觉循迹优先级
  Segment72GNSSPriority: double, Min=0, Max=2  % 第72个区间的GNSS循迹优先级
  Segment73VisioinPriority: double, Min=0, Max=2  % 第73个区间的视觉循迹优先级
  Segment73GNSSPriority: double, Min=0, Max=2  % 第73个区间的GNSS循迹优先级
  Segment74VisioinPriority: double, Min=0, Max=2  % 第74个区间的视觉循迹优先级
  Segment74GNSSPriority: double, Min=0, Max=2  % 第74个区间的GNSS循迹优先级
  Segment75VisioinPriority: double, Min=0, Max=2  % 第75个区间的视觉循迹优先级
  Segment75GNSSPriority: double, Min=0, Max=2  % 第75个区间的GNSS循迹优先级
  Segment76VisioinPriority: double, Min=0, Max=2  % 第76个区间的视觉循迹优先级
  Segment76GNSSPriority: double, Min=0, Max=2  % 第76个区间的GNSS循迹优先级
  Segment77VisioinPriority: double, Min=0, Max=2  % 第77个区间的视觉循迹优先级
  Segment77GNSSPriority: double, Min=0, Max=2  % 第77个区间的GNSS循迹优先级
  Segment78VisioinPriority: double, Min=0, Max=2  % 第78个区间的视觉循迹优先级
  Segment78GNSSPriority: double, Min=0, Max=2  % 第78个区间的GNSS循迹优先级
  Segment79VisioinPriority: double, Min=0, Max=2  % 第79个区间的视觉循迹优先级
  Segment79GNSSPriority: double, Min=0, Max=2  % 第79个区间的GNSS循迹优先级
  Segment80VisioinPriority: double, Min=0, Max=2  % 第80个区间的视觉循迹优先级
  Segment80GNSSPriority: double, Min=0, Max=2  % 第80个区间的GNSS循迹优先级
  Segment81VisioinPriority: double, Min=0, Max=2  % 第81个区间的视觉循迹优先级
  Segment81GNSSPriority: double, Min=0, Max=2  % 第81个区间的GNSS循迹优先级
  Segment82VisioinPriority: double, Min=0, Max=2  % 第82个区间的视觉循迹优先级
  Segment82GNSSPriority: double, Min=0, Max=2  % 第82个区间的GNSS循迹优先级
  Segment83VisioinPriority: double, Min=0, Max=2  % 第83个区间的视觉循迹优先级
  Segment83GNSSPriority: double, Min=0, Max=2  % 第83个区间的GNSS循迹优先级
  Segment84VisioinPriority: double, Min=0, Max=2  % 第84个区间的视觉循迹优先级
  Segment84GNSSPriority: double, Min=0, Max=2  % 第84个区间的GNSS循迹优先级
  Segment85VisioinPriority: double, Min=0, Max=2  % 第85个区间的视觉循迹优先级
  Segment85GNSSPriority: double, Min=0, Max=2  % 第85个区间的GNSS循迹优先级
  Segment86VisioinPriority: double, Min=0, Max=2  % 第86个区间的视觉循迹优先级
  Segment86GNSSPriority: double, Min=0, Max=2  % 第86个区间的GNSS循迹优先级
  Segment87VisioinPriority: double, Min=0, Max=2  % 第87个区间的视觉循迹优先级
  Segment87GNSSPriority: double, Min=0, Max=2  % 第87个区间的GNSS循迹优先级
  Segment88VisioinPriority: double, Min=0, Max=2  % 第88个区间的视觉循迹优先级
  Segment88GNSSPriority: double, Min=0, Max=2  % 第88个区间的GNSS循迹优先级
  Segment89VisioinPriority: double, Min=0, Max=2  % 第89个区间的视觉循迹优先级
  Segment89GNSSPriority: double, Min=0, Max=2  % 第89个区间的GNSS循迹优先级
  Segment90VisioinPriority: double, Min=0, Max=2  % 第90个区间的视觉循迹优先级
  Segment90GNSSPriority: double, Min=0, Max=2  % 第90个区间的GNSS循迹优先级
  Segment91VisioinPriority: double, Min=0, Max=2  % 第91个区间的视觉循迹优先级
  Segment91GNSSPriority: double, Min=0, Max=2  % 第91个区间的GNSS循迹优先级
  Segment92VisioinPriority: double, Min=0, Max=2  % 第92个区间的视觉循迹优先级
  Segment92GNSSPriority: double, Min=0, Max=2  % 第92个区间的GNSS循迹优先级
  Segment93VisioinPriority: double, Min=0, Max=2  % 第93个区间的视觉循迹优先级
  Segment93GNSSPriority: double, Min=0, Max=2  % 第93个区间的GNSS循迹优先级
  Segment94VisioinPriority: double, Min=0, Max=2  % 第94个区间的视觉循迹优先级
  Segment94GNSSPriority: double, Min=0, Max=2  % 第94个区间的GNSS循迹优先级
  Segment95VisioinPriority: double, Min=0, Max=2  % 第95个区间的视觉循迹优先级
  Segment95GNSSPriority: double, Min=0, Max=2  % 第95个区间的GNSS循迹优先级
  Segment96VisioinPriority: double, Min=0, Max=2  % 第96个区间的视觉循迹优先级
  Segment96GNSSPriority: double, Min=0, Max=2  % 第96个区间的GNSS循迹优先级
  Segment97VisioinPriority: double, Min=0, Max=2  % 第97个区间的视觉循迹优先级
  Segment97GNSSPriority: double, Min=0, Max=2  % 第97个区间的GNSS循迹优先级
  Segment98VisioinPriority: double, Min=0, Max=2  % 第98个区间的视觉循迹优先级
  Segment98GNSSPriority: double, Min=0, Max=2  % 第98个区间的GNSS循迹优先级
  Segment99VisioinPriority: double, Min=0, Max=2  % 第99个区间的视觉循迹优先级
  Segment99GNSSPriority: double, Min=0, Max=2  % 第99个区间的GNSS循迹优先级
  Segment100VisioinPriority: double, Min=0, Max=2  % 第100个区间的视觉循迹优先级
  Segment100GNSSPriority: double, Min=0, Max=2  % 第100个区间的GNSS循迹优先级
  Segment101VisioinPriority: double, Min=0, Max=2  % 第101个区间的视觉循迹优先级
  Segment101GNSSPriority: double, Min=0, Max=2  % 第101个区间的GNSS循迹优先级
  Segment102VisioinPriority: double, Min=0, Max=2  % 第102个区间的视觉循迹优先级
  Segment102GNSSPriority: double, Min=0, Max=2  % 第102个区间的GNSS循迹优先级
  Segment103VisioinPriority: double, Min=0, Max=2  % 第103个区间的视觉循迹优先级
  Segment103GNSSPriority: double, Min=0, Max=2  % 第103个区间的GNSS循迹优先级
  Segment104VisioinPriority: double, Min=0, Max=2  % 第104个区间的视觉循迹优先级
  Segment104GNSSPriority: double, Min=0, Max=2  % 第104个区间的GNSS循迹优先级
  Segment105VisioinPriority: double, Min=0, Max=2  % 第105个区间的视觉循迹优先级
  Segment105GNSSPriority: double, Min=0, Max=2  % 第105个区间的GNSS循迹优先级
  Segment106VisioinPriority: double, Min=0, Max=2  % 第106个区间的视觉循迹优先级
  Segment106GNSSPriority: double, Min=0, Max=2  % 第106个区间的GNSS循迹优先级
  Segment107VisioinPriority: double, Min=0, Max=2  % 第107个区间的视觉循迹优先级
  Segment107GNSSPriority: double, Min=0, Max=2  % 第107个区间的GNSS循迹优先级
  Segment108VisioinPriority: double, Min=0, Max=2  % 第108个区间的视觉循迹优先级
  Segment108GNSSPriority: double, Min=0, Max=2  % 第108个区间的GNSS循迹优先级
  Segment109VisioinPriority: double, Min=0, Max=2  % 第109个区间的视觉循迹优先级
  Segment109GNSSPriority: double, Min=0, Max=2  % 第109个区间的GNSS循迹优先级
  Segment110VisioinPriority: double, Min=0, Max=2  % 第110个区间的视觉循迹优先级
  Segment110GNSSPriority: double, Min=0, Max=2  % 第110个区间的GNSS循迹优先级
  Segment111VisioinPriority: double, Min=0, Max=2  % 第111个区间的视觉循迹优先级
  Segment111GNSSPriority: double, Min=0, Max=2  % 第111个区间的GNSS循迹优先级
  Segment112VisioinPriority: double, Min=0, Max=2  % 第112个区间的视觉循迹优先级
  Segment112GNSSPriority: double, Min=0, Max=2  % 第112个区间的GNSS循迹优先级
  Segment113VisioinPriority: double, Min=0, Max=2  % 第113个区间的视觉循迹优先级
  Segment113GNSSPriority: double, Min=0, Max=2  % 第113个区间的GNSS循迹优先级
  Segment114VisioinPriority: double, Min=0, Max=2  % 第114个区间的视觉循迹优先级
  Segment114GNSSPriority: double, Min=0, Max=2  % 第114个区间的GNSS循迹优先级
  Segment115VisioinPriority: double, Min=0, Max=2  % 第115个区间的视觉循迹优先级
  Segment115GNSSPriority: double, Min=0, Max=2  % 第115个区间的GNSS循迹优先级
  Segment116VisioinPriority: double, Min=0, Max=2  % 第116个区间的视觉循迹优先级
  Segment116GNSSPriority: double, Min=0, Max=2  % 第116个区间的GNSS循迹优先级
  Segment117VisioinPriority: double, Min=0, Max=2  % 第117个区间的视觉循迹优先级
  Segment117GNSSPriority: double, Min=0, Max=2  % 第117个区间的GNSS循迹优先级
  Segment118VisioinPriority: double, Min=0, Max=2  % 第118个区间的视觉循迹优先级
  Segment118GNSSPriority: double, Min=0, Max=2  % 第118个区间的GNSS循迹优先级
  Segment119VisioinPriority: double, Min=0, Max=2  % 第119个区间的视觉循迹优先级
  Segment119GNSSPriority: double, Min=0, Max=2  % 第119个区间的GNSS循迹优先级
  Segment120VisioinPriority: double, Min=0, Max=2  % 第120个区间的视觉循迹优先级
  Segment120GNSSPriority: double, Min=0, Max=2  % 第120个区间的GNSS循迹优先级
  GridOriginLatitude: double, Min=-90, Max=90  % 相对坐标原点纬度
  GridOriginLongitude: double, Min=-180, Max=180  % 相对坐标原点经度

TRDP_CONFIG_MC1_CCU2IDS = struct(
  byte_order=uint32(repmat(1, 29, 1)),
  factor=[1; 1; 1; 0.1; 0.1; 0.1; 0.1; 0.1; 1; 1; 1; 1; 1; 1; 1; 1; 1; 1; 1; 1; 1; 1; 1; 1; 1; 1; 1; 0.1; 0.1],
  offset=repmat(0, 29, 1),
  type=uint32([0; 0; 0; 0; 1; 1; 1; 1; 0; 0; 0; 0; 0; 0; 0; 0; 0; 0; 0; 0; 0; 0; 0; 0; 0; 0; 0; 1; 1]),
  start_byte=uint32([4; 5; 6; 8; 10; 12; 14; 16; 17; 20; 20; 20; 20; 20; 20; 20; 50; 50; 50; 50; 50; 50; 50; 0; 1; 2; 3; 97; 99]),
  start_bit=uint32([0; 0; 0; 0; 0; 0; 0; 0; 0; 0; 1; 2; 3; 4; 5; 6; 0; 1; 2; 3; 4; 5; 6; 0; 0; 0; 0; 0; 0]),
  bit_length=uint32([8; 8; 8; 16; 12; 12; 10; 10; 1; 1; 1; 1; 1; 1; 1; 1; 1; 1; 1; 1; 1; 1; 1; 8; 8; 8; 8; 10; 10]),
  min=[0; 0; 0; 0; -60; -60; -25; -25; 0; 0; 0; 0; 0; 0; 0; 0; 0; 0; 0; 0; 0; 0; 0; 0; 0; 1; 1; -25; -25],
  max=[23; 59; 59; 80; 60; 60; 25; 25; 1; 1; 1; 1; 1; 1; 1; 1; 1; 1; 1; 1; 1; 1; 1; 255; 99; 12; 31; 25; 25])

TRDP_CONFIG_MC1_IDS2CCU = struct(
  byte_order=uint32(repmat(1, 296, 1)),
  factor=[1; 1; 1; 1; 1; 1; 1; 1; 1; 1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 0.01],
  offset=[0; 0; 0; 0; 0; 0; 0; 0; 0; 0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 0],
  type=uint32([0; 0; 0; 0; 0; 0; 0; 0; 0; 0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 0]),
  start_byte=uint32([39; 39; 39; 39; 39; 39; 39; 39; 40; 40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 834]),
  start_bit=uint32([0; 1; 2; 3; 4; 5; 6; 7; 0; 1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 0]),
  bit_length=uint32([1; 1; 1; 1; 1; 1; 1; 1; 1; 1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 8]),
  min=[0; 0; 0; 0; 0; 0; 0; 0; 0; 0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 0.3],
  max=[1; 1; 1; 1; 1; 1; 1; 1; 1; 1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 2])

TRDP_CONFIG_MC1_MMU2IDS_POINT = struct(
  byte_order=uint32(repmat(1, 307, 1)),
  factor=[1; 1; 0.01; 0.01; 0.01; 0.0001; 0.01; 0.01; 0.01; 0.0001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 0.01],
  offset=repmat(0, 307, 1),
  type=uint32([0; 0; 1; 1; 1; 1; 1; 1; 1; 1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 1]),
  start_byte=uint32([0; 1; 41; 45; 49; 51; 57; 61; 65; 67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 16]),
  start_bit=uint32([0; 0; 0; 0; 0; 0; 0; 0; 0; 0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 0]),
  bit_length=uint32([8; 8; 16; 32; 32; 16; 16; 32; 32; 16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 32]),
  min=[0; 0; -179.99; -10000000; -10000000; -0.0667; -179.99; -10000000; -10000000; -0.0667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 -10000000],
  max=[255; 60; 180; 10000000; 10000000; 0.0667; 180; 10000000; 10000000; 0.0667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 10000000])

TRDP_CONFIG_MC1_MMU2IDS_SEGMENT = struct(
  byte_order=uint32(repmat(1, 243, 1)),
  factor=[1; 1; 1; 1; 1; 1; 1; 1; 1; 1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 1.0e-7],
  offset=repmat(0, 243, 1),
  type=uint32([0; 0; 0; 0; 0; 0; 0; 0; 0; 0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 1]),
  start_byte=uint32([0; 40; 41; 48; 49; 56; 57; 64; 65; 72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 8]),
  start_bit=uint32(repmat(0, 243, 1)),
  bit_length=uint32([8; 8; 8; 8; 8; 8; 8; 8; 8; 8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 32]),
  min=[0; 0; 0; 0; 0; 0; 0; 0; 0; 0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 -180],
  max=[255; 2; 2; 2; 2; 2; 2; 2; 2; 2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 180])

TRDP_SIGNALS_MC1_CCU2IDS = struct(
  Hour=0,
  Minute=0,
  Second=0,
  TramSpeed=0,
  MC1ArticulatedAngle=-60,
  MC2ArticulatedAngle=-60,
  SteeringAxle1Angle=-25,
  SteeringAxle6Angle=-25,
  TGS1FaultStatus=0,
  MC1AutonomousTracking=0,
  MC1TurnLeftIndicator=0,
  MC1TurnRightIndicator=0,
  MC1OccupiedStatus=0,
  MC1DriveBackward=0,
  MC1OilPumpStatus=0,
  MC1ParkingStatus=0,
  MC2AutonomousTracking=0,
  MC2TurnLeftIndicator=0,
  MC2TurnRightIndicator=0,
  MC2OccupiedStatus=0,
  MC2DriveBackward=0,
  MC2OilPumpStatus=0,
  MC2ParkingStatus=0,
  TCSNLife=0,
  Year=0,
  Month=1,
  Day=1,
  SteeringAxle2Angle=-25,
  SteeringAxle5Angle=-25)

TRDP_SIGNALS_MC1_IDS2CCU = struct(
  LateralRadar1YellowAlarm=0,
  LateralRadar2YellowAlarm=0,
  LateralRadar3YellowAlarm=0,
  LateralRadar4YellowAlarm=0,
  LateralRadar5YellowAlarm=0,
  LateralRadar6YellowAlarm=0,
  LateralRadar7YellowAlarm=0,
  LateralRadar8YellowAlarm=0,
  LateralRadar9YellowAlarm=0,
  LateralRadar10YellowAlarm=0,
  LateralRadar11YellowAlarm=0,
  LateralRadar12YellowAlarm=0,
  LateralRadar13YellowAlarm=0,
  LateralRadar14YellowAlarm=0,
  LateralRadar15YellowAlarm=0,
  LateralRadar16YellowAlarm=0,
  LateralRadar17YellowAlarm=0,
  LateralRadar18YellowAlarm=0,
  LateralRadar1Fault=0,
  LateralRadar2Fault=0,
  LateralRadar3Fault=0,
  LateralRadar4Fault=0,
  LateralRadar5Fault=0,
  LateralRadar6Fault=0,
  LateralRadar7Fault=0,
  LateralRadar8Fault=0,
  LateralRadar9Fault=0,
  LateralRadar10Fault=0,
  LateralRadar11Fault=0,
  LateralRadar12Fault=0,
  LateralRadar13Fault=0,
  LateralRadar14Fault=0,
  LateralRadar15Fault=0,
  LateralRadar16Fault=0,
  LateralRadar17Fault=0,
  LateralRadar18Fault=0,
  GNSSWeek=0,
  GNSSTime=0,
  GNSSHeadingAngle=0,
  GNSSPitchAngle=-90,
  GNSSRollAngle=-180,
  GNSSLatitude=-90,
  GNSSLongitude=-180,
  GNSSAltitude=-200,
  GNSSEastSpeed=-20,
  GNSSNorthSpeed=-20,
  GNSSUpperSpeed=-20,
  GNSSBaseline=0,
  GNSSFrontAntennaSatelliteNumber=0,
  GNSSRearAntennaSatelliteNumber=0,
  GNSSWorkStatus=0,
  LateralControlExecuteWord=0,
  IDSSetTractionBlock=0,
  IDSSetSafeBrake=0,
  GNSSAngleSpeedX=-360,
  GNSSAngleSpeedY=-360,
  GNSSAngleSpeedZ=-360,
  GNSSAccelerationX=-1,
  GNSSAccelerationY=-1,
  GNSSAccelerationZ=-1,
  GNSSTemperature=-40,
  A0Offset=-0.5,
  A1Offset=-0.1,
  SteeringWheelAngleOffset=-128,
  FilteredA0=-10.24,
  FilteredA1=-1.024,
  FilteredA2=-0.08192,
  FilteredA3=-0.0002048,
  PreviewLateralOffset=-10.24,
  PreviewAngleOffset=-1.024,
  LDWImageStatus=0,
  AutonomousTrackingAlarmSound=0,
  TrackingCameraSoftwareVersionHigh4Byte=0,
  TrackingCameraSoftwareVersionlow4Byte=0,
  TrackingCameraCommunicationFault=0,
  EPSFault=0,
  GNSSFault=0,
  TCSNCommunicationFault=0,
  EPS_FL1_TQS_OVERFLOW=0,
  EPS_FL1_TQM_OVERFLOW=0,
  EPS_FL1_TQ_NOT_MATCH=0,
  EPS_FL1_VSENSOR_F=0,
  EPS_FL1_VMOTOR_F=0,
  EPS_FL1_CMOTOR_F=0,
  EPS_FL1_DRIVER_CIR_F=0,
  EPS_FL1_CDIFF_EX=0,
  EPS_FL1_RELAY_FAIL=0,
  EPS_FL1_SIGN_AD_FAIL=0,
  EPS_FL2_BAT_VHIGH=0,
  EPS_FL2_BAT_VLOW=0,
  EPS_FL2_VSPD_F=0,
  EPS_FL2_SPD_LOST=0,
  EPS_FL3_CAN_Lost=0,
  LateralRadar1Fault_2=0,
  LateralRadar2Fault_2=0,
  LateralRadar3Fault_2=0,
  LateralRadar4Fault_2=0,
  LateralRadar5Fault_2=0,
  LateralRadar6Fault_2=0,
  LateralRadar7Fault_2=0,
  LateralRadar8Fault_2=0,
  LateralRadar9Fault_2=0,
  LateralRadar10Fault_2=0,
  LateralRadar11Fault_2=0,
  LateralRadar12Fault_2=0,
  LateralRadar13Fault_2=0,
  LateralRadar14Fault_2=0,
  LateralRadar15Fault_2=0,
  LateralRadar16Fault_2=0,
  LateralRadar17Fault_2=0,
  LateralRadar18Fault_2=0,
  EPS_FL1_UVW_F=0,
  EPS_FL1_SIGN_AB_F=0,
  EPS_FL1_VPOS_SEN_F=0,
  EPS_FL1_MotorCur_F=0,
  EPS_FL1_AD_OFFSET_DF=0,
  EPS_FL1_V_F=0,
  EPS_FL1_Vbus_Short=0,
  EPS_FL1_Relay_Bonding=0,
  EPS_FL1_V_Diff_F=0,
  EPS_FL1_V_F_longtime=0,
  EPS_FL1_IG_F=0,
  EPS_FL1_5V_abnormal=0,
  EPS_FL1_5V_from_65381=0,
  EPS_FL3_CAN_ANGOVERFLOW=0,
  EPS_FL3_CALIB_ERR=0,
  EPS_FL3_TEMP_PROT_L1=0,
  EPS_FL3_AB_CAL_ERR=0,
  EPS_FL2_TEMP_PROT_L2=0,
  EPS_FL3_SIGNA_F=0,
  EPS_FL3_SIGNR_F=0,
  EPS_FL3_ANG_SEN_LOST=0,
  EPS_FL3_LOGIC_ANG_ER=0,
  EPS_FL2_DVSPD_F=0,
  EPS_FL2_CAN_BUSOFF=0,
  EPS_FL2_ENGSPD_F=0,
  EPS_FL2_ENGSPD_LOST=0,
  EPS_FL1_Motor_PhaseLost=0,
  EPS_FL1_Motor_PhaseLost_BC=0,
  EPSCommunicationFault=0,
  AutonomousTrackingCameraConfidenceLowFault=0,
  SteeringAxleAngleSensorFault=0,
  AutonomousTrackingCameraDataUnchangedAbnormalFault=0,
  LaneDeviationOutOfBoundaryFault=0,
  TCSNLife=0,
  Year=0,
  Month=1,
  Day=1,
  Hour=0,
  Minute=0,
  Second=0,
  TramSpeed=0,
  MC1ArticulatedAngle=-60,
  MC2ArticulatedAngle=-60,
  SteeringAxle1Angle=-25,
  SteeringAxle6Angle=-25,
  TGS1FaultStatus=0,
  MC1AutonomousTracking=0,
  MC1TurnLeftIndicator=0,
  MC1TurnRightIndicator=0,
  MC1OccupiedStatus=0,
  MC1DriveBackward=0,
  MC1OilPumpStatus=0,
  MC1ParkingStatus=0,
  MC2AutonomousTracking=0,
  MC2TurnLeftIndicator=0,
  MC2TurnRightIndicator=0,
  MC2OccupiedStatus=0,
  MC2DriveBackward=0,
  MC2OilPumpStatus=0,
  MC2ParkingStatus=0,
  LateralControlWarning=0,
  VisionSetFirstSteeringAxleAngle=-25,
  SteeringWheelAngle=-1575,
  DesiredAdditionalTorque=-12.8,
  MotorPowerTorque=-5,
  SteeringWheelTorque=-8.96,
  LateralRadarAlarmSound=0,
  LateralRadar1RedAlarm=0,
  LateralRadar2RedAlarm=0,
  LateralRadar3RedAlarm=0,
  LateralRadar4RedAlarm=0,
  LateralRadar5RedAlarm=0,
  LateralRadar6RedAlarm=0,
  LateralRadar7RedAlarm=0,
  LateralRadar8RedAlarm=0,
  LateralRadar9RedAlarm=0,
  LateralRadar10RedAlarm=0,
  LateralRadar11RedAlarm=0,
  LateralRadar12RedAlarm=0,
  LateralRadar13RedAlarm=0,
  LateralRadar14RedAlarm=0,
  LateralRadar15RedAlarm=0,
  LateralRadar16RedAlarm=0,
  LateralRadar17RedAlarm=0,
  LateralRadar18RedAlarm=0,
  GNSSCommunicationFault=0,
  TramYawRate=-100.59776,
  SteeringAxle2Angle=-25,
  SteeringAxle5Angle=-25,
  IDSLife=0,
  SurroundingCameraDisplaySwitch=90,
  LateralControlSoftwareVersion=0,
  LDWImageStatus_2=0,
  AutonomousTrackingWorkStatus=0,
  AutonomousTrackingFaultStatus=0,
  AutonomousTrackingAlarmSound_2=0,
  OriginalA0=-10.24,
  OriginalA1=-1.024,
  OriginalA2=-0.08192,
  OriginalA3=-0.0002048,
  GNSSLife=0,
  TrackingCameraLife=0,
  EPSLife=0,
  GNSSLocationInvalidFault=0,
  GNSSPositionOutOfBoundaryFault=0,
  SteeringAxleAngleJumpAbnormalFault=0,
  SteeringWheelAngleJumpAbnormalFault=0,
  TramSpeedJumpAbnormalFault=0,
  A0JumpAbnormalFault=0,
  A1JumpAbnormalFault=0,
  A2JumpAbnormalFault=0,
  ENUYawAngleJumpAbnormalFault=0,
  ENUXJumpAbnormalFault=0,
  ENUYJumpAbnormalFault=0,
  MMUCommunicationFault=0,
  EPSWorkStatus=0,
  DesiredEPSWorkMode=0,
  AutonomousTrackingCameraConfidence=0,
  LocationValidStatus=0,
  PreventAutoTrackingStatus=0,
  TaskIndex=0,
  BaseInterventionCondition=0,
  VisionInterventionCondition=0,
  GNSSInterventionCondition=0,
  TramTypeIndex=0,
  StateFlowLateralControlMethod=0,
  StateFlowLateralControlMode=0,
  StateFlowManualDrivingMode=0,
  StateFlowAutoTrackingMode=0,
  StateFlowWaitInterventionMode=0,
  VisionPriorityCurrent=0,
  GNSSPriorityCurrent=0,
  LateralControlMethodCurrent=0,
  LaneDeviationTolerance=0.3,
  StateFlowAlarmVoiceMode=0,
  StateFlowManualDrivingAlarmVoice=0,
  StateFlowAutoTrackingAlarmVoice=0,
  DesiredSteeringWheelAngle=-600,
  DesiredSteeringAxleAngle=-15,
  StateFlowSetSteeringWheelAngleSignalProcessingMode=0,
  StateFlowConfidenceCheck=0,
  StateFlowDataUnchangedAbnormalCheck=0,
  DistanceOffsetPreviewPointYawAngle=-179.99,
  DistanceOffsetPreviewPointX=-10000000,
  DistanceOffsetPreviewPointY=-10000000,
  TramKinematicModelYawRate=-100,
  TramKinematicModelSpeedX=-22.22,
  TramKinematicModelSpeedY=-22.22,
  TramKinematicModelSlipAngle=-100,
  ExecuteDelayEstimatedYawAngle=-1000000000,
  ExecuteDelayEstimatedX=-10000000,
  ExecuteDelayEstimatedY=-10000000,
  StateFlowTramSpeedCheck=0,
  StateFlowLaneCurvatureCheck=0,
  StateFlowLaneSlopeCheck=0,
  StateFlowLaneSmallCurvatureCheck=0,
  GNSSPreviewTime=0,
  GNSSMinPreviewDistance=0,
  StanleyLateralOffsetFactor=0,
  SteeringAxleAngleFactor=0,
  StanleySetSteeringAxleAngle=-15,
  ClosestPointYawAngle=-179.99,
  ClosestPointX=-10000000,
  ClosestPointY=-10000000,
  ClosestPointCurvature=-0.0667,
  ClosestPointSegmentIndex=1,
  AngleOffsetPreviewPointYawAngle=-179.99,
  AngleOffsetPreviewPointX=-10000000,
  AngleOffsetPreviewPointY=-10000000,
  GNSSPreviewLateralOffset=-10000000,
  NearLateralOffsetCurrent=-10000000,
  GNSSPreviewAngleOffset=-179.99,
  GNSSAngleOffsetPreviewDistance=0,
  ReferenceTrajectoryClosestSegmentStartPointIndex=0,
  GNSSDistanceOffsetPreviewDistance=0,
  DesiredSteeringWheelAngleSpeed=50,
  LocalReferenceTrajectoryPointNumber2Control=0,
  LocalReferenceTrajectoryPoint1X2Control=-10000000,
  LocalReferenceTrajectoryPoint1Y2Control=-10000000,
  AngleOffsetPreviewPointCurvature=-0.0667,
  MaxAbsoluteCurvature=0,
  SteeringWheelAngleSpeed=50,
  DistanceOffsetPreviewPointCurvature=-0.0667,
  FilteredTramSpeed=0,
  GNSSTrajectoryDeviationTolerance=0.3)

TRDP_SIGNALS_MC1_MMU2IDS_POINT = struct(
  WayPointDataLife=0,
  WayPointNumber=0,
  WayPoint1YawAngle=-179.99,
  WayPoint1X=-10000000,
  WayPoint1Y=-10000000,
  WayPoint1Curvature=-0.0667,
  WayPoint2YawAngle=-179.99,
  WayPoint2X=-10000000,
  WayPoint2Y=-10000000,
  WayPoint2Curvature=-0.0667,
  WayPoint3YawAngle=-179.99,
  WayPoint3X=-10000000,
  WayPoint3Y=-10000000,
  WayPoint3Curvature=-0.0667,
  WayPoint4YawAngle=-179.99,
  WayPoint4X=-10000000,
  WayPoint4Y=-10000000,
  WayPoint4Curvature=-0.0667,
  WayPoint5YawAngle=-179.99,
  WayPoint5X=-10000000,
  WayPoint5Y=-10000000,
  WayPoint5Curvature=-0.0667,
  WayPoint6YawAngle=-179.99,
  WayPoint6X=-10000000,
  WayPoint6Y=-10000000,
  WayPoint6Curvature=-0.0667,
  WayPoint7YawAngle=-179.99,
  WayPoint7X=-10000000,
  WayPoint7Y=-10000000,
  WayPoint7Curvature=-0.0667,
  WayPoint8YawAngle=-179.99,
  WayPoint8X=-10000000,
  WayPoint8Y=-10000000,
  WayPoint8Curvature=-0.0667,
  WayPoint9YawAngle=-179.99,
  WayPoint9X=-10000000,
  WayPoint9Y=-10000000,
  WayPoint9Curvature=-0.0667,
  WayPoint10YawAngle=-179.99,
  WayPoint10X=-10000000,
  WayPoint10Y=-10000000,
  WayPoint10Curvature=-0.0667,
  WayPoint11YawAngle=-179.99,
  WayPoint11X=-10000000,
  WayPoint11Y=-10000000,
  WayPoint11Curvature=-0.0667,
  WayPoint12YawAngle=-179.99,
  WayPoint12X=-10000000,
  WayPoint12Y=-10000000,
  WayPoint12Curvature=-0.0667,
  WayPoint13YawAngle=-179.99,
  WayPoint13X=-10000000,
  WayPoint13Y=-10000000,
  WayPoint13Curvature=-0.0667,
  WayPoint14YawAngle=-179.99,
  WayPoint14X=-10000000,
  WayPoint14Y=-10000000,
  WayPoint14Curvature=-0.0667,
  WayPoint15YawAngle=-179.99,
  WayPoint15X=-10000000,
  WayPoint15Y=-10000000,
  WayPoint15Curvature=-0.0667,
  WayPoint16YawAngle=-179.99,
  WayPoint16X=-10000000,
  WayPoint16Y=-10000000,
  WayPoint16Curvature=-0.0667,
  WayPoint17YawAngle=-179.99,
  WayPoint17X=-10000000,
  WayPoint17Y=-10000000,
  WayPoint17Curvature=-0.0667,
  WayPoint18YawAngle=-179.99,
  WayPoint18X=-10000000,
  WayPoint18Y=-10000000,
  WayPoint18Curvature=-0.0667,
  WayPoint19YawAngle=-179.99,
  WayPoint19X=-10000000,
  WayPoint19Y=-10000000,
  WayPoint19Curvature=-0.0667,
  WayPoint20YawAngle=-179.99,
  WayPoint20X=-10000000,
  WayPoint20Y=-10000000,
  WayPoint20Curvature=-0.0667,
  WayPoint21YawAngle=-179.99,
  WayPoint21X=-10000000,
  WayPoint21Y=-10000000,
  WayPoint21Curvature=-0.0667,
  WayPoint22YawAngle=-179.99,
  WayPoint22X=-10000000,
  WayPoint22Y=-10000000,
  WayPoint22Curvature=-0.0667,
  WayPoint23YawAngle=-179.99,
  WayPoint23X=-10000000,
  WayPoint23Y=-10000000,
  WayPoint23Curvature=-0.0667,
  WayPoint24YawAngle=-179.99,
  WayPoint24X=-10000000,
  WayPoint24Y=-10000000,
  WayPoint24Curvature=-0.0667,
  WayPoint25YawAngle=-179.99,
  WayPoint25X=-10000000,
  WayPoint25Y=-10000000,
  WayPoint25Curvature=-0.0667,
  WayPoint26YawAngle=-179.99,
  WayPoint26X=-10000000,
  WayPoint26Y=-10000000,
  WayPoint26Curvature=-0.0667,
  WayPoint27YawAngle=-179.99,
  WayPoint27X=-10000000,
  WayPoint27Y=-10000000,
  WayPoint27Curvature=-0.0667,
  WayPoint28YawAngle=-179.99,
  WayPoint28X=-10000000,
  WayPoint28Y=-10000000,
  WayPoint28Curvature=-0.0667,
  WayPoint29YawAngle=-179.99,
  WayPoint29X=-10000000,
  WayPoint29Y=-10000000,
  WayPoint29Curvature=-0.0667,
  WayPoint30YawAngle=-179.99,
  WayPoint30X=-10000000,
  WayPoint30Y=-10000000,
  WayPoint30Curvature=-0.0667,
  WayPoint31YawAngle=-179.99,
  WayPoint31X=-10000000,
  WayPoint31Y=-10000000,
  WayPoint31Curvature=-0.0667,
  WayPoint32YawAngle=-179.99,
  WayPoint32X=-10000000,
  WayPoint32Y=-10000000,
  WayPoint32Curvature=-0.0667,
  WayPoint33YawAngle=-179.99,
  WayPoint33X=-10000000,
  WayPoint33Y=-10000000,
  WayPoint33Curvature=-0.0667,
  WayPoint34YawAngle=-179.99,
  WayPoint34X=-10000000,
  WayPoint34Y=-10000000,
  WayPoint34Curvature=-0.0667,
  WayPoint35YawAngle=-179.99,
  WayPoint35X=-10000000,
  WayPoint35Y=-10000000,
  WayPoint35Curvature=-0.0667,
  WayPoint36YawAngle=-179.99,
  WayPoint36X=-10000000,
  WayPoint36Y=-10000000,
  WayPoint36Curvature=-0.0667,
  WayPoint37YawAngle=-179.99,
  WayPoint37X=-10000000,
  WayPoint37Y=-10000000,
  WayPoint37Curvature=-0.0667,
  WayPoint38YawAngle=-179.99,
  WayPoint38X=-10000000,
  WayPoint38Y=-10000000,
  WayPoint38Curvature=-0.0667,
  WayPoint39YawAngle=-179.99,
  WayPoint39X=-10000000,
  WayPoint39Y=-10000000,
  WayPoint39Curvature=-0.0667,
  WayPoint40YawAngle=-179.99,
  WayPoint40X=-10000000,
  WayPoint40Y=-10000000,
  WayPoint40Curvature=-0.0667,
  WayPoint41YawAngle=-179.99,
  WayPoint41X=-10000000,
  WayPoint41Y=-10000000,
  WayPoint41Curvature=-0.0667,
  WayPoint42YawAngle=-179.99,
  WayPoint42X=-10000000,
  WayPoint42Y=-10000000,
  WayPoint42Curvature=-0.0667,
  WayPoint43YawAngle=-179.99,
  WayPoint43X=-10000000,
  WayPoint43Y=-10000000,
  WayPoint43Curvature=-0.0667,
  WayPoint44YawAngle=-179.99,
  WayPoint44X=-10000000,
  WayPoint44Y=-10000000,
  WayPoint44Curvature=-0.0667,
  WayPoint45YawAngle=-179.99,
  WayPoint45X=-10000000,
  WayPoint45Y=-10000000,
  WayPoint45Curvature=-0.0667,
  WayPoint46YawAngle=-179.99,
  WayPoint46X=-10000000,
  WayPoint46Y=-10000000,
  WayPoint46Curvature=-0.0667,
  WayPoint47YawAngle=-179.99,
  WayPoint47X=-10000000,
  WayPoint47Y=-10000000,
  WayPoint47Curvature=-0.0667,
  WayPoint48YawAngle=-179.99,
  WayPoint48X=-10000000,
  WayPoint48Y=-10000000,
  WayPoint48Curvature=-0.0667,
  WayPoint49YawAngle=-179.99,
  WayPoint49X=-10000000,
  WayPoint49Y=-10000000,
  WayPoint49Curvature=-0.0667,
  WayPoint50YawAngle=-179.99,
  WayPoint50X=-10000000,
  WayPoint50Y=-10000000,
  WayPoint50Curvature=-0.0667,
  WayPoint51YawAngle=-179.99,
  WayPoint51X=-10000000,
  WayPoint51Y=-10000000,
  WayPoint51Curvature=-0.0667,
  WayPoint52YawAngle=-179.99,
  WayPoint52X=-10000000,
  WayPoint52Y=-10000000,
  WayPoint52Curvature=-0.0667,
  WayPoint53YawAngle=-179.99,
  WayPoint53X=-10000000,
  WayPoint53Y=-10000000,
  WayPoint53Curvature=-0.0667,
  WayPoint54YawAngle=-179.99,
  WayPoint54X=-10000000,
  WayPoint54Y=-10000000,
  WayPoint54Curvature=-0.0667,
  WayPoint55YawAngle=-179.99,
  WayPoint55X=-10000000,
  WayPoint55Y=-10000000,
  WayPoint55Curvature=-0.0667,
  WayPoint56YawAngle=-179.99,
  WayPoint56X=-10000000,
  WayPoint56Y=-10000000,
  WayPoint56Curvature=-0.0667,
  WayPoint57YawAngle=-179.99,
  WayPoint57X=-10000000,
  WayPoint57Y=-10000000,
  WayPoint57Curvature=-0.0667,
  WayPoint58YawAngle=-179.99,
  WayPoint58X=-10000000,
  WayPoint58Y=-10000000,
  WayPoint58Curvature=-0.0667,
  WayPoint59YawAngle=-179.99,
  WayPoint59X=-10000000,
  WayPoint59Y=-10000000,
  WayPoint59Curvature=-0.0667,
  WayPoint60YawAngle=-179.99,
  WayPoint60X=-10000000,
  WayPoint60Y=-10000000,
  WayPoint60Curvature=-0.0667,
  ENUYawAngle=-179.99,
  ENUX=-10000000,
  ENUY=-10000000,
  WayPoint1SegmentIndex=1,
  WayPoint2SegmentIndex=1,
  WayPoint3SegmentIndex=1,
  WayPoint4SegmentIndex=1,
  WayPoint5SegmentIndex=1,
  WayPoint6SegmentIndex=1,
  WayPoint7SegmentIndex=1,
  WayPoint8SegmentIndex=1,
  WayPoint9SegmentIndex=1,
  WayPoint10SegmentIndex=1,
  WayPoint11SegmentIndex=1,
  WayPoint12SegmentIndex=1,
  WayPoint13SegmentIndex=1,
  WayPoint14SegmentIndex=1,
  WayPoint15SegmentIndex=1,
  WayPoint16SegmentIndex=1,
  WayPoint17SegmentIndex=1,
  WayPoint18SegmentIndex=1,
  WayPoint19SegmentIndex=1,
  WayPoint20SegmentIndex=1,
  WayPoint21SegmentIndex=1,
  WayPoint22SegmentIndex=1,
  WayPoint23SegmentIndex=1,
  WayPoint24SegmentIndex=1,
  WayPoint25SegmentIndex=1,
  WayPoint26SegmentIndex=1,
  WayPoint27SegmentIndex=1,
  WayPoint28SegmentIndex=1,
  WayPoint29SegmentIndex=1,
  WayPoint30SegmentIndex=1,
  WayPoint31SegmentIndex=1,
  WayPoint32SegmentIndex=1,
  WayPoint33SegmentIndex=1,
  WayPoint34SegmentIndex=1,
  WayPoint35SegmentIndex=1,
  WayPoint36SegmentIndex=1,
  WayPoint37SegmentIndex=1,
  WayPoint38SegmentIndex=1,
  WayPoint39SegmentIndex=1,
  WayPoint40SegmentIndex=1,
  WayPoint41SegmentIndex=1,
  WayPoint42SegmentIndex=1,
  WayPoint43SegmentIndex=1,
  WayPoint44SegmentIndex=1,
  WayPoint45SegmentIndex=1,
  WayPoint46SegmentIndex=1,
  WayPoint47SegmentIndex=1,
  WayPoint48SegmentIndex=1,
  WayPoint49SegmentIndex=1,
  WayPoint50SegmentIndex=1,
  WayPoint51SegmentIndex=1,
  WayPoint52SegmentIndex=1,
  WayPoint53SegmentIndex=1,
  WayPoint54SegmentIndex=1,
  WayPoint55SegmentIndex=1,
  WayPoint56SegmentIndex=1,
  WayPoint57SegmentIndex=1,
  WayPoint58SegmentIndex=1,
  WayPoint59SegmentIndex=1,
  WayPoint60SegmentIndex=1,
  TrajectoryUpdateEnable=0,
  NearLateralOffsetOriginal=-10000000)

TRDP_SIGNALS_MC1_MMU2IDS_SEGMENT = struct(
  SegmentDataLife=0,
  Segment1VisioinPriority=0,
  Segment1GNSSPriority=0,
  Segment2VisioinPriority=0,
  Segment2GNSSPriority=0,
  Segment3VisioinPriority=0,
  Segment3GNSSPriority=0,
  Segment4VisioinPriority=0,
  Segment4GNSSPriority=0,
  Segment5VisioinPriority=0,
  Segment5GNSSPriority=0,
  Segment6VisioinPriority=0,
  Segment6GNSSPriority=0,
  Segment7VisioinPriority=0,
  Segment7GNSSPriority=0,
  Segment8VisioinPriority=0,
  Segment8GNSSPriority=0,
  Segment9VisioinPriority=0,
  Segment9GNSSPriority=0,
  Segment10VisioinPriority=0,
  Segment10GNSSPriority=0,
  Segment11VisioinPriority=0,
  Segment11GNSSPriority=0,
  Segment12VisioinPriority=0,
  Segment12GNSSPriority=0,
  Segment13VisioinPriority=0,
  Segment13GNSSPriority=0,
  Segment14VisioinPriority=0,
  Segment14GNSSPriority=0,
  Segment15VisioinPriority=0,
  Segment15GNSSPriority=0,
  Segment16VisioinPriority=0,
  Segment16GNSSPriority=0,
  Segment17VisioinPriority=0,
  Segment17GNSSPriority=0,
  Segment18VisioinPriority=0,
  Segment18GNSSPriority=0,
  Segment19VisioinPriority=0,
  Segment19GNSSPriority=0,
  Segment20VisioinPriority=0,
  Segment20GNSSPriority=0,
  Segment21VisioinPriority=0,
  Segment21GNSSPriority=0,
  Segment22VisioinPriority=0,
  Segment22GNSSPriority=0,
  Segment23VisioinPriority=0,
  Segment23GNSSPriority=0,
  Segment24VisioinPriority=0,
  Segment24GNSSPriority=0,
  Segment25VisioinPriority=0,
  Segment25GNSSPriority=0,
  Segment26VisioinPriority=0,
  Segment26GNSSPriority=0,
  Segment27VisioinPriority=0,
  Segment27GNSSPriority=0,
  Segment28VisioinPriority=0,
  Segment28GNSSPriority=0,
  Segment29VisioinPriority=0,
  Segment29GNSSPriority=0,
  Segment30VisioinPriority=0,
  Segment30GNSSPriority=0,
  Segment31VisioinPriority=0,
  Segment31GNSSPriority=0,
  Segment32VisioinPriority=0,
  Segment32GNSSPriority=0,
  Segment33VisioinPriority=0,
  Segment33GNSSPriority=0,
  Segment34VisioinPriority=0,
  Segment34GNSSPriority=0,
  Segment35VisioinPriority=0,
  Segment35GNSSPriority=0,
  Segment36VisioinPriority=0,
  Segment36GNSSPriority=0,
  Segment37VisioinPriority=0,
  Segment37GNSSPriority=0,
  Segment38VisioinPriority=0,
  Segment38GNSSPriority=0,
  Segment39VisioinPriority=0,
  Segment39GNSSPriority=0,
  Segment40VisioinPriority=0,
  Segment40GNSSPriority=0,
  Segment41VisioinPriority=0,
  Segment41GNSSPriority=0,
  Segment42VisioinPriority=0,
  Segment42GNSSPriority=0,
  Segment43VisioinPriority=0,
  Segment43GNSSPriority=0,
  Segment44VisioinPriority=0,
  Segment44GNSSPriority=0,
  Segment45VisioinPriority=0,
  Segment45GNSSPriority=0,
  Segment46VisioinPriority=0,
  Segment46GNSSPriority=0,
  Segment47VisioinPriority=0,
  Segment47GNSSPriority=0,
  Segment48VisioinPriority=0,
  Segment48GNSSPriority=0,
  Segment49VisioinPriority=0,
  Segment49GNSSPriority=0,
  Segment50VisioinPriority=0,
  Segment50GNSSPriority=0,
  Segment51VisioinPriority=0,
  Segment51GNSSPriority=0,
  Segment52VisioinPriority=0,
  Segment52GNSSPriority=0,
  Segment53VisioinPriority=0,
  Segment53GNSSPriority=0,
  Segment54VisioinPriority=0,
  Segment54GNSSPriority=0,
  Segment55VisioinPriority=0,
  Segment55GNSSPriority=0,
  Segment56VisioinPriority=0,
  Segment56GNSSPriority=0,
  Segment57VisioinPriority=0,
  Segment57GNSSPriority=0,
  Segment58VisioinPriority=0,
  Segment58GNSSPriority=0,
  Segment59VisioinPriority=0,
  Segment59GNSSPriority=0,
  Segment60VisioinPriority=0,
  Segment60GNSSPriority=0,
  Segment61VisioinPriority=0,
  Segment61GNSSPriority=0,
  Segment62VisioinPriority=0,
  Segment62GNSSPriority=0,
  Segment63VisioinPriority=0,
  Segment63GNSSPriority=0,
  Segment64VisioinPriority=0,
  Segment64GNSSPriority=0,
  Segment65VisioinPriority=0,
  Segment65GNSSPriority=0,
  Segment66VisioinPriority=0,
  Segment66GNSSPriority=0,
  Segment67VisioinPriority=0,
  Segment67GNSSPriority=0,
  Segment68VisioinPriority=0,
  Segment68GNSSPriority=0,
  Segment69VisioinPriority=0,
  Segment69GNSSPriority=0,
  Segment70VisioinPriority=0,
  Segment70GNSSPriority=0,
  Segment71VisioinPriority=0,
  Segment71GNSSPriority=0,
  Segment72VisioinPriority=0,
  Segment72GNSSPriority=0,
  Segment73VisioinPriority=0,
  Segment73GNSSPriority=0,
  Segment74VisioinPriority=0,
  Segment74GNSSPriority=0,
  Segment75VisioinPriority=0,
  Segment75GNSSPriority=0,
  Segment76VisioinPriority=0,
  Segment76GNSSPriority=0,
  Segment77VisioinPriority=0,
  Segment77GNSSPriority=0,
  Segment78VisioinPriority=0,
  Segment78GNSSPriority=0,
  Segment79VisioinPriority=0,
  Segment79GNSSPriority=0,
  Segment80VisioinPriority=0,
  Segment80GNSSPriority=0,
  Segment81VisioinPriority=0,
  Segment81GNSSPriority=0,
  Segment82VisioinPriority=0,
  Segment82GNSSPriority=0,
  Segment83VisioinPriority=0,
  Segment83GNSSPriority=0,
  Segment84VisioinPriority=0,
  Segment84GNSSPriority=0,
  Segment85VisioinPriority=0,
  Segment85GNSSPriority=0,
  Segment86VisioinPriority=0,
  Segment86GNSSPriority=0,
  Segment87VisioinPriority=0,
  Segment87GNSSPriority=0,
  Segment88VisioinPriority=0,
  Segment88GNSSPriority=0,
  Segment89VisioinPriority=0,
  Segment89GNSSPriority=0,
  Segment90VisioinPriority=0,
  Segment90GNSSPriority=0,
  Segment91VisioinPriority=0,
  Segment91GNSSPriority=0,
  Segment92VisioinPriority=0,
  Segment92GNSSPriority=0,
  Segment93VisioinPriority=0,
  Segment93GNSSPriority=0,
  Segment94VisioinPriority=0,
  Segment94GNSSPriority=0,
  Segment95VisioinPriority=0,
  Segment95GNSSPriority=0,
  Segment96VisioinPriority=0,
  Segment96GNSSPriority=0,
  Segment97VisioinPriority=0,
  Segment97GNSSPriority=0,
  Segment98VisioinPriority=0,
  Segment98GNSSPriority=0,
  Segment99VisioinPriority=0,
  Segment99GNSSPriority=0,
  Segment100VisioinPriority=0,
  Segment100GNSSPriority=0,
  Segment101VisioinPriority=0,
  Segment101GNSSPriority=0,
  Segment102VisioinPriority=0,
  Segment102GNSSPriority=0,
  Segment103VisioinPriority=0,
  Segment103GNSSPriority=0,
  Segment104VisioinPriority=0,
  Segment104GNSSPriority=0,
  Segment105VisioinPriority=0,
  Segment105GNSSPriority=0,
  Segment106VisioinPriority=0,
  Segment106GNSSPriority=0,
  Segment107VisioinPriority=0,
  Segment107GNSSPriority=0,
  Segment108VisioinPriority=0,
  Segment108GNSSPriority=0,
  Segment109VisioinPriority=0,
  Segment109GNSSPriority=0,
  Segment110VisioinPriority=0,
  Segment110GNSSPriority=0,
  Segment111VisioinPriority=0,
  Segment111GNSSPriority=0,
  Segment112VisioinPriority=0,
  Segment112GNSSPriority=0,
  Segment113VisioinPriority=0,
  Segment113GNSSPriority=0,
  Segment114VisioinPriority=0,
  Segment114GNSSPriority=0,
  Segment115VisioinPriority=0,
  Segment115GNSSPriority=0,
  Segment116VisioinPriority=0,
  Segment116GNSSPriority=0,
  Segment117VisioinPriority=0,
  Segment117GNSSPriority=0,
  Segment118VisioinPriority=0,
  Segment118GNSSPriority=0,
  Segment119VisioinPriority=0,
  Segment119GNSSPriority=0,
  Segment120VisioinPriority=0,
  Segment120GNSSPriority=0,
  GridOriginLatitude=-90,
  GridOriginLongitude=-180)

CONFIG_MC2_CCU2IDS = Simulink.Bus()  % MC2_CCU2IDS
  byte_order: uint32[29 1]  % byte_order
  factor: double[29 1]  % factor
  offset: double[29 1]  % offset
  type: uint32[29 1]  % type
  start_byte: uint32[29 1]  % start_byte
  start_bit: uint32[29 1]  % start_bit
  bit_length: uint32[29 1]  % bit_length
  min: double[29 1]  % min
  max: double[29 1]  % max

CONFIG_MC2_IDS2CCU = Simulink.Bus()  % MC2_IDS2CCU
  byte_order: uint32[223 1]  % byte_order
  factor: double[223 1]  % factor
  offset: double[223 1]  % offset
  type: uint32[223 1]  % type
  start_byte: uint32[223 1]  % start_byte
  start_bit: uint32[223 1]  % start_bit
  bit_length: uint32[223 1]  % bit_length
  min: double[223 1]  % min
  max: double[223 1]  % max

CONFIG_MC2_MMU2IDS_POINT = Simulink.Bus()  % MC2_MMU2IDS_POINT
  byte_order: uint32[307 1]  % byte_order
  factor: double[307 1]  % factor
  offset: double[307 1]  % offset
  type: uint32[307 1]  % type
  start_byte: uint32[307 1]  % start_byte
  start_bit: uint32[307 1]  % start_bit
  bit_length: uint32[307 1]  % bit_length
  min: double[307 1]  % min
  max: double[307 1]  % max

CONFIG_MC2_MMU2IDS_SEGMENT = Simulink.Bus()  % MC2_MMU2IDS_SEGMENT
  byte_order: uint32[243 1]  % byte_order
  factor: double[243 1]  % factor
  offset: double[243 1]  % offset
  type: uint32[243 1]  % type
  start_byte: uint32[243 1]  % start_byte
  start_bit: uint32[243 1]  % start_bit
  bit_length: uint32[243 1]  % bit_length
  min: double[243 1]  % min
  max: double[243 1]  % max

MC2_CCU2IDS = Simulink.Bus()  % MC2_CCU2IDS
  Hour: double, Min=0, Max=23  % 时间轴 时
  Minute: double, Min=0, Max=59  % 时间轴 分
  Second: double, Min=0, Max=59  % 时间轴 秒
  TramSpeed: double, Min=0, Max=80  % 整车车速
  MC1ArticulatedAngle: double, Min=-60, Max=60  % MC1与TP间铰接盘角度
  MC2ArticulatedAngle: double, Min=-60, Max=60  % MC2与TP间铰接盘角度
  SteeringAxle1Angle: double, Min=-25, Max=25  % 轴1转向角度
  SteeringAxle6Angle: double, Min=-25, Max=25  % 轴6转向角度
  TGS5FaultStatus: double, Min=0, Max=1  % 无轨导向控制器5故障状态（指代MC2端收到的无轨导向系统故障状态）
  MC1AutonomousTracking: double, Min=0, Max=1  % MC1自动循迹
  MC1TurnLeftIndicator: double, Min=0, Max=1  % MC1左转向灯
  MC1TurnRightIndicator: double, Min=0, Max=1  % MC1右转向灯
  MC1OccupiedStatus: double, Min=0, Max=1  % MC1占有状态
  MC1DriveBackward: double, Min=0, Max=1  % MC1行车方向向后
  MC1OilPumpStatus: double, Min=0, Max=1  % MC1助力油泵状态
  MC1ParkingStatus: double, Min=0, Max=1  % MC1驻车状态
  MC2AutonomousTracking: double, Min=0, Max=1  % MC2自动循迹
  MC2TurnLeftIndicator: double, Min=0, Max=1  % MC2左转向灯
  MC2TurnRightIndicator: double, Min=0, Max=1  % MC2右转向灯
  MC2OccupiedStatus: double, Min=0, Max=1  % MC2占有状态
  MC2DriveBackward: double, Min=0, Max=1  % MC2行车方向向后
  MC2OilPumpStatus: double, Min=0, Max=1  % MC2助力油泵状态
  MC2ParkingStatus: double, Min=0, Max=1  % MC2驻车状态
  TCSNLife: double, Min=0, Max=255  % 整车网络控制系统生命信号
  Year: double, Min=0, Max=99  % 时间轴 年
  Month: double, Min=1, Max=12  % 时间轴 月
  Day: double, Min=1, Max=31  % 时间轴 日
  SteeringAxle2Angle: double, Min=-25, Max=25  % 轴2转向角度
  SteeringAxle5Angle: double, Min=-25, Max=25  % 轴5转向角度

MC2_IDS2CCU = Simulink.Bus()  % MC2_IDS2CCU
  TramYawRate: double, Min=-100.59776, Max=100.59469  % 列车横摆角速度(转发给摄像头)
  IDSLife: double, Min=0, Max=255  % 智能驾驶系统生命信号
  SurroundingCameraDisplaySwitch: double, Min=90, Max=165  % 周界环视画面切换指令
  LateralControlSoftwareVersion: double, Min=0, Max=65535  % 横向控制程序版本
  LDWImageStatus: double, Min=0, Max=4  % 车道偏离预警图标状态显示
  AutonomousTrackingWorkStatus: double, Min=0, Max=1  % 自动循迹工作状态
  AutonomousTrackingFaultStatus: double, Min=0, Max=1  % 自动循迹故障状态
  AutonomousTrackingAlarmSound: double, Min=0, Max=15  % 自动循迹声音报警
  OriginalA0: double, Min=-10.24, Max=10.23  % 循迹线轨迹偏差A0
  OriginalA1: double, Min=-1.024, Max=1.023  % 循迹线斜率A1
  OriginalA2: double, Min=-0.08192, Max=0.08191  % 循迹线曲率A2
  OriginalA3: double, Min=-0.0002048, Max=0.0002047  % 循迹线曲率变化率A3
  VisionSetFirstSteeringAxleAngle: double, Min=-25, Max=25  % 视觉循迹设置头轴转向角度
  SteeringWheelAngle: double, Min=-1575, Max=1575  % 方向盘转向角度
  DesiredAdditionalTorque: double, Min=-12.8, Max=12.7  % 期望电机叠加扭矩
  MotorPowerTorque: double, Min=-5, Max=4.96132  % 线控转向系统电机助力扭矩
  SteeringWheelTorque: double, Min=-8.96, Max=8.89  % 方向盘转向扭矩
  GNSSWeek: double, Min=0, Max=9999  % 组合惯导接收到的自1980-1-6 至当前的星期数（接收机时间）
  GNSSTime: double, Min=0, Max=999999.999  % 组合惯导接收到的当前星期内经过的秒数（接收机时间）
  GNSSHeadingAngle: double, Min=0, Max=359.99  % 组合惯导航向角
  GNSSPitchAngle: double, Min=-90, Max=90  % 组合惯导俯仰角
  GNSSRollAngle: double, Min=-180, Max=180  % 组合惯导横滚角
  GNSSLatitude: double, Min=-90, Max=90  % 组合惯导纬度
  GNSSLongitude: double, Min=-180, Max=180  % 组合惯导经度
  GNSSAltitude: double, Min=-200, Max=8000  % 组合惯导高度
  GNSSEastSpeed: double, Min=-20, Max=20  % 组合惯导东向速度
  GNSSNorthSpeed: double, Min=-20, Max=20  % 组合惯导北向速度
  GNSSUpperSpeed: double, Min=-20, Max=20  % 组合惯导天向速度
  GNSSBaseline: double, Min=0, Max=30  % 组合惯导基线长度
  GNSSFrontAntennaSatelliteNumber: double, Min=0, Max=99  % 组合惯导前天线可用卫星数
  GNSSRearAntennaSatelliteNumber: double, Min=0, Max=99  % 组合惯导后天线可用卫星数
  GNSSWorkStatus: double, Min=0, Max=255  % 组合惯导工作状态
  LateralControlExecuteWord: double, Min=0, Max=65535  % 横向控制执行状态字
  IDSSetTractionBlock: double, Min=0, Max=1  % 智能驾驶系统输出牵引封锁
  IDSSetSafeBrake: double, Min=0, Max=1  % 智能驾驶系统输出安全制动
  GNSSAngleSpeedX: double, Min=-360, Max=360  % 组合惯导X角速度
  GNSSAngleSpeedY: double, Min=-360, Max=360  % 组合惯导Y角速度
  GNSSAngleSpeedZ: double, Min=-360, Max=360  % 组合惯导Z角速度
  GNSSAccelerationX: double, Min=-1, Max=1  % 组合惯导X加速度
  GNSSAccelerationY: double, Min=-1, Max=1  % 组合惯导Y加速度
  GNSSAccelerationZ: double, Min=-1, Max=1  % 组合惯导Z加速度
  GNSSTemperature: double, Min=-40, Max=55  % 组合惯导温度
  A0Offset: double, Min=-0.5, Max=0.5  % 循迹线轨迹偏差A0偏置
  A1Offset: double, Min=-0.1, Max=0.1  % 循迹线斜率A1偏置
  SteeringWheelAngleOffset: double, Min=-128, Max=127  % 方向盘转向角度偏置
  FilteredA0: double, Min=-10.24, Max=10.23  % 滤波后的循迹线轨迹偏差A0
  FilteredA1: double, Min=-1.024, Max=1.023  % 滤波后的循迹线斜率A1
  FilteredA2: double, Min=-0.08192, Max=0.08191  % 滤波后的循迹线曲率A2
  FilteredA3: double, Min=-0.0002048, Max=0.0002047  % 滤波后的循迹线曲率变化率A3
  PreviewLateralOffset: double, Min=-10.24, Max=10.23  % 预瞄处的横向轨迹偏差
  PreviewAngleOffset: double, Min=-1.024, Max=1.023  % 预瞄处的角度偏差
  LDWImageStatus_2: double, Min=0, Max=4  % 车道偏离预警图标状态显示
  AutonomousTrackingAlarmSound_2: double, Min=0, Max=15  % 自动循迹声音报警
  TrackingCameraSoftwareVersionHigh4Byte: double, Min=0, Max=4294967295  % 循迹摄像头软件版本高4字节
  TrackingCameraSoftwareVersionlow4Byte: double, Min=0, Max=4294967295  % 循迹摄像头软件版本低4字节
  TrackingCameraCommunicationFault: double, Min=0, Max=1  % 循迹摄像头通信故障
  EPSFault: double, Min=0, Max=1  % 线控转向控制器故障
  GNSSFault: double, Min=0, Max=1  % 组合惯导故障
  TCSNCommunicationFault: double, Min=0, Max=1  % 整车网络通信故障
  EPS_FL1_TQS_OVERFLOW: double, Min=0, Max=1  % 线控转向系统副力矩不在设计范围内
  EPS_FL1_TQM_OVERFLOW: double, Min=0, Max=1  % 线控转向系统主力矩不在设计范围内
  EPS_FL1_TQ_NOT_MATCH: double, Min=0, Max=1  % 线控转向系统主副力矩信号不匹配
  EPS_FL1_VSENSOR_F: double, Min=0, Max=1  % 线控转向系统传感器电源电压不正常
  EPS_FL1_VMOTOR_F: double, Min=0, Max=1  % 线控转向系统电机电压不正常
  EPS_FL1_CMOTOR_F: double, Min=0, Max=1  % 线控转向系统电机电流不正常
  EPS_FL1_DRIVER_CIR_F: double, Min=0, Max=1  % 线控转向系统驱动电路失效
  EPS_FL1_CDIFF_EX: double, Min=0, Max=1  % 线控转向系统实际和目标电流差异过大
  EPS_FL1_RELAY_FAIL: double, Min=0, Max=1  % 线控转向系统控制器继电器失效
  EPS_FL1_SIGN_AD_FAIL: double, Min=0, Max=1  % 线控转向系统控制器信号调理电路失效
  EPS_FL2_BAT_VHIGH: double, Min=0, Max=1  % 线控转向系统电源电压过高
  EPS_FL2_BAT_VLOW: double, Min=0, Max=1  % 线控转向系统电源电压过低
  EPS_FL2_VSPD_F: double, Min=0, Max=1  % 线控转向系统车速信号异常
  EPS_FL2_SPD_LOST: double, Min=0, Max=1  % 线控转向系统CAN车速报文丢失
  EPS_FL3_CAN_Lost: double, Min=0, Max=1  % 线控转向系统CAN指令丢失
  EPS_FL1_UVW_F: double, Min=0, Max=1  % 线控转向系统位置传感器UVW信号错误
  EPS_FL1_SIGN_AB_F: double, Min=0, Max=1  % 线控转向系统位置传感器AB信号错误
  EPS_FL1_VPOS_SEN_F: double, Min=0, Max=1  % 线控转向系统位置传感器电压不正常
  EPS_FL1_MotorCur_F: double, Min=0, Max=1  % 线控转向系统电机电流不正常S1
  EPS_FL1_AD_OFFSET_DF: double, Min=0, Max=1  % 线控转向系统AD上电offset检测错误
  EPS_FL1_V_F: double, Min=0, Max=1  % 线控转向系统电压不正常S1
  EPS_FL1_Vbus_Short: double, Min=0, Max=1  % 线控转向系统上电Vbus短路
  EPS_FL1_Relay_Bonding: double, Min=0, Max=1  % 线控转向系统继电器粘连错误
  EPS_FL1_V_Diff_F: double, Min=0, Max=1  % 线控转向系统电源电压前后电路检测不一致
  EPS_FL1_V_F_longtime: double, Min=0, Max=1  % 线控转向系统长时间电压不正常错误
  EPS_FL1_IG_F: double, Min=0, Max=1  % 线控转向系统点火电路故障
  EPS_FL1_5V_abnormal: double, Min=0, Max=1  % 线控转向系统Power 5V abnormal
  EPS_FL1_5V_from_65381: double, Min=0, Max=1  % 线控转向系统Power 5V from 65381
  EPS_FL3_CAN_ANGOVERFLOW: double, Min=0, Max=1  % 线控转向系统CAN指令角度不在设计范围
  EPS_FL3_CALIB_ERR: double, Min=0, Max=1  % 线控转向系统标定错误
  EPS_FL3_TEMP_PROT_L1: double, Min=0, Max=1  % 线控转向系统温度保护Level1
  EPS_FL3_AB_CAL_ERR: double, Min=0, Max=1  % 线控转向系统AB值角度计算错误
  EPS_FL2_TEMP_PROT_L2: double, Min=0, Max=1  % 线控转向系统温度保护Level2
  EPS_FL3_SIGNA_F: double, Min=0, Max=1  % 线控转向系统转角A信号不正常
  EPS_FL3_SIGNR_F: double, Min=0, Max=1  % 线控转向系统转角R信号不正常
  EPS_FL3_ANG_SEN_LOST: double, Min=0, Max=1  % 线控转向系统或者CAN转角传感器丢失
  EPS_FL3_LOGIC_ANG_ER: double, Min=0, Max=1  % 线控转向系统转角计算逻辑异常
  EPS_FL2_DVSPD_F: double, Min=0, Max=1  % 线控转向系统车速信号变化异常
  EPS_FL2_CAN_BUSOFF: double, Min=0, Max=1  % 线控转向系统CAN-BUSOFF
  EPS_FL2_ENGSPD_F: double, Min=0, Max=1  % 线控转向系统CAN发动机转速报文异常
  EPS_FL2_ENGSPD_LOST: double, Min=0, Max=1  % 线控转向系统CAN发动机转速报文丢失
  EPS_FL1_Motor_PhaseLost: double, Min=0, Max=1  % 线控转向系统电机缺相
  EPS_FL1_Motor_PhaseLost_BC: double, Min=0, Max=1  % 线控转向系统电机缺相BC
  EPSCommunicationFault: double, Min=0, Max=1  % 线控转向控制器通信故障
  AutonomousTrackingCameraConfidenceLowFault: double, Min=0, Max=1  % 循迹视觉输入置信度低故障
  SteeringAxleAngleSensorFault: double, Min=0, Max=1  % 转向轴角度传感器故障
  AutonomousTrackingCameraDataUnchangedAbnormalFault: double, Min=0, Max=1  % 前视道路标识线摄像头识别数据不变异常故障
  LaneDeviationOutOfBoundaryFault: double, Min=0, Max=1  % 车道偏离超过边界故障
  TCSNLife: double, Min=0, Max=255  % 整车网络控制系统生命信号
  Year: double, Min=0, Max=99  % 时间轴 年
  Month: double, Min=1, Max=12  % 时间轴 月
  Day: double, Min=1, Max=31  % 时间轴 日
  Hour: double, Min=0, Max=23  % 时间轴 时
  Minute: double, Min=0, Max=59  % 时间轴 分
  Second: double, Min=0, Max=59  % 时间轴 秒
  TramSpeed: double, Min=0, Max=80  % 整车车速
  MC1ArticulatedAngle: double, Min=-60, Max=60  % MC1与TP间铰接盘角度
  MC2ArticulatedAngle: double, Min=-60, Max=60  % MC2与TP间铰接盘角度
  SteeringAxle1Angle: double, Min=-25, Max=25  % 轴1转向角度
  SteeringAxle6Angle: double, Min=-25, Max=25  % 轴6转向角度
  TGS5FaultStatus: double, Min=0, Max=1  % 无轨导向控制器5故障状态（指代MC2端收到的无轨导向系统故障状态）
  MC1AutonomousTracking: double, Min=0, Max=1  % MC1自动循迹
  MC1TurnLeftIndicator: double, Min=0, Max=1  % MC1左转向灯
  MC1TurnRightIndicator: double, Min=0, Max=1  % MC1右转向灯
  MC1OccupiedStatus: double, Min=0, Max=1  % MC1占有状态
  MC1DriveBackward: double, Min=0, Max=1  % MC1行车方向向后
  MC1OilPumpStatus: double, Min=0, Max=1  % MC1助力油泵状态
  MC1ParkingStatus: double, Min=0, Max=1  % MC1驻车状态
  MC2AutonomousTracking: double, Min=0, Max=1  % MC2自动循迹
  MC2TurnLeftIndicator: double, Min=0, Max=1  % MC2左转向灯
  MC2TurnRightIndicator: double, Min=0, Max=1  % MC2右转向灯
  MC2OccupiedStatus: double, Min=0, Max=1  % MC2占有状态
  MC2DriveBackward: double, Min=0, Max=1  % MC2行车方向向后
  MC2OilPumpStatus: double, Min=0, Max=1  % MC2助力油泵状态
  MC2ParkingStatus: double, Min=0, Max=1  % MC2驻车状态
  GNSSCommunicationFault: double, Min=0, Max=1  % 组合惯导通信故障
  LateralControlWarning: double, Min=0, Max=4294967295  % 横向控制警告（不构成手动接管条件，关注的状态位集合）
  SteeringAxle2Angle: double, Min=-25, Max=25  % 轴2转向角度
  SteeringAxle5Angle: double, Min=-25, Max=25  % 轴5转向角度
  GNSSLife: double, Min=0, Max=255  % 组合惯导生命信号
  TrackingCameraLife: double, Min=0, Max=255  % 循迹摄像头生命信号
  EPSLife: double, Min=0, Max=255  % 线控转向系统生命信号
  GNSSLocationInvalidFault: double, Min=0, Max=1  % 组合惯导定位无效故障
  GNSSPositionOutOfBoundaryFault: double, Min=0, Max=1  % 组合惯导当前位置超过边界故障
  SteeringAxleAngleJumpAbnormalFault: double, Min=0, Max=1  % 转向轴角度异常突变故障
  SteeringWheelAngleJumpAbnormalFault: double, Min=0, Max=1  % 方向盘角度异常突变故障
  TramSpeedJumpAbnormalFault: double, Min=0, Max=1  % 整车速度异常突变故障
  A0JumpAbnormalFault: double, Min=0, Max=1  % A0异常突变故障
  A1JumpAbnormalFault: double, Min=0, Max=1  % A1异常突变故障
  A2JumpAbnormalFault: double, Min=0, Max=1  % A2异常突变故障
  ENUYawAngleJumpAbnormalFault: double, Min=0, Max=1  % 东北天坐标系下横摆角异常突变故障
  ENUXJumpAbnormalFault: double, Min=0, Max=1  % 东北天坐标系下x坐标异常突变故障
  ENUYJumpAbnormalFault: double, Min=0, Max=1  % 东北天坐标系下y坐标异常突变故障
  MMUCommunicationFault: double, Min=0, Max=1  % 地图管理单元通信故障
  EPSWorkStatus: double, Min=0, Max=15  % 线控转向系统工作状态
  DesiredEPSWorkMode: double, Min=0, Max=15  % 期望线控转向系统工作模式
  AutonomousTrackingCameraConfidence: double, Min=0, Max=1  % 循迹摄像头置信度
  LocationValidStatus: double, Min=0, Max=1  % 定位有效状态
  PreventAutoTrackingStatus: double, Min=0, Max=1  % 阻止自动循迹状态
  TaskIndex: double, Min=0, Max=255  % 任务代号
  BaseInterventionCondition: double, Min=0, Max=4294967295  % 基本手动接管条件
  VisionInterventionCondition: double, Min=0, Max=4294967295  % 视觉循迹手动接管条件
  GNSSInterventionCondition: double, Min=0, Max=4294967295  % GNSS循迹手动接管条件
  TramTypeIndex: double, Min=0, Max=255  % 车型索引
  StateFlowLateralControlMethod: double, Min=0, Max=255  % 横向控制方法转移到的状态
  StateFlowLateralControlMode: double, Min=0, Max=255  % 横向控制模式转移到的状态
  StateFlowManualDrivingMode: double, Min=0, Max=255  % 手动驾驶模式转移到的状态
  StateFlowAutoTrackingMode: double, Min=0, Max=255  % 循迹驾驶模式转移到的状态
  StateFlowWaitInterventionMode: double, Min=0, Max=255  % 等待接管模式转移到的状态
  VisionPriorityCurrent: double, Min=0, Max=3  % 当前视觉循迹优先级
  GNSSPriorityCurrent: double, Min=0, Max=3  % 当前GNSS循迹优先级
  LateralControlMethodCurrent: double, Min=0, Max=2  % 本周期横向控制方法
  LaneDeviationTolerance: double, Min=0.3, Max=0.6  % 列车偏离循迹线的阈值
  StateFlowAlarmVoiceMode: double, Min=0, Max=255  % 报警声音模式转移到的状态
  StateFlowManualDrivingAlarmVoice: double, Min=0, Max=255  % 手动驾驶时报警声音转移到的状态
  StateFlowAutoTrackingAlarmVoice: double, Min=0, Max=255  % 循迹驾驶时报警声音转移到的状态
  DesiredSteeringWheelAngle: double, Min=-600, Max=600  % 期望方向盘转向角度
  DesiredSteeringAxleAngle: double, Min=-15, Max=15  % 目标转向轴转角
  StateFlowSetSteeringWheelAngleSignalProcessingMode: double, Min=0, Max=255  % 目标方向盘转角信号处理模式转移到的状态
  StateFlowConfidenceCheck: double, Min=0, Max=255  % 前视道路标识线摄像头置信度检查转移到的状态
  StateFlowDataUnchangedAbnormalCheck: double, Min=0, Max=255  % 前视道路标识线摄像头识别数据不变异常检查转移到的状态
  DistanceOffsetPreviewPointYawAngle: double, Min=-179.99, Max=180  % 本周期距离偏差预瞄点横摆角
  DistanceOffsetPreviewPointX: double, Min=-10000000, Max=10000000  % 本周期距离偏差预瞄点x坐标
  DistanceOffsetPreviewPointY: double, Min=-10000000, Max=10000000  % 本周期距离偏差预瞄点y坐标
  TramKinematicModelYawRate: double, Min=-100, Max=100  % 根据列车运动学模型计算得到的横摆角速度
  TramKinematicModelSpeedX: double, Min=-22.22, Max=22.22  % 根据列车运动学模型计算得到的x轴向速度
  TramKinematicModelSpeedY: double, Min=-22.22, Max=22.22  % 根据列车运动学模型计算得到的y轴向速度
  TramKinematicModelSlipAngle: double, Min=-100, Max=100  % 根据列车运动学模型计算得到的侧偏角度
  ExecuteDelayEstimatedYawAngle: double, Min=-1000000000, Max=1000000000  % 考虑执行滞后而估计的东北天坐标系下横摆角
  ExecuteDelayEstimatedX: double, Min=-10000000, Max=10000000  % 考虑执行滞后而估计的东北天坐标系下x坐标
  ExecuteDelayEstimatedY: double, Min=-10000000, Max=10000000  % 考虑执行滞后而估计的东北天坐标系下y坐标
  StateFlowTramSpeedCheck: double, Min=0, Max=255  % 列车速度检查转移到的状态
  StateFlowLaneCurvatureCheck: double, Min=0, Max=255  % 标识线曲率检查转移到的状态
  StateFlowLaneSlopeCheck: double, Min=0, Max=255  % 标识线斜率率检查转移到的状态
  StateFlowLaneSmallCurvatureCheck: double, Min=0, Max=255  % 标识线小曲率检查转移到的状态
  GNSSPreviewTime: double, Min=0, Max=10  % GNSS预瞄时间
  GNSSMinPreviewDistance: double, Min=0, Max=20  % GNSS最小预瞄距离
  StanleyLateralOffsetFactor: double, Min=0, Max=20  % Stanley横向偏差矫正系数
  SteeringAxleAngleFactor: double, Min=0, Max=20  % 转向轴转角矫正系数
  StanleySetSteeringAxleAngle: double, Min=-15, Max=15  % Stanley输出目标转向轴转角
  ClosestPointYawAngle: double, Min=-179.99, Max=180  % 参考轨迹上的最近点横摆角
  ClosestPointX: double, Min=-10000000, Max=10000000  % 参考轨迹上的最近点x坐标
  ClosestPointY: double, Min=-10000000, Max=10000000  % 参考轨迹上的最近点y坐标
  ClosestPointCurvature: double, Min=-0.0667, Max=0.0667  % 参考轨迹上的最近点曲率
  ClosestPointSegmentIndex: double, Min=1, Max=120  % 参考轨迹上的最近点隶属区间代号
  AngleOffsetPreviewPointYawAngle: double, Min=-179.99, Max=180  % 本周期角度偏差预瞄点横摆角
  AngleOffsetPreviewPointX: double, Min=-10000000, Max=10000000  % 本周期角度偏差预瞄点x坐标
  AngleOffsetPreviewPointY: double, Min=-10000000, Max=10000000  % 本周期角度偏差预瞄点y坐标
  GNSSPreviewLateralOffset: double, Min=-10000000, Max=10000000  % GNSS预瞄处横向偏差
  NearLateralOffsetCurrent: double, Min=-10000000, Max=10000000  % 在线规划之后的本周期近处横向偏差
  GNSSPreviewAngleOffset: double, Min=-179.99, Max=180  % GNSS预瞄处角度偏差
  GNSSAngleOffsetPreviewDistance: double, Min=0, Max=30  % GNSS角度偏差预瞄距离
  ReferenceTrajectoryClosestSegmentStartPointIndex: double, Min=0, Max=6000  % 本周期最近线段起始点索引
  GNSSDistanceOffsetPreviewDistance: double, Min=0, Max=30  % GNSS距离偏差预瞄距离
  DesiredSteeringWheelAngleSpeed: double, Min=50, Max=540  % 期望方向盘角速度
  LocalReferenceTrajectoryPointNumber2Control: double, Min=0, Max=6000  % 输入给控制的局部参考轨迹路点数量
  LocalReferenceTrajectoryPoint1X2Control: double, Min=-10000000, Max=10000000  % 输入给控制的局部参考轨迹第1个点x坐标
  LocalReferenceTrajectoryPoint1Y2Control: double, Min=-10000000, Max=10000000  % 输入给控制的局部参考轨迹第1个点y坐标
  AngleOffsetPreviewPointCurvature: double, Min=-0.0667, Max=0.0667  % 本周期角度偏差预瞄点曲率
  MaxAbsoluteCurvature: double, Min=0, Max=0.0667  % 最近点和预瞄点曲率绝对值之间的最大值
  SteeringWheelAngleSpeed: double, Min=50, Max=540  % 方向盘转向角速度
  DistanceOffsetPreviewPointCurvature: double, Min=-0.0667, Max=0.0667  % 本周期距离偏差预瞄点曲率
  FilteredTramSpeed: double, Min=0, Max=22.3  % 滤波后的整车车速
  GNSSTrajectoryDeviationTolerance: double, Min=0.3, Max=2  % 列车偏离GNSS参考轨迹的阈值

MC2_MMU2IDS_POINT = Simulink.Bus()  % MC2_MMU2IDS_POINT
  WayPointDataLife: double, Min=0, Max=255  % 路点属性数据生命信号
  WayPointNumber: double, Min=0, Max=60  % 有效路点总数
  WayPoint1YawAngle: double, Min=-179.99, Max=180  % 第1个路点横摆角
  WayPoint1X: double, Min=-10000000, Max=10000000  % 第1个路点x坐标
  WayPoint1Y: double, Min=-10000000, Max=10000000  % 第1个路点y坐标
  WayPoint1Curvature: double, Min=-0.0667, Max=0.0667  % 第1个路点曲率
  WayPoint2YawAngle: double, Min=-179.99, Max=180  % 第2个路点横摆角
  WayPoint2X: double, Min=-10000000, Max=10000000  % 第2个路点x坐标
  WayPoint2Y: double, Min=-10000000, Max=10000000  % 第2个路点y坐标
  WayPoint2Curvature: double, Min=-0.0667, Max=0.0667  % 第2个路点曲率
  WayPoint3YawAngle: double, Min=-179.99, Max=180  % 第3个路点横摆角
  WayPoint3X: double, Min=-10000000, Max=10000000  % 第3个路点x坐标
  WayPoint3Y: double, Min=-10000000, Max=10000000  % 第3个路点y坐标
  WayPoint3Curvature: double, Min=-0.0667, Max=0.0667  % 第3个路点曲率
  WayPoint4YawAngle: double, Min=-179.99, Max=180  % 第4个路点横摆角
  WayPoint4X: double, Min=-10000000, Max=10000000  % 第4个路点x坐标
  WayPoint4Y: double, Min=-10000000, Max=10000000  % 第4个路点y坐标
  WayPoint4Curvature: double, Min=-0.0667, Max=0.0667  % 第4个路点曲率
  WayPoint5YawAngle: double, Min=-179.99, Max=180  % 第5个路点横摆角
  WayPoint5X: double, Min=-10000000, Max=10000000  % 第5个路点x坐标
  WayPoint5Y: double, Min=-10000000, Max=10000000  % 第5个路点y坐标
  WayPoint5Curvature: double, Min=-0.0667, Max=0.0667  % 第5个路点曲率
  WayPoint6YawAngle: double, Min=-179.99, Max=180  % 第6个路点横摆角
  WayPoint6X: double, Min=-10000000, Max=10000000  % 第6个路点x坐标
  WayPoint6Y: double, Min=-10000000, Max=10000000  % 第6个路点y坐标
  WayPoint6Curvature: double, Min=-0.0667, Max=0.0667  % 第6个路点曲率
  WayPoint7YawAngle: double, Min=-179.99, Max=180  % 第7个路点横摆角
  WayPoint7X: double, Min=-10000000, Max=10000000  % 第7个路点x坐标
  WayPoint7Y: double, Min=-10000000, Max=10000000  % 第7个路点y坐标
  WayPoint7Curvature: double, Min=-0.0667, Max=0.0667  % 第7个路点曲率
  WayPoint8YawAngle: double, Min=-179.99, Max=180  % 第8个路点横摆角
  WayPoint8X: double, Min=-10000000, Max=10000000  % 第8个路点x坐标
  WayPoint8Y: double, Min=-10000000, Max=10000000  % 第8个路点y坐标
  WayPoint8Curvature: double, Min=-0.0667, Max=0.0667  % 第8个路点曲率
  WayPoint9YawAngle: double, Min=-179.99, Max=180  % 第9个路点横摆角
  WayPoint9X: double, Min=-10000000, Max=10000000  % 第9个路点x坐标
  WayPoint9Y: double, Min=-10000000, Max=10000000  % 第9个路点y坐标
  WayPoint9Curvature: double, Min=-0.0667, Max=0.0667  % 第9个路点曲率
  WayPoint10YawAngle: double, Min=-179.99, Max=180  % 第10个路点横摆角
  WayPoint10X: double, Min=-10000000, Max=10000000  % 第10个路点x坐标
  WayPoint10Y: double, Min=-10000000, Max=10000000  % 第10个路点y坐标
  WayPoint10Curvature: double, Min=-0.0667, Max=0.0667  % 第10个路点曲率
  WayPoint11YawAngle: double, Min=-179.99, Max=180  % 第11个路点横摆角
  WayPoint11X: double, Min=-10000000, Max=10000000  % 第11个路点x坐标
  WayPoint11Y: double, Min=-10000000, Max=10000000  % 第11个路点y坐标
  WayPoint11Curvature: double, Min=-0.0667, Max=0.0667  % 第11个路点曲率
  WayPoint12YawAngle: double, Min=-179.99, Max=180  % 第12个路点横摆角
  WayPoint12X: double, Min=-10000000, Max=10000000  % 第12个路点x坐标
  WayPoint12Y: double, Min=-10000000, Max=10000000  % 第12个路点y坐标
  WayPoint12Curvature: double, Min=-0.0667, Max=0.0667  % 第12个路点曲率
  WayPoint13YawAngle: double, Min=-179.99, Max=180  % 第13个路点横摆角
  WayPoint13X: double, Min=-10000000, Max=10000000  % 第13个路点x坐标
  WayPoint13Y: double, Min=-10000000, Max=10000000  % 第13个路点y坐标
  WayPoint13Curvature: double, Min=-0.0667, Max=0.0667  % 第13个路点曲率
  WayPoint14YawAngle: double, Min=-179.99, Max=180  % 第14个路点横摆角
  WayPoint14X: double, Min=-10000000, Max=10000000  % 第14个路点x坐标
  WayPoint14Y: double, Min=-10000000, Max=10000000  % 第14个路点y坐标
  WayPoint14Curvature: double, Min=-0.0667, Max=0.0667  % 第14个路点曲率
  WayPoint15YawAngle: double, Min=-179.99, Max=180  % 第15个路点横摆角
  WayPoint15X: double, Min=-10000000, Max=10000000  % 第15个路点x坐标
  WayPoint15Y: double, Min=-10000000, Max=10000000  % 第15个路点y坐标
  WayPoint15Curvature: double, Min=-0.0667, Max=0.0667  % 第15个路点曲率
  WayPoint16YawAngle: double, Min=-179.99, Max=180  % 第16个路点横摆角
  WayPoint16X: double, Min=-10000000, Max=10000000  % 第16个路点x坐标
  WayPoint16Y: double, Min=-10000000, Max=10000000  % 第16个路点y坐标
  WayPoint16Curvature: double, Min=-0.0667, Max=0.0667  % 第16个路点曲率
  WayPoint17YawAngle: double, Min=-179.99, Max=180  % 第17个路点横摆角
  WayPoint17X: double, Min=-10000000, Max=10000000  % 第17个路点x坐标
  WayPoint17Y: double, Min=-10000000, Max=10000000  % 第17个路点y坐标
  WayPoint17Curvature: double, Min=-0.0667, Max=0.0667  % 第17个路点曲率
  WayPoint18YawAngle: double, Min=-179.99, Max=180  % 第18个路点横摆角
  WayPoint18X: double, Min=-10000000, Max=10000000  % 第18个路点x坐标
  WayPoint18Y: double, Min=-10000000, Max=10000000  % 第18个路点y坐标
  WayPoint18Curvature: double, Min=-0.0667, Max=0.0667  % 第18个路点曲率
  WayPoint19YawAngle: double, Min=-179.99, Max=180  % 第19个路点横摆角
  WayPoint19X: double, Min=-10000000, Max=10000000  % 第19个路点x坐标
  WayPoint19Y: double, Min=-10000000, Max=10000000  % 第19个路点y坐标
  WayPoint19Curvature: double, Min=-0.0667, Max=0.0667  % 第19个路点曲率
  WayPoint20YawAngle: double, Min=-179.99, Max=180  % 第20个路点横摆角
  WayPoint20X: double, Min=-10000000, Max=10000000  % 第20个路点x坐标
  WayPoint20Y: double, Min=-10000000, Max=10000000  % 第20个路点y坐标
  WayPoint20Curvature: double, Min=-0.0667, Max=0.0667  % 第20个路点曲率
  WayPoint21YawAngle: double, Min=-179.99, Max=180  % 第21个路点横摆角
  WayPoint21X: double, Min=-10000000, Max=10000000  % 第21个路点x坐标
  WayPoint21Y: double, Min=-10000000, Max=10000000  % 第21个路点y坐标
  WayPoint21Curvature: double, Min=-0.0667, Max=0.0667  % 第21个路点曲率
  WayPoint22YawAngle: double, Min=-179.99, Max=180  % 第22个路点横摆角
  WayPoint22X: double, Min=-10000000, Max=10000000  % 第22个路点x坐标
  WayPoint22Y: double, Min=-10000000, Max=10000000  % 第22个路点y坐标
  WayPoint22Curvature: double, Min=-0.0667, Max=0.0667  % 第22个路点曲率
  WayPoint23YawAngle: double, Min=-179.99, Max=180  % 第23个路点横摆角
  WayPoint23X: double, Min=-10000000, Max=10000000  % 第23个路点x坐标
  WayPoint23Y: double, Min=-10000000, Max=10000000  % 第23个路点y坐标
  WayPoint23Curvature: double, Min=-0.0667, Max=0.0667  % 第23个路点曲率
  WayPoint24YawAngle: double, Min=-179.99, Max=180  % 第24个路点横摆角
  WayPoint24X: double, Min=-10000000, Max=10000000  % 第24个路点x坐标
  WayPoint24Y: double, Min=-10000000, Max=10000000  % 第24个路点y坐标
  WayPoint24Curvature: double, Min=-0.0667, Max=0.0667  % 第24个路点曲率
  WayPoint25YawAngle: double, Min=-179.99, Max=180  % 第25个路点横摆角
  WayPoint25X: double, Min=-10000000, Max=10000000  % 第25个路点x坐标
  WayPoint25Y: double, Min=-10000000, Max=10000000  % 第25个路点y坐标
  WayPoint25Curvature: double, Min=-0.0667, Max=0.0667  % 第25个路点曲率
  WayPoint26YawAngle: double, Min=-179.99, Max=180  % 第26个路点横摆角
  WayPoint26X: double, Min=-10000000, Max=10000000  % 第26个路点x坐标
  WayPoint26Y: double, Min=-10000000, Max=10000000  % 第26个路点y坐标
  WayPoint26Curvature: double, Min=-0.0667, Max=0.0667  % 第26个路点曲率
  WayPoint27YawAngle: double, Min=-179.99, Max=180  % 第27个路点横摆角
  WayPoint27X: double, Min=-10000000, Max=10000000  % 第27个路点x坐标
  WayPoint27Y: double, Min=-10000000, Max=10000000  % 第27个路点y坐标
  WayPoint27Curvature: double, Min=-0.0667, Max=0.0667  % 第27个路点曲率
  WayPoint28YawAngle: double, Min=-179.99, Max=180  % 第28个路点横摆角
  WayPoint28X: double, Min=-10000000, Max=10000000  % 第28个路点x坐标
  WayPoint28Y: double, Min=-10000000, Max=10000000  % 第28个路点y坐标
  WayPoint28Curvature: double, Min=-0.0667, Max=0.0667  % 第28个路点曲率
  WayPoint29YawAngle: double, Min=-179.99, Max=180  % 第29个路点横摆角
  WayPoint29X: double, Min=-10000000, Max=10000000  % 第29个路点x坐标
  WayPoint29Y: double, Min=-10000000, Max=10000000  % 第29个路点y坐标
  WayPoint29Curvature: double, Min=-0.0667, Max=0.0667  % 第29个路点曲率
  WayPoint30YawAngle: double, Min=-179.99, Max=180  % 第30个路点横摆角
  WayPoint30X: double, Min=-10000000, Max=10000000  % 第30个路点x坐标
  WayPoint30Y: double, Min=-10000000, Max=10000000  % 第30个路点y坐标
  WayPoint30Curvature: double, Min=-0.0667, Max=0.0667  % 第30个路点曲率
  WayPoint31YawAngle: double, Min=-179.99, Max=180  % 第31个路点横摆角
  WayPoint31X: double, Min=-10000000, Max=10000000  % 第31个路点x坐标
  WayPoint31Y: double, Min=-10000000, Max=10000000  % 第31个路点y坐标
  WayPoint31Curvature: double, Min=-0.0667, Max=0.0667  % 第31个路点曲率
  WayPoint32YawAngle: double, Min=-179.99, Max=180  % 第32个路点横摆角
  WayPoint32X: double, Min=-10000000, Max=10000000  % 第32个路点x坐标
  WayPoint32Y: double, Min=-10000000, Max=10000000  % 第32个路点y坐标
  WayPoint32Curvature: double, Min=-0.0667, Max=0.0667  % 第32个路点曲率
  WayPoint33YawAngle: double, Min=-179.99, Max=180  % 第33个路点横摆角
  WayPoint33X: double, Min=-10000000, Max=10000000  % 第33个路点x坐标
  WayPoint33Y: double, Min=-10000000, Max=10000000  % 第33个路点y坐标
  WayPoint33Curvature: double, Min=-0.0667, Max=0.0667  % 第33个路点曲率
  WayPoint34YawAngle: double, Min=-179.99, Max=180  % 第34个路点横摆角
  WayPoint34X: double, Min=-10000000, Max=10000000  % 第34个路点x坐标
  WayPoint34Y: double, Min=-10000000, Max=10000000  % 第34个路点y坐标
  WayPoint34Curvature: double, Min=-0.0667, Max=0.0667  % 第34个路点曲率
  WayPoint35YawAngle: double, Min=-179.99, Max=180  % 第35个路点横摆角
  WayPoint35X: double, Min=-10000000, Max=10000000  % 第35个路点x坐标
  WayPoint35Y: double, Min=-10000000, Max=10000000  % 第35个路点y坐标
  WayPoint35Curvature: double, Min=-0.0667, Max=0.0667  % 第35个路点曲率
  WayPoint36YawAngle: double, Min=-179.99, Max=180  % 第36个路点横摆角
  WayPoint36X: double, Min=-10000000, Max=10000000  % 第36个路点x坐标
  WayPoint36Y: double, Min=-10000000, Max=10000000  % 第36个路点y坐标
  WayPoint36Curvature: double, Min=-0.0667, Max=0.0667  % 第36个路点曲率
  WayPoint37YawAngle: double, Min=-179.99, Max=180  % 第37个路点横摆角
  WayPoint37X: double, Min=-10000000, Max=10000000  % 第37个路点x坐标
  WayPoint37Y: double, Min=-10000000, Max=10000000  % 第37个路点y坐标
  WayPoint37Curvature: double, Min=-0.0667, Max=0.0667  % 第37个路点曲率
  WayPoint38YawAngle: double, Min=-179.99, Max=180  % 第38个路点横摆角
  WayPoint38X: double, Min=-10000000, Max=10000000  % 第38个路点x坐标
  WayPoint38Y: double, Min=-10000000, Max=10000000  % 第38个路点y坐标
  WayPoint38Curvature: double, Min=-0.0667, Max=0.0667  % 第38个路点曲率
  WayPoint39YawAngle: double, Min=-179.99, Max=180  % 第39个路点横摆角
  WayPoint39X: double, Min=-10000000, Max=10000000  % 第39个路点x坐标
  WayPoint39Y: double, Min=-10000000, Max=10000000  % 第39个路点y坐标
  WayPoint39Curvature: double, Min=-0.0667, Max=0.0667  % 第39个路点曲率
  WayPoint40YawAngle: double, Min=-179.99, Max=180  % 第40个路点横摆角
  WayPoint40X: double, Min=-10000000, Max=10000000  % 第40个路点x坐标
  WayPoint40Y: double, Min=-10000000, Max=10000000  % 第40个路点y坐标
  WayPoint40Curvature: double, Min=-0.0667, Max=0.0667  % 第40个路点曲率
  WayPoint41YawAngle: double, Min=-179.99, Max=180  % 第41个路点横摆角
  WayPoint41X: double, Min=-10000000, Max=10000000  % 第41个路点x坐标
  WayPoint41Y: double, Min=-10000000, Max=10000000  % 第41个路点y坐标
  WayPoint41Curvature: double, Min=-0.0667, Max=0.0667  % 第41个路点曲率
  WayPoint42YawAngle: double, Min=-179.99, Max=180  % 第42个路点横摆角
  WayPoint42X: double, Min=-10000000, Max=10000000  % 第42个路点x坐标
  WayPoint42Y: double, Min=-10000000, Max=10000000  % 第42个路点y坐标
  WayPoint42Curvature: double, Min=-0.0667, Max=0.0667  % 第42个路点曲率
  WayPoint43YawAngle: double, Min=-179.99, Max=180  % 第43个路点横摆角
  WayPoint43X: double, Min=-10000000, Max=10000000  % 第43个路点x坐标
  WayPoint43Y: double, Min=-10000000, Max=10000000  % 第43个路点y坐标
  WayPoint43Curvature: double, Min=-0.0667, Max=0.0667  % 第43个路点曲率
  WayPoint44YawAngle: double, Min=-179.99, Max=180  % 第44个路点横摆角
  WayPoint44X: double, Min=-10000000, Max=10000000  % 第44个路点x坐标
  WayPoint44Y: double, Min=-10000000, Max=10000000  % 第44个路点y坐标
  WayPoint44Curvature: double, Min=-0.0667, Max=0.0667  % 第44个路点曲率
  WayPoint45YawAngle: double, Min=-179.99, Max=180  % 第45个路点横摆角
  WayPoint45X: double, Min=-10000000, Max=10000000  % 第45个路点x坐标
  WayPoint45Y: double, Min=-10000000, Max=10000000  % 第45个路点y坐标
  WayPoint45Curvature: double, Min=-0.0667, Max=0.0667  % 第45个路点曲率
  WayPoint46YawAngle: double, Min=-179.99, Max=180  % 第46个路点横摆角
  WayPoint46X: double, Min=-10000000, Max=10000000  % 第46个路点x坐标
  WayPoint46Y: double, Min=-10000000, Max=10000000  % 第46个路点y坐标
  WayPoint46Curvature: double, Min=-0.0667, Max=0.0667  % 第46个路点曲率
  WayPoint47YawAngle: double, Min=-179.99, Max=180  % 第47个路点横摆角
  WayPoint47X: double, Min=-10000000, Max=10000000  % 第47个路点x坐标
  WayPoint47Y: double, Min=-10000000, Max=10000000  % 第47个路点y坐标
  WayPoint47Curvature: double, Min=-0.0667, Max=0.0667  % 第47个路点曲率
  WayPoint48YawAngle: double, Min=-179.99, Max=180  % 第48个路点横摆角
  WayPoint48X: double, Min=-10000000, Max=10000000  % 第48个路点x坐标
  WayPoint48Y: double, Min=-10000000, Max=10000000  % 第48个路点y坐标
  WayPoint48Curvature: double, Min=-0.0667, Max=0.0667  % 第48个路点曲率
  WayPoint49YawAngle: double, Min=-179.99, Max=180  % 第49个路点横摆角
  WayPoint49X: double, Min=-10000000, Max=10000000  % 第49个路点x坐标
  WayPoint49Y: double, Min=-10000000, Max=10000000  % 第49个路点y坐标
  WayPoint49Curvature: double, Min=-0.0667, Max=0.0667  % 第49个路点曲率
  WayPoint50YawAngle: double, Min=-179.99, Max=180  % 第50个路点横摆角
  WayPoint50X: double, Min=-10000000, Max=10000000  % 第50个路点x坐标
  WayPoint50Y: double, Min=-10000000, Max=10000000  % 第50个路点y坐标
  WayPoint50Curvature: double, Min=-0.0667, Max=0.0667  % 第50个路点曲率
  WayPoint51YawAngle: double, Min=-179.99, Max=180  % 第51个路点横摆角
  WayPoint51X: double, Min=-10000000, Max=10000000  % 第51个路点x坐标
  WayPoint51Y: double, Min=-10000000, Max=10000000  % 第51个路点y坐标
  WayPoint51Curvature: double, Min=-0.0667, Max=0.0667  % 第51个路点曲率
  WayPoint52YawAngle: double, Min=-179.99, Max=180  % 第52个路点横摆角
  WayPoint52X: double, Min=-10000000, Max=10000000  % 第52个路点x坐标
  WayPoint52Y: double, Min=-10000000, Max=10000000  % 第52个路点y坐标
  WayPoint52Curvature: double, Min=-0.0667, Max=0.0667  % 第52个路点曲率
  WayPoint53YawAngle: double, Min=-179.99, Max=180  % 第53个路点横摆角
  WayPoint53X: double, Min=-10000000, Max=10000000  % 第53个路点x坐标
  WayPoint53Y: double, Min=-10000000, Max=10000000  % 第53个路点y坐标
  WayPoint53Curvature: double, Min=-0.0667, Max=0.0667  % 第53个路点曲率
  WayPoint54YawAngle: double, Min=-179.99, Max=180  % 第54个路点横摆角
  WayPoint54X: double, Min=-10000000, Max=10000000  % 第54个路点x坐标
  WayPoint54Y: double, Min=-10000000, Max=10000000  % 第54个路点y坐标
  WayPoint54Curvature: double, Min=-0.0667, Max=0.0667  % 第54个路点曲率
  WayPoint55YawAngle: double, Min=-179.99, Max=180  % 第55个路点横摆角
  WayPoint55X: double, Min=-10000000, Max=10000000  % 第55个路点x坐标
  WayPoint55Y: double, Min=-10000000, Max=10000000  % 第55个路点y坐标
  WayPoint55Curvature: double, Min=-0.0667, Max=0.0667  % 第55个路点曲率
  WayPoint56YawAngle: double, Min=-179.99, Max=180  % 第56个路点横摆角
  WayPoint56X: double, Min=-10000000, Max=10000000  % 第56个路点x坐标
  WayPoint56Y: double, Min=-10000000, Max=10000000  % 第56个路点y坐标
  WayPoint56Curvature: double, Min=-0.0667, Max=0.0667  % 第56个路点曲率
  WayPoint57YawAngle: double, Min=-179.99, Max=180  % 第57个路点横摆角
  WayPoint57X: double, Min=-10000000, Max=10000000  % 第57个路点x坐标
  WayPoint57Y: double, Min=-10000000, Max=10000000  % 第57个路点y坐标
  WayPoint57Curvature: double, Min=-0.0667, Max=0.0667  % 第57个路点曲率
  WayPoint58YawAngle: double, Min=-179.99, Max=180  % 第58个路点横摆角
  WayPoint58X: double, Min=-10000000, Max=10000000  % 第58个路点x坐标
  WayPoint58Y: double, Min=-10000000, Max=10000000  % 第58个路点y坐标
  WayPoint58Curvature: double, Min=-0.0667, Max=0.0667  % 第58个路点曲率
  WayPoint59YawAngle: double, Min=-179.99, Max=180  % 第59个路点横摆角
  WayPoint59X: double, Min=-10000000, Max=10000000  % 第59个路点x坐标
  WayPoint59Y: double, Min=-10000000, Max=10000000  % 第59个路点y坐标
  WayPoint59Curvature: double, Min=-0.0667, Max=0.0667  % 第59个路点曲率
  WayPoint60YawAngle: double, Min=-179.99, Max=180  % 第60个路点横摆角
  WayPoint60X: double, Min=-10000000, Max=10000000  % 第60个路点x坐标
  WayPoint60Y: double, Min=-10000000, Max=10000000  % 第60个路点y坐标
  WayPoint60Curvature: double, Min=-0.0667, Max=0.0667  % 第60个路点曲率
  ENUYawAngle: double, Min=-179.99, Max=180  % 当前时刻列车在东北天坐标系下的横摆角
  ENUX: double, Min=-10000000, Max=10000000  % 当前时刻列车在东北天坐标系下的x坐标
  ENUY: double, Min=-10000000, Max=10000000  % 当前时刻列车在东北天坐标系下的y坐标
  WayPoint1SegmentIndex: double, Min=1, Max=120  % 第1个路点隶属区间代号
  WayPoint2SegmentIndex: double, Min=1, Max=120  % 第2个路点隶属区间代号
  WayPoint3SegmentIndex: double, Min=1, Max=120  % 第3个路点隶属区间代号
  WayPoint4SegmentIndex: double, Min=1, Max=120  % 第4个路点隶属区间代号
  WayPoint5SegmentIndex: double, Min=1, Max=120  % 第5个路点隶属区间代号
  WayPoint6SegmentIndex: double, Min=1, Max=120  % 第6个路点隶属区间代号
  WayPoint7SegmentIndex: double, Min=1, Max=120  % 第7个路点隶属区间代号
  WayPoint8SegmentIndex: double, Min=1, Max=120  % 第8个路点隶属区间代号
  WayPoint9SegmentIndex: double, Min=1, Max=120  % 第9个路点隶属区间代号
  WayPoint10SegmentIndex: double, Min=1, Max=120  % 第10个路点隶属区间代号
  WayPoint11SegmentIndex: double, Min=1, Max=120  % 第11个路点隶属区间代号
  WayPoint12SegmentIndex: double, Min=1, Max=120  % 第12个路点隶属区间代号
  WayPoint13SegmentIndex: double, Min=1, Max=120  % 第13个路点隶属区间代号
  WayPoint14SegmentIndex: double, Min=1, Max=120  % 第14个路点隶属区间代号
  WayPoint15SegmentIndex: double, Min=1, Max=120  % 第15个路点隶属区间代号
  WayPoint16SegmentIndex: double, Min=1, Max=120  % 第16个路点隶属区间代号
  WayPoint17SegmentIndex: double, Min=1, Max=120  % 第17个路点隶属区间代号
  WayPoint18SegmentIndex: double, Min=1, Max=120  % 第18个路点隶属区间代号
  WayPoint19SegmentIndex: double, Min=1, Max=120  % 第19个路点隶属区间代号
  WayPoint20SegmentIndex: double, Min=1, Max=120  % 第20个路点隶属区间代号
  WayPoint21SegmentIndex: double, Min=1, Max=120  % 第21个路点隶属区间代号
  WayPoint22SegmentIndex: double, Min=1, Max=120  % 第22个路点隶属区间代号
  WayPoint23SegmentIndex: double, Min=1, Max=120  % 第23个路点隶属区间代号
  WayPoint24SegmentIndex: double, Min=1, Max=120  % 第24个路点隶属区间代号
  WayPoint25SegmentIndex: double, Min=1, Max=120  % 第25个路点隶属区间代号
  WayPoint26SegmentIndex: double, Min=1, Max=120  % 第26个路点隶属区间代号
  WayPoint27SegmentIndex: double, Min=1, Max=120  % 第27个路点隶属区间代号
  WayPoint28SegmentIndex: double, Min=1, Max=120  % 第28个路点隶属区间代号
  WayPoint29SegmentIndex: double, Min=1, Max=120  % 第29个路点隶属区间代号
  WayPoint30SegmentIndex: double, Min=1, Max=120  % 第30个路点隶属区间代号
  WayPoint31SegmentIndex: double, Min=1, Max=120  % 第31个路点隶属区间代号
  WayPoint32SegmentIndex: double, Min=1, Max=120  % 第32个路点隶属区间代号
  WayPoint33SegmentIndex: double, Min=1, Max=120  % 第33个路点隶属区间代号
  WayPoint34SegmentIndex: double, Min=1, Max=120  % 第34个路点隶属区间代号
  WayPoint35SegmentIndex: double, Min=1, Max=120  % 第35个路点隶属区间代号
  WayPoint36SegmentIndex: double, Min=1, Max=120  % 第36个路点隶属区间代号
  WayPoint37SegmentIndex: double, Min=1, Max=120  % 第37个路点隶属区间代号
  WayPoint38SegmentIndex: double, Min=1, Max=120  % 第38个路点隶属区间代号
  WayPoint39SegmentIndex: double, Min=1, Max=120  % 第39个路点隶属区间代号
  WayPoint40SegmentIndex: double, Min=1, Max=120  % 第40个路点隶属区间代号
  WayPoint41SegmentIndex: double, Min=1, Max=120  % 第41个路点隶属区间代号
  WayPoint42SegmentIndex: double, Min=1, Max=120  % 第42个路点隶属区间代号
  WayPoint43SegmentIndex: double, Min=1, Max=120  % 第43个路点隶属区间代号
  WayPoint44SegmentIndex: double, Min=1, Max=120  % 第44个路点隶属区间代号
  WayPoint45SegmentIndex: double, Min=1, Max=120  % 第45个路点隶属区间代号
  WayPoint46SegmentIndex: double, Min=1, Max=120  % 第46个路点隶属区间代号
  WayPoint47SegmentIndex: double, Min=1, Max=120  % 第47个路点隶属区间代号
  WayPoint48SegmentIndex: double, Min=1, Max=120  % 第48个路点隶属区间代号
  WayPoint49SegmentIndex: double, Min=1, Max=120  % 第49个路点隶属区间代号
  WayPoint50SegmentIndex: double, Min=1, Max=120  % 第50个路点隶属区间代号
  WayPoint51SegmentIndex: double, Min=1, Max=120  % 第51个路点隶属区间代号
  WayPoint52SegmentIndex: double, Min=1, Max=120  % 第52个路点隶属区间代号
  WayPoint53SegmentIndex: double, Min=1, Max=120  % 第53个路点隶属区间代号
  WayPoint54SegmentIndex: double, Min=1, Max=120  % 第54个路点隶属区间代号
  WayPoint55SegmentIndex: double, Min=1, Max=120  % 第55个路点隶属区间代号
  WayPoint56SegmentIndex: double, Min=1, Max=120  % 第56个路点隶属区间代号
  WayPoint57SegmentIndex: double, Min=1, Max=120  % 第57个路点隶属区间代号
  WayPoint58SegmentIndex: double, Min=1, Max=120  % 第58个路点隶属区间代号
  WayPoint59SegmentIndex: double, Min=1, Max=120  % 第59个路点隶属区间代号
  WayPoint60SegmentIndex: double, Min=1, Max=120  % 第60个路点隶属区间代号
  TrajectoryUpdateEnable: double, Min=0, Max=1  % 轨迹更新使能状态
  NearLateralOffsetOriginal: double, Min=-10000000, Max=10000000  % 在线规划之前的原始近处横向偏差

MC2_MMU2IDS_SEGMENT = Simulink.Bus()  % MC2_MMU2IDS_SEGMENT
  Segment1VisioinPriority: double, Min=0, Max=2  % 第1个区间的视觉循迹优先级
  Segment1GNSSPriority: double, Min=0, Max=2  % 第1个区间的GNSS循迹优先级
  Segment2VisioinPriority: double, Min=0, Max=2  % 第2个区间的视觉循迹优先级
  Segment2GNSSPriority: double, Min=0, Max=2  % 第2个区间的GNSS循迹优先级
  Segment3VisioinPriority: double, Min=0, Max=2  % 第3个区间的视觉循迹优先级
  Segment3GNSSPriority: double, Min=0, Max=2  % 第3个区间的GNSS循迹优先级
  Segment4VisioinPriority: double, Min=0, Max=2  % 第4个区间的视觉循迹优先级
  Segment4GNSSPriority: double, Min=0, Max=2  % 第4个区间的GNSS循迹优先级
  Segment5VisioinPriority: double, Min=0, Max=2  % 第5个区间的视觉循迹优先级
  Segment5GNSSPriority: double, Min=0, Max=2  % 第5个区间的GNSS循迹优先级
  Segment6VisioinPriority: double, Min=0, Max=2  % 第6个区间的视觉循迹优先级
  Segment6GNSSPriority: double, Min=0, Max=2  % 第6个区间的GNSS循迹优先级
  Segment7VisioinPriority: double, Min=0, Max=2  % 第7个区间的视觉循迹优先级
  Segment7GNSSPriority: double, Min=0, Max=2  % 第7个区间的GNSS循迹优先级
  Segment8VisioinPriority: double, Min=0, Max=2  % 第8个区间的视觉循迹优先级
  Segment8GNSSPriority: double, Min=0, Max=2  % 第8个区间的GNSS循迹优先级
  Segment9VisioinPriority: double, Min=0, Max=2  % 第9个区间的视觉循迹优先级
  Segment9GNSSPriority: double, Min=0, Max=2  % 第9个区间的GNSS循迹优先级
  Segment10VisioinPriority: double, Min=0, Max=2  % 第10个区间的视觉循迹优先级
  Segment10GNSSPriority: double, Min=0, Max=2  % 第10个区间的GNSS循迹优先级
  Segment11VisioinPriority: double, Min=0, Max=2  % 第11个区间的视觉循迹优先级
  Segment11GNSSPriority: double, Min=0, Max=2  % 第11个区间的GNSS循迹优先级
  Segment12VisioinPriority: double, Min=0, Max=2  % 第12个区间的视觉循迹优先级
  Segment12GNSSPriority: double, Min=0, Max=2  % 第12个区间的GNSS循迹优先级
  Segment13VisioinPriority: double, Min=0, Max=2  % 第13个区间的视觉循迹优先级
  Segment13GNSSPriority: double, Min=0, Max=2  % 第13个区间的GNSS循迹优先级
  Segment14VisioinPriority: double, Min=0, Max=2  % 第14个区间的视觉循迹优先级
  Segment14GNSSPriority: double, Min=0, Max=2  % 第14个区间的GNSS循迹优先级
  Segment15VisioinPriority: double, Min=0, Max=2  % 第15个区间的视觉循迹优先级
  Segment15GNSSPriority: double, Min=0, Max=2  % 第15个区间的GNSS循迹优先级
  Segment16VisioinPriority: double, Min=0, Max=2  % 第16个区间的视觉循迹优先级
  Segment16GNSSPriority: double, Min=0, Max=2  % 第16个区间的GNSS循迹优先级
  Segment17VisioinPriority: double, Min=0, Max=2  % 第17个区间的视觉循迹优先级
  Segment17GNSSPriority: double, Min=0, Max=2  % 第17个区间的GNSS循迹优先级
  Segment18VisioinPriority: double, Min=0, Max=2  % 第18个区间的视觉循迹优先级
  Segment18GNSSPriority: double, Min=0, Max=2  % 第18个区间的GNSS循迹优先级
  Segment19VisioinPriority: double, Min=0, Max=2  % 第19个区间的视觉循迹优先级
  Segment19GNSSPriority: double, Min=0, Max=2  % 第19个区间的GNSS循迹优先级
  Segment20VisioinPriority: double, Min=0, Max=2  % 第20个区间的视觉循迹优先级
  Segment20GNSSPriority: double, Min=0, Max=2  % 第20个区间的GNSS循迹优先级
  Segment21VisioinPriority: double, Min=0, Max=2  % 第21个区间的视觉循迹优先级
  Segment21GNSSPriority: double, Min=0, Max=2  % 第21个区间的GNSS循迹优先级
  Segment22VisioinPriority: double, Min=0, Max=2  % 第22个区间的视觉循迹优先级
  Segment22GNSSPriority: double, Min=0, Max=2  % 第22个区间的GNSS循迹优先级
  Segment23VisioinPriority: double, Min=0, Max=2  % 第23个区间的视觉循迹优先级
  Segment23GNSSPriority: double, Min=0, Max=2  % 第23个区间的GNSS循迹优先级
  Segment24VisioinPriority: double, Min=0, Max=2  % 第24个区间的视觉循迹优先级
  Segment24GNSSPriority: double, Min=0, Max=2  % 第24个区间的GNSS循迹优先级
  Segment25VisioinPriority: double, Min=0, Max=2  % 第25个区间的视觉循迹优先级
  Segment25GNSSPriority: double, Min=0, Max=2  % 第25个区间的GNSS循迹优先级
  Segment26VisioinPriority: double, Min=0, Max=2  % 第26个区间的视觉循迹优先级
  Segment26GNSSPriority: double, Min=0, Max=2  % 第26个区间的GNSS循迹优先级
  Segment27VisioinPriority: double, Min=0, Max=2  % 第27个区间的视觉循迹优先级
  Segment27GNSSPriority: double, Min=0, Max=2  % 第27个区间的GNSS循迹优先级
  Segment28VisioinPriority: double, Min=0, Max=2  % 第28个区间的视觉循迹优先级
  Segment28GNSSPriority: double, Min=0, Max=2  % 第28个区间的GNSS循迹优先级
  Segment29VisioinPriority: double, Min=0, Max=2  % 第29个区间的视觉循迹优先级
  Segment29GNSSPriority: double, Min=0, Max=2  % 第29个区间的GNSS循迹优先级
  Segment30VisioinPriority: double, Min=0, Max=2  % 第30个区间的视觉循迹优先级
  Segment30GNSSPriority: double, Min=0, Max=2  % 第30个区间的GNSS循迹优先级
  Segment31VisioinPriority: double, Min=0, Max=2  % 第31个区间的视觉循迹优先级
  Segment31GNSSPriority: double, Min=0, Max=2  % 第31个区间的GNSS循迹优先级
  Segment32VisioinPriority: double, Min=0, Max=2  % 第32个区间的视觉循迹优先级
  Segment32GNSSPriority: double, Min=0, Max=2  % 第32个区间的GNSS循迹优先级
  Segment33VisioinPriority: double, Min=0, Max=2  % 第33个区间的视觉循迹优先级
  Segment33GNSSPriority: double, Min=0, Max=2  % 第33个区间的GNSS循迹优先级
  Segment34VisioinPriority: double, Min=0, Max=2  % 第34个区间的视觉循迹优先级
  Segment34GNSSPriority: double, Min=0, Max=2  % 第34个区间的GNSS循迹优先级
  Segment35VisioinPriority: double, Min=0, Max=2  % 第35个区间的视觉循迹优先级
  Segment35GNSSPriority: double, Min=0, Max=2  % 第35个区间的GNSS循迹优先级
  Segment36VisioinPriority: double, Min=0, Max=2  % 第36个区间的视觉循迹优先级
  Segment36GNSSPriority: double, Min=0, Max=2  % 第36个区间的GNSS循迹优先级
  Segment37VisioinPriority: double, Min=0, Max=2  % 第37个区间的视觉循迹优先级
  Segment37GNSSPriority: double, Min=0, Max=2  % 第37个区间的GNSS循迹优先级
  Segment38VisioinPriority: double, Min=0, Max=2  % 第38个区间的视觉循迹优先级
  Segment38GNSSPriority: double, Min=0, Max=2  % 第38个区间的GNSS循迹优先级
  Segment39VisioinPriority: double, Min=0, Max=2  % 第39个区间的视觉循迹优先级
  Segment39GNSSPriority: double, Min=0, Max=2  % 第39个区间的GNSS循迹优先级
  Segment40VisioinPriority: double, Min=0, Max=2  % 第40个区间的视觉循迹优先级
  Segment40GNSSPriority: double, Min=0, Max=2  % 第40个区间的GNSS循迹优先级
  Segment41VisioinPriority: double, Min=0, Max=2  % 第41个区间的视觉循迹优先级
  Segment41GNSSPriority: double, Min=0, Max=2  % 第41个区间的GNSS循迹优先级
  Segment42VisioinPriority: double, Min=0, Max=2  % 第42个区间的视觉循迹优先级
  Segment42GNSSPriority: double, Min=0, Max=2  % 第42个区间的GNSS循迹优先级
  Segment43VisioinPriority: double, Min=0, Max=2  % 第43个区间的视觉循迹优先级
  Segment43GNSSPriority: double, Min=0, Max=2  % 第43个区间的GNSS循迹优先级
  Segment44VisioinPriority: double, Min=0, Max=2  % 第44个区间的视觉循迹优先级
  Segment44GNSSPriority: double, Min=0, Max=2  % 第44个区间的GNSS循迹优先级
  Segment45VisioinPriority: double, Min=0, Max=2  % 第45个区间的视觉循迹优先级
  Segment45GNSSPriority: double, Min=0, Max=2  % 第45个区间的GNSS循迹优先级
  Segment46VisioinPriority: double, Min=0, Max=2  % 第46个区间的视觉循迹优先级
  Segment46GNSSPriority: double, Min=0, Max=2  % 第46个区间的GNSS循迹优先级
  Segment47VisioinPriority: double, Min=0, Max=2  % 第47个区间的视觉循迹优先级
  Segment47GNSSPriority: double, Min=0, Max=2  % 第47个区间的GNSS循迹优先级
  Segment48VisioinPriority: double, Min=0, Max=2  % 第48个区间的视觉循迹优先级
  Segment48GNSSPriority: double, Min=0, Max=2  % 第48个区间的GNSS循迹优先级
  Segment49VisioinPriority: double, Min=0, Max=2  % 第49个区间的视觉循迹优先级
  Segment49GNSSPriority: double, Min=0, Max=2  % 第49个区间的GNSS循迹优先级
  Segment50VisioinPriority: double, Min=0, Max=2  % 第50个区间的视觉循迹优先级
  Segment50GNSSPriority: double, Min=0, Max=2  % 第50个区间的GNSS循迹优先级
  Segment51VisioinPriority: double, Min=0, Max=2  % 第51个区间的视觉循迹优先级
  Segment51GNSSPriority: double, Min=0, Max=2  % 第51个区间的GNSS循迹优先级
  Segment52VisioinPriority: double, Min=0, Max=2  % 第52个区间的视觉循迹优先级
  Segment52GNSSPriority: double, Min=0, Max=2  % 第52个区间的GNSS循迹优先级
  Segment53VisioinPriority: double, Min=0, Max=2  % 第53个区间的视觉循迹优先级
  Segment53GNSSPriority: double, Min=0, Max=2  % 第53个区间的GNSS循迹优先级
  Segment54VisioinPriority: double, Min=0, Max=2  % 第54个区间的视觉循迹优先级
  Segment54GNSSPriority: double, Min=0, Max=2  % 第54个区间的GNSS循迹优先级
  Segment55VisioinPriority: double, Min=0, Max=2  % 第55个区间的视觉循迹优先级
  Segment55GNSSPriority: double, Min=0, Max=2  % 第55个区间的GNSS循迹优先级
  Segment56VisioinPriority: double, Min=0, Max=2  % 第56个区间的视觉循迹优先级
  Segment56GNSSPriority: double, Min=0, Max=2  % 第56个区间的GNSS循迹优先级
  Segment57VisioinPriority: double, Min=0, Max=2  % 第57个区间的视觉循迹优先级
  Segment57GNSSPriority: double, Min=0, Max=2  % 第57个区间的GNSS循迹优先级
  Segment58VisioinPriority: double, Min=0, Max=2  % 第58个区间的视觉循迹优先级
  Segment58GNSSPriority: double, Min=0, Max=2  % 第58个区间的GNSS循迹优先级
  Segment59VisioinPriority: double, Min=0, Max=2  % 第59个区间的视觉循迹优先级
  Segment59GNSSPriority: double, Min=0, Max=2  % 第59个区间的GNSS循迹优先级
  Segment60VisioinPriority: double, Min=0, Max=2  % 第60个区间的视觉循迹优先级
  Segment60GNSSPriority: double, Min=0, Max=2  % 第60个区间的GNSS循迹优先级
  Segment61VisioinPriority: double, Min=0, Max=2  % 第61个区间的视觉循迹优先级
  Segment61GNSSPriority: double, Min=0, Max=2  % 第61个区间的GNSS循迹优先级
  Segment62VisioinPriority: double, Min=0, Max=2  % 第62个区间的视觉循迹优先级
  Segment62GNSSPriority: double, Min=0, Max=2  % 第62个区间的GNSS循迹优先级
  Segment63VisioinPriority: double, Min=0, Max=2  % 第63个区间的视觉循迹优先级
  Segment63GNSSPriority: double, Min=0, Max=2  % 第63个区间的GNSS循迹优先级
  Segment64VisioinPriority: double, Min=0, Max=2  % 第64个区间的视觉循迹优先级
  Segment64GNSSPriority: double, Min=0, Max=2  % 第64个区间的GNSS循迹优先级
  Segment65VisioinPriority: double, Min=0, Max=2  % 第65个区间的视觉循迹优先级
  Segment65GNSSPriority: double, Min=0, Max=2  % 第65个区间的GNSS循迹优先级
  Segment66VisioinPriority: double, Min=0, Max=2  % 第66个区间的视觉循迹优先级
  Segment66GNSSPriority: double, Min=0, Max=2  % 第66个区间的GNSS循迹优先级
  Segment67VisioinPriority: double, Min=0, Max=2  % 第67个区间的视觉循迹优先级
  Segment67GNSSPriority: double, Min=0, Max=2  % 第67个区间的GNSS循迹优先级
  Segment68VisioinPriority: double, Min=0, Max=2  % 第68个区间的视觉循迹优先级
  Segment68GNSSPriority: double, Min=0, Max=2  % 第68个区间的GNSS循迹优先级
  Segment69VisioinPriority: double, Min=0, Max=2  % 第69个区间的视觉循迹优先级
  Segment69GNSSPriority: double, Min=0, Max=2  % 第69个区间的GNSS循迹优先级
  Segment70VisioinPriority: double, Min=0, Max=2  % 第70个区间的视觉循迹优先级
  Segment70GNSSPriority: double, Min=0, Max=2  % 第70个区间的GNSS循迹优先级
  Segment71VisioinPriority: double, Min=0, Max=2  % 第71个区间的视觉循迹优先级
  Segment71GNSSPriority: double, Min=0, Max=2  % 第71个区间的GNSS循迹优先级
  Segment72VisioinPriority: double, Min=0, Max=2  % 第72个区间的视觉循迹优先级
  Segment72GNSSPriority: double, Min=0, Max=2  % 第72个区间的GNSS循迹优先级
  Segment73VisioinPriority: double, Min=0, Max=2  % 第73个区间的视觉循迹优先级
  Segment73GNSSPriority: double, Min=0, Max=2  % 第73个区间的GNSS循迹优先级
  Segment74VisioinPriority: double, Min=0, Max=2  % 第74个区间的视觉循迹优先级
  Segment74GNSSPriority: double, Min=0, Max=2  % 第74个区间的GNSS循迹优先级
  Segment75VisioinPriority: double, Min=0, Max=2  % 第75个区间的视觉循迹优先级
  Segment75GNSSPriority: double, Min=0, Max=2  % 第75个区间的GNSS循迹优先级
  Segment76VisioinPriority: double, Min=0, Max=2  % 第76个区间的视觉循迹优先级
  Segment76GNSSPriority: double, Min=0, Max=2  % 第76个区间的GNSS循迹优先级
  Segment77VisioinPriority: double, Min=0, Max=2  % 第77个区间的视觉循迹优先级
  Segment77GNSSPriority: double, Min=0, Max=2  % 第77个区间的GNSS循迹优先级
  Segment78VisioinPriority: double, Min=0, Max=2  % 第78个区间的视觉循迹优先级
  Segment78GNSSPriority: double, Min=0, Max=2  % 第78个区间的GNSS循迹优先级
  Segment79VisioinPriority: double, Min=0, Max=2  % 第79个区间的视觉循迹优先级
  Segment79GNSSPriority: double, Min=0, Max=2  % 第79个区间的GNSS循迹优先级
  Segment80VisioinPriority: double, Min=0, Max=2  % 第80个区间的视觉循迹优先级
  Segment80GNSSPriority: double, Min=0, Max=2  % 第80个区间的GNSS循迹优先级
  Segment81VisioinPriority: double, Min=0, Max=2  % 第81个区间的视觉循迹优先级
  Segment81GNSSPriority: double, Min=0, Max=2  % 第81个区间的GNSS循迹优先级
  Segment82VisioinPriority: double, Min=0, Max=2  % 第82个区间的视觉循迹优先级
  Segment82GNSSPriority: double, Min=0, Max=2  % 第82个区间的GNSS循迹优先级
  Segment83VisioinPriority: double, Min=0, Max=2  % 第83个区间的视觉循迹优先级
  Segment83GNSSPriority: double, Min=0, Max=2  % 第83个区间的GNSS循迹优先级
  Segment84VisioinPriority: double, Min=0, Max=2  % 第84个区间的视觉循迹优先级
  Segment84GNSSPriority: double, Min=0, Max=2  % 第84个区间的GNSS循迹优先级
  Segment85VisioinPriority: double, Min=0, Max=2  % 第85个区间的视觉循迹优先级
  Segment85GNSSPriority: double, Min=0, Max=2  % 第85个区间的GNSS循迹优先级
  Segment86VisioinPriority: double, Min=0, Max=2  % 第86个区间的视觉循迹优先级
  Segment86GNSSPriority: double, Min=0, Max=2  % 第86个区间的GNSS循迹优先级
  Segment87VisioinPriority: double, Min=0, Max=2  % 第87个区间的视觉循迹优先级
  Segment87GNSSPriority: double, Min=0, Max=2  % 第87个区间的GNSS循迹优先级
  Segment88VisioinPriority: double, Min=0, Max=2  % 第88个区间的视觉循迹优先级
  Segment88GNSSPriority: double, Min=0, Max=2  % 第88个区间的GNSS循迹优先级
  Segment89VisioinPriority: double, Min=0, Max=2  % 第89个区间的视觉循迹优先级
  Segment89GNSSPriority: double, Min=0, Max=2  % 第89个区间的GNSS循迹优先级
  Segment90VisioinPriority: double, Min=0, Max=2  % 第90个区间的视觉循迹优先级
  Segment90GNSSPriority: double, Min=0, Max=2  % 第90个区间的GNSS循迹优先级
  Segment91VisioinPriority: double, Min=0, Max=2  % 第91个区间的视觉循迹优先级
  Segment91GNSSPriority: double, Min=0, Max=2  % 第91个区间的GNSS循迹优先级
  Segment92VisioinPriority: double, Min=0, Max=2  % 第92个区间的视觉循迹优先级
  Segment92GNSSPriority: double, Min=0, Max=2  % 第92个区间的GNSS循迹优先级
  Segment93VisioinPriority: double, Min=0, Max=2  % 第93个区间的视觉循迹优先级
  Segment93GNSSPriority: double, Min=0, Max=2  % 第93个区间的GNSS循迹优先级
  Segment94VisioinPriority: double, Min=0, Max=2  % 第94个区间的视觉循迹优先级
  Segment94GNSSPriority: double, Min=0, Max=2  % 第94个区间的GNSS循迹优先级
  Segment95VisioinPriority: double, Min=0, Max=2  % 第95个区间的视觉循迹优先级
  Segment95GNSSPriority: double, Min=0, Max=2  % 第95个区间的GNSS循迹优先级
  Segment96VisioinPriority: double, Min=0, Max=2  % 第96个区间的视觉循迹优先级
  Segment96GNSSPriority: double, Min=0, Max=2  % 第96个区间的GNSS循迹优先级
  Segment97VisioinPriority: double, Min=0, Max=2  % 第97个区间的视觉循迹优先级
  Segment97GNSSPriority: double, Min=0, Max=2  % 第97个区间的GNSS循迹优先级
  Segment98VisioinPriority: double, Min=0, Max=2  % 第98个区间的视觉循迹优先级
  Segment98GNSSPriority: double, Min=0, Max=2  % 第98个区间的GNSS循迹优先级
  Segment99VisioinPriority: double, Min=0, Max=2  % 第99个区间的视觉循迹优先级
  Segment99GNSSPriority: double, Min=0, Max=2  % 第99个区间的GNSS循迹优先级
  Segment100VisioinPriority: double, Min=0, Max=2  % 第100个区间的视觉循迹优先级
  Segment100GNSSPriority: double, Min=0, Max=2  % 第100个区间的GNSS循迹优先级
  Segment101VisioinPriority: double, Min=0, Max=2  % 第101个区间的视觉循迹优先级
  Segment101GNSSPriority: double, Min=0, Max=2  % 第101个区间的GNSS循迹优先级
  Segment102VisioinPriority: double, Min=0, Max=2  % 第102个区间的视觉循迹优先级
  Segment102GNSSPriority: double, Min=0, Max=2  % 第102个区间的GNSS循迹优先级
  Segment103VisioinPriority: double, Min=0, Max=2  % 第103个区间的视觉循迹优先级
  Segment103GNSSPriority: double, Min=0, Max=2  % 第103个区间的GNSS循迹优先级
  Segment104VisioinPriority: double, Min=0, Max=2  % 第104个区间的视觉循迹优先级
  Segment104GNSSPriority: double, Min=0, Max=2  % 第104个区间的GNSS循迹优先级
  Segment105VisioinPriority: double, Min=0, Max=2  % 第105个区间的视觉循迹优先级
  Segment105GNSSPriority: double, Min=0, Max=2  % 第105个区间的GNSS循迹优先级
  Segment106VisioinPriority: double, Min=0, Max=2  % 第106个区间的视觉循迹优先级
  Segment106GNSSPriority: double, Min=0, Max=2  % 第106个区间的GNSS循迹优先级
  Segment107VisioinPriority: double, Min=0, Max=2  % 第107个区间的视觉循迹优先级
  Segment107GNSSPriority: double, Min=0, Max=2  % 第107个区间的GNSS循迹优先级
  Segment108VisioinPriority: double, Min=0, Max=2  % 第108个区间的视觉循迹优先级
  Segment108GNSSPriority: double, Min=0, Max=2  % 第108个区间的GNSS循迹优先级
  Segment109VisioinPriority: double, Min=0, Max=2  % 第109个区间的视觉循迹优先级
  Segment109GNSSPriority: double, Min=0, Max=2  % 第109个区间的GNSS循迹优先级
  Segment110VisioinPriority: double, Min=0, Max=2  % 第110个区间的视觉循迹优先级
  Segment110GNSSPriority: double, Min=0, Max=2  % 第110个区间的GNSS循迹优先级
  Segment111VisioinPriority: double, Min=0, Max=2  % 第111个区间的视觉循迹优先级
  Segment111GNSSPriority: double, Min=0, Max=2  % 第111个区间的GNSS循迹优先级
  Segment112VisioinPriority: double, Min=0, Max=2  % 第112个区间的视觉循迹优先级
  Segment112GNSSPriority: double, Min=0, Max=2  % 第112个区间的GNSS循迹优先级
  Segment113VisioinPriority: double, Min=0, Max=2  % 第113个区间的视觉循迹优先级
  Segment113GNSSPriority: double, Min=0, Max=2  % 第113个区间的GNSS循迹优先级
  Segment114VisioinPriority: double, Min=0, Max=2  % 第114个区间的视觉循迹优先级
  Segment114GNSSPriority: double, Min=0, Max=2  % 第114个区间的GNSS循迹优先级
  Segment115VisioinPriority: double, Min=0, Max=2  % 第115个区间的视觉循迹优先级
  Segment115GNSSPriority: double, Min=0, Max=2  % 第115个区间的GNSS循迹优先级
  Segment116VisioinPriority: double, Min=0, Max=2  % 第116个区间的视觉循迹优先级
  Segment116GNSSPriority: double, Min=0, Max=2  % 第116个区间的GNSS循迹优先级
  Segment117VisioinPriority: double, Min=0, Max=2  % 第117个区间的视觉循迹优先级
  Segment117GNSSPriority: double, Min=0, Max=2  % 第117个区间的GNSS循迹优先级
  Segment118VisioinPriority: double, Min=0, Max=2  % 第118个区间的视觉循迹优先级
  Segment118GNSSPriority: double, Min=0, Max=2  % 第118个区间的GNSS循迹优先级
  Segment119VisioinPriority: double, Min=0, Max=2  % 第119个区间的视觉循迹优先级
  Segment119GNSSPriority: double, Min=0, Max=2  % 第119个区间的GNSS循迹优先级
  Segment120VisioinPriority: double, Min=0, Max=2  % 第120个区间的视觉循迹优先级
  Segment120GNSSPriority: double, Min=0, Max=2  % 第120个区间的GNSS循迹优先级
  GridOriginLatitude: double, Min=-90, Max=90  % 相对坐标原点纬度
  GridOriginLongitude: double, Min=-180, Max=180  % 相对坐标原点经度
  GridOriginLongitude_2: double, Min=-180, Max=180  % 相对坐标原点经度

TRDP_CONFIG_MC2_CCU2IDS = struct(
  byte_order=uint32(repmat(1, 29, 1)),
  factor=[1; 1; 1; 0.1; 0.1; 0.1; 0.1; 0.1; 1; 1; 1; 1; 1; 1; 1; 1; 1; 1; 1; 1; 1; 1; 1; 1; 1; 1; 1; 0.1; 0.1],
  offset=repmat(0, 29, 1),
  type=uint32([0; 0; 0; 0; 1; 1; 1; 1; 0; 0; 0; 0; 0; 0; 0; 0; 0; 0; 0; 0; 0; 0; 0; 0; 0; 0; 0; 1; 1]),
  start_byte=uint32([4; 5; 6; 8; 10; 12; 14; 16; 17; 20; 20; 20; 20; 20; 20; 20; 50; 50; 50; 50; 50; 50; 50; 0; 1; 2; 3; 97; 99]),
  start_bit=uint32([0; 0; 0; 0; 0; 0; 0; 0; 0; 0; 1; 2; 3; 4; 5; 6; 0; 1; 2; 3; 4; 5; 6; 0; 0; 0; 0; 0; 0]),
  bit_length=uint32([8; 8; 8; 16; 12; 12; 10; 10; 1; 1; 1; 1; 1; 1; 1; 1; 1; 1; 1; 1; 1; 1; 1; 8; 8; 8; 8; 10; 10]),
  min=[0; 0; 0; 0; -60; -60; -25; -25; 0; 0; 0; 0; 0; 0; 0; 0; 0; 0; 0; 0; 0; 0; 0; 0; 0; 1; 1; -25; -25],
  max=[23; 59; 59; 80; 60; 60; 25; 25; 1; 1; 1; 1; 1; 1; 1; 1; 1; 1; 1; 1; 1; 1; 1; 255; 99; 12; 31; 25; 25])

TRDP_CONFIG_MC2_IDS2CCU = struct(
  byte_order=uint32(repmat(1, 223, 1)),
  factor=[0.00307; 1; 1; 1; 1; 1; 1; 1; 0.01; 0.001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 0.01],
  offset=[0; 0; 0; 0; 0; 0; 0; 0; -10.24; -1.024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 0],
  type=uint32([1; 0; 0; 0; 0; 0; 0; 0; 0; 0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 0]),
  start_byte=uint32([149; 0; 1; 3; 4; 4; 4; 4; 6; 8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 834]),
  start_bit=uint32([0; 0; 0; 0; 0; 3; 4; 5; 0; 0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 0]),
  bit_length=uint32([16; 8; 8; 16; 3; 1; 1; 3; 16; 16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 8]),
  min=[-100.59776; 0; 90; 0; 0; 0; 0; 0; -10.24; -1.024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 0.3],
  max=[100.59469; 255; 165; 65535; 4; 1; 1; 15; 10.23; 1.023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 2])

TRDP_CONFIG_MC2_MMU2IDS_POINT = struct(
  byte_order=uint32(repmat(1, 307, 1)),
  factor=[1; 1; 0.01; 0.01; 0.01; 0.0001; 0.01; 0.01; 0.01; 0.0001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 0.01],
  offset=repmat(0, 307, 1),
  type=uint32([0; 0; 1; 1; 1; 1; 1; 1; 1; 1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 1]),
  start_byte=uint32([0; 1; 41; 45; 49; 51; 57; 61; 65; 67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 16]),
  start_bit=uint32([0; 0; 0; 0; 0; 0; 0; 0; 0; 0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 0]),
  bit_length=uint32([8; 8; 16; 32; 32; 16; 16; 32; 32; 16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 32]),
  min=[0; 0; -179.99; -10000000; -10000000; -0.0667; -179.99; -10000000; -10000000; -0.0667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 -10000000],
  max=[255; 60; 180; 10000000; 10000000; 0.0667; 180; 10000000; 10000000; 0.0667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 10000000])

TRDP_CONFIG_MC2_MMU2IDS_SEGMENT = struct(
  byte_order=uint32(repmat(1, 243, 1)),
  factor=[1; 1; 1; 1; 1; 1; 1; 1; 1; 1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 1.0e-7],
  offset=repmat(0, 243, 1),
  type=uint32([0; 0; 0; 0; 0; 0; 0; 0; 0; 0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 1]),
  start_byte=uint32([40; 41; 48; 49; 56; 57; 64; 65; 72; 73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 8]),
  start_bit=uint32(repmat(0, 243, 1)),
  bit_length=uint32([8; 8; 8; 8; 8; 8; 8; 8; 8; 8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 32]),
  min=[0; 0; 0; 0; 0; 0; 0; 0; 0; 0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 -180],
  max=[2; 2; 2; 2; 2; 2; 2; 2; 2; 2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 180])

TRDP_SIGNALS_MC2_CCU2IDS = struct(
  Hour=0,
  Minute=0,
  Second=0,
  TramSpeed=0,
  MC1ArticulatedAngle=-60,
  MC2ArticulatedAngle=-60,
  SteeringAxle1Angle=-25,
  SteeringAxle6Angle=-25,
  TGS5FaultStatus=0,
  MC1AutonomousTracking=0,
  MC1TurnLeftIndicator=0,
  MC1TurnRightIndicator=0,
  MC1OccupiedStatus=0,
  MC1DriveBackward=0,
  MC1OilPumpStatus=0,
  MC1ParkingStatus=0,
  MC2AutonomousTracking=0,
  MC2TurnLeftIndicator=0,
  MC2TurnRightIndicator=0,
  MC2OccupiedStatus=0,
  MC2DriveBackward=0,
  MC2OilPumpStatus=0,
  MC2ParkingStatus=0,
  TCSNLife=0,
  Year=0,
  Month=1,
  Day=1,
  SteeringAxle2Angle=-25,
  SteeringAxle5Angle=-25)

TRDP_SIGNALS_MC2_IDS2CCU = struct(
  TramYawRate=-100.59776,
  IDSLife=0,
  SurroundingCameraDisplaySwitch=90,
  LateralControlSoftwareVersion=0,
  LDWImageStatus=0,
  AutonomousTrackingWorkStatus=0,
  AutonomousTrackingFaultStatus=0,
  AutonomousTrackingAlarmSound=0,
  OriginalA0=-10.24,
  OriginalA1=-1.024,
  OriginalA2=-0.08192,
  OriginalA3=-0.0002048,
  VisionSetFirstSteeringAxleAngle=-25,
  SteeringWheelAngle=-1575,
  DesiredAdditionalTorque=-12.8,
  MotorPowerTorque=-5,
  SteeringWheelTorque=-8.96,
  GNSSWeek=0,
  GNSSTime=0,
  GNSSHeadingAngle=0,
  GNSSPitchAngle=-90,
  GNSSRollAngle=-180,
  GNSSLatitude=-90,
  GNSSLongitude=-180,
  GNSSAltitude=-200,
  GNSSEastSpeed=-20,
  GNSSNorthSpeed=-20,
  GNSSUpperSpeed=-20,
  GNSSBaseline=0,
  GNSSFrontAntennaSatelliteNumber=0,
  GNSSRearAntennaSatelliteNumber=0,
  GNSSWorkStatus=0,
  LateralControlExecuteWord=0,
  IDSSetTractionBlock=0,
  IDSSetSafeBrake=0,
  GNSSAngleSpeedX=-360,
  GNSSAngleSpeedY=-360,
  GNSSAngleSpeedZ=-360,
  GNSSAccelerationX=-1,
  GNSSAccelerationY=-1,
  GNSSAccelerationZ=-1,
  GNSSTemperature=-40,
  A0Offset=-0.5,
  A1Offset=-0.1,
  SteeringWheelAngleOffset=-128,
  FilteredA0=-10.24,
  FilteredA1=-1.024,
  FilteredA2=-0.08192,
  FilteredA3=-0.0002048,
  PreviewLateralOffset=-10.24,
  PreviewAngleOffset=-1.024,
  LDWImageStatus_2=0,
  AutonomousTrackingAlarmSound_2=0,
  TrackingCameraSoftwareVersionHigh4Byte=0,
  TrackingCameraSoftwareVersionlow4Byte=0,
  TrackingCameraCommunicationFault=0,
  EPSFault=0,
  GNSSFault=0,
  TCSNCommunicationFault=0,
  EPS_FL1_TQS_OVERFLOW=0,
  EPS_FL1_TQM_OVERFLOW=0,
  EPS_FL1_TQ_NOT_MATCH=0,
  EPS_FL1_VSENSOR_F=0,
  EPS_FL1_VMOTOR_F=0,
  EPS_FL1_CMOTOR_F=0,
  EPS_FL1_DRIVER_CIR_F=0,
  EPS_FL1_CDIFF_EX=0,
  EPS_FL1_RELAY_FAIL=0,
  EPS_FL1_SIGN_AD_FAIL=0,
  EPS_FL2_BAT_VHIGH=0,
  EPS_FL2_BAT_VLOW=0,
  EPS_FL2_VSPD_F=0,
  EPS_FL2_SPD_LOST=0,
  EPS_FL3_CAN_Lost=0,
  EPS_FL1_UVW_F=0,
  EPS_FL1_SIGN_AB_F=0,
  EPS_FL1_VPOS_SEN_F=0,
  EPS_FL1_MotorCur_F=0,
  EPS_FL1_AD_OFFSET_DF=0,
  EPS_FL1_V_F=0,
  EPS_FL1_Vbus_Short=0,
  EPS_FL1_Relay_Bonding=0,
  EPS_FL1_V_Diff_F=0,
  EPS_FL1_V_F_longtime=0,
  EPS_FL1_IG_F=0,
  EPS_FL1_5V_abnormal=0,
  EPS_FL1_5V_from_65381=0,
  EPS_FL3_CAN_ANGOVERFLOW=0,
  EPS_FL3_CALIB_ERR=0,
  EPS_FL3_TEMP_PROT_L1=0,
  EPS_FL3_AB_CAL_ERR=0,
  EPS_FL2_TEMP_PROT_L2=0,
  EPS_FL3_SIGNA_F=0,
  EPS_FL3_SIGNR_F=0,
  EPS_FL3_ANG_SEN_LOST=0,
  EPS_FL3_LOGIC_ANG_ER=0,
  EPS_FL2_DVSPD_F=0,
  EPS_FL2_CAN_BUSOFF=0,
  EPS_FL2_ENGSPD_F=0,
  EPS_FL2_ENGSPD_LOST=0,
  EPS_FL1_Motor_PhaseLost=0,
  EPS_FL1_Motor_PhaseLost_BC=0,
  EPSCommunicationFault=0,
  AutonomousTrackingCameraConfidenceLowFault=0,
  SteeringAxleAngleSensorFault=0,
  AutonomousTrackingCameraDataUnchangedAbnormalFault=0,
  LaneDeviationOutOfBoundaryFault=0,
  TCSNLife=0,
  Year=0,
  Month=1,
  Day=1,
  Hour=0,
  Minute=0,
  Second=0,
  TramSpeed=0,
  MC1ArticulatedAngle=-60,
  MC2ArticulatedAngle=-60,
  SteeringAxle1Angle=-25,
  SteeringAxle6Angle=-25,
  TGS5FaultStatus=0,
  MC1AutonomousTracking=0,
  MC1TurnLeftIndicator=0,
  MC1TurnRightIndicator=0,
  MC1OccupiedStatus=0,
  MC1DriveBackward=0,
  MC1OilPumpStatus=0,
  MC1ParkingStatus=0,
  MC2AutonomousTracking=0,
  MC2TurnLeftIndicator=0,
  MC2TurnRightIndicator=0,
  MC2OccupiedStatus=0,
  MC2DriveBackward=0,
  MC2OilPumpStatus=0,
  MC2ParkingStatus=0,
  GNSSCommunicationFault=0,
  LateralControlWarning=0,
  SteeringAxle2Angle=-25,
  SteeringAxle5Angle=-25,
  GNSSLife=0,
  TrackingCameraLife=0,
  EPSLife=0,
  GNSSLocationInvalidFault=0,
  GNSSPositionOutOfBoundaryFault=0,
  SteeringAxleAngleJumpAbnormalFault=0,
  SteeringWheelAngleJumpAbnormalFault=0,
  TramSpeedJumpAbnormalFault=0,
  A0JumpAbnormalFault=0,
  A1JumpAbnormalFault=0,
  A2JumpAbnormalFault=0,
  ENUYawAngleJumpAbnormalFault=0,
  ENUXJumpAbnormalFault=0,
  ENUYJumpAbnormalFault=0,
  MMUCommunicationFault=0,
  EPSWorkStatus=0,
  DesiredEPSWorkMode=0,
  AutonomousTrackingCameraConfidence=0,
  LocationValidStatus=0,
  PreventAutoTrackingStatus=0,
  TaskIndex=0,
  BaseInterventionCondition=0,
  VisionInterventionCondition=0,
  GNSSInterventionCondition=0,
  TramTypeIndex=0,
  StateFlowLateralControlMethod=0,
  StateFlowLateralControlMode=0,
  StateFlowManualDrivingMode=0,
  StateFlowAutoTrackingMode=0,
  StateFlowWaitInterventionMode=0,
  VisionPriorityCurrent=0,
  GNSSPriorityCurrent=0,
  LateralControlMethodCurrent=0,
  LaneDeviationTolerance=0.3,
  StateFlowAlarmVoiceMode=0,
  StateFlowManualDrivingAlarmVoice=0,
  StateFlowAutoTrackingAlarmVoice=0,
  DesiredSteeringWheelAngle=-600,
  DesiredSteeringAxleAngle=-15,
  StateFlowSetSteeringWheelAngleSignalProcessingMode=0,
  StateFlowConfidenceCheck=0,
  StateFlowDataUnchangedAbnormalCheck=0,
  DistanceOffsetPreviewPointYawAngle=-179.99,
  DistanceOffsetPreviewPointX=-10000000,
  DistanceOffsetPreviewPointY=-10000000,
  TramKinematicModelYawRate=-100,
  TramKinematicModelSpeedX=-22.22,
  TramKinematicModelSpeedY=-22.22,
  TramKinematicModelSlipAngle=-100,
  ExecuteDelayEstimatedYawAngle=-1000000000,
  ExecuteDelayEstimatedX=-10000000,
  ExecuteDelayEstimatedY=-10000000,
  StateFlowTramSpeedCheck=0,
  StateFlowLaneCurvatureCheck=0,
  StateFlowLaneSlopeCheck=0,
  StateFlowLaneSmallCurvatureCheck=0,
  GNSSPreviewTime=0,
  GNSSMinPreviewDistance=0,
  StanleyLateralOffsetFactor=0,
  SteeringAxleAngleFactor=0,
  StanleySetSteeringAxleAngle=-15,
  ClosestPointYawAngle=-179.99,
  ClosestPointX=-10000000,
  ClosestPointY=-10000000,
  ClosestPointCurvature=-0.0667,
  ClosestPointSegmentIndex=1,
  AngleOffsetPreviewPointYawAngle=-179.99,
  AngleOffsetPreviewPointX=-10000000,
  AngleOffsetPreviewPointY=-10000000,
  GNSSPreviewLateralOffset=-10000000,
  NearLateralOffsetCurrent=-10000000,
  GNSSPreviewAngleOffset=-179.99,
  GNSSAngleOffsetPreviewDistance=0,
  ReferenceTrajectoryClosestSegmentStartPointIndex=0,
  GNSSDistanceOffsetPreviewDistance=0,
  DesiredSteeringWheelAngleSpeed=50,
  LocalReferenceTrajectoryPointNumber2Control=0,
  LocalReferenceTrajectoryPoint1X2Control=-10000000,
  LocalReferenceTrajectoryPoint1Y2Control=-10000000,
  AngleOffsetPreviewPointCurvature=-0.0667,
  MaxAbsoluteCurvature=0,
  SteeringWheelAngleSpeed=50,
  DistanceOffsetPreviewPointCurvature=-0.0667,
  FilteredTramSpeed=0,
  GNSSTrajectoryDeviationTolerance=0.3)

TRDP_SIGNALS_MC2_MMU2IDS_POINT = struct(
  WayPointDataLife=0,
  WayPointNumber=0,
  WayPoint1YawAngle=-179.99,
  WayPoint1X=-10000000,
  WayPoint1Y=-10000000,
  WayPoint1Curvature=-0.0667,
  WayPoint2YawAngle=-179.99,
  WayPoint2X=-10000000,
  WayPoint2Y=-10000000,
  WayPoint2Curvature=-0.0667,
  WayPoint3YawAngle=-179.99,
  WayPoint3X=-10000000,
  WayPoint3Y=-10000000,
  WayPoint3Curvature=-0.0667,
  WayPoint4YawAngle=-179.99,
  WayPoint4X=-10000000,
  WayPoint4Y=-10000000,
  WayPoint4Curvature=-0.0667,
  WayPoint5YawAngle=-179.99,
  WayPoint5X=-10000000,
  WayPoint5Y=-10000000,
  WayPoint5Curvature=-0.0667,
  WayPoint6YawAngle=-179.99,
  WayPoint6X=-10000000,
  WayPoint6Y=-10000000,
  WayPoint6Curvature=-0.0667,
  WayPoint7YawAngle=-179.99,
  WayPoint7X=-10000000,
  WayPoint7Y=-10000000,
  WayPoint7Curvature=-0.0667,
  WayPoint8YawAngle=-179.99,
  WayPoint8X=-10000000,
  WayPoint8Y=-10000000,
  WayPoint8Curvature=-0.0667,
  WayPoint9YawAngle=-179.99,
  WayPoint9X=-10000000,
  WayPoint9Y=-10000000,
  WayPoint9Curvature=-0.0667,
  WayPoint10YawAngle=-179.99,
  WayPoint10X=-10000000,
  WayPoint10Y=-10000000,
  WayPoint10Curvature=-0.0667,
  WayPoint11YawAngle=-179.99,
  WayPoint11X=-10000000,
  WayPoint11Y=-10000000,
  WayPoint11Curvature=-0.0667,
  WayPoint12YawAngle=-179.99,
  WayPoint12X=-10000000,
  WayPoint12Y=-10000000,
  WayPoint12Curvature=-0.0667,
  WayPoint13YawAngle=-179.99,
  WayPoint13X=-10000000,
  WayPoint13Y=-10000000,
  WayPoint13Curvature=-0.0667,
  WayPoint14YawAngle=-179.99,
  WayPoint14X=-10000000,
  WayPoint14Y=-10000000,
  WayPoint14Curvature=-0.0667,
  WayPoint15YawAngle=-179.99,
  WayPoint15X=-10000000,
  WayPoint15Y=-10000000,
  WayPoint15Curvature=-0.0667,
  WayPoint16YawAngle=-179.99,
  WayPoint16X=-10000000,
  WayPoint16Y=-10000000,
  WayPoint16Curvature=-0.0667,
  WayPoint17YawAngle=-179.99,
  WayPoint17X=-10000000,
  WayPoint17Y=-10000000,
  WayPoint17Curvature=-0.0667,
  WayPoint18YawAngle=-179.99,
  WayPoint18X=-10000000,
  WayPoint18Y=-10000000,
  WayPoint18Curvature=-0.0667,
  WayPoint19YawAngle=-179.99,
  WayPoint19X=-10000000,
  WayPoint19Y=-10000000,
  WayPoint19Curvature=-0.0667,
  WayPoint20YawAngle=-179.99,
  WayPoint20X=-10000000,
  WayPoint20Y=-10000000,
  WayPoint20Curvature=-0.0667,
  WayPoint21YawAngle=-179.99,
  WayPoint21X=-10000000,
  WayPoint21Y=-10000000,
  WayPoint21Curvature=-0.0667,
  WayPoint22YawAngle=-179.99,
  WayPoint22X=-10000000,
  WayPoint22Y=-10000000,
  WayPoint22Curvature=-0.0667,
  WayPoint23YawAngle=-179.99,
  WayPoint23X=-10000000,
  WayPoint23Y=-10000000,
  WayPoint23Curvature=-0.0667,
  WayPoint24YawAngle=-179.99,
  WayPoint24X=-10000000,
  WayPoint24Y=-10000000,
  WayPoint24Curvature=-0.0667,
  WayPoint25YawAngle=-179.99,
  WayPoint25X=-10000000,
  WayPoint25Y=-10000000,
  WayPoint25Curvature=-0.0667,
  WayPoint26YawAngle=-179.99,
  WayPoint26X=-10000000,
  WayPoint26Y=-10000000,
  WayPoint26Curvature=-0.0667,
  WayPoint27YawAngle=-179.99,
  WayPoint27X=-10000000,
  WayPoint27Y=-10000000,
  WayPoint27Curvature=-0.0667,
  WayPoint28YawAngle=-179.99,
  WayPoint28X=-10000000,
  WayPoint28Y=-10000000,
  WayPoint28Curvature=-0.0667,
  WayPoint29YawAngle=-179.99,
  WayPoint29X=-10000000,
  WayPoint29Y=-10000000,
  WayPoint29Curvature=-0.0667,
  WayPoint30YawAngle=-179.99,
  WayPoint30X=-10000000,
  WayPoint30Y=-10000000,
  WayPoint30Curvature=-0.0667,
  WayPoint31YawAngle=-179.99,
  WayPoint31X=-10000000,
  WayPoint31Y=-10000000,
  WayPoint31Curvature=-0.0667,
  WayPoint32YawAngle=-179.99,
  WayPoint32X=-10000000,
  WayPoint32Y=-10000000,
  WayPoint32Curvature=-0.0667,
  WayPoint33YawAngle=-179.99,
  WayPoint33X=-10000000,
  WayPoint33Y=-10000000,
  WayPoint33Curvature=-0.0667,
  WayPoint34YawAngle=-179.99,
  WayPoint34X=-10000000,
  WayPoint34Y=-10000000,
  WayPoint34Curvature=-0.0667,
  WayPoint35YawAngle=-179.99,
  WayPoint35X=-10000000,
  WayPoint35Y=-10000000,
  WayPoint35Curvature=-0.0667,
  WayPoint36YawAngle=-179.99,
  WayPoint36X=-10000000,
  WayPoint36Y=-10000000,
  WayPoint36Curvature=-0.0667,
  WayPoint37YawAngle=-179.99,
  WayPoint37X=-10000000,
  WayPoint37Y=-10000000,
  WayPoint37Curvature=-0.0667,
  WayPoint38YawAngle=-179.99,
  WayPoint38X=-10000000,
  WayPoint38Y=-10000000,
  WayPoint38Curvature=-0.0667,
  WayPoint39YawAngle=-179.99,
  WayPoint39X=-10000000,
  WayPoint39Y=-10000000,
  WayPoint39Curvature=-0.0667,
  WayPoint40YawAngle=-179.99,
  WayPoint40X=-10000000,
  WayPoint40Y=-10000000,
  WayPoint40Curvature=-0.0667,
  WayPoint41YawAngle=-179.99,
  WayPoint41X=-10000000,
  WayPoint41Y=-10000000,
  WayPoint41Curvature=-0.0667,
  WayPoint42YawAngle=-179.99,
  WayPoint42X=-10000000,
  WayPoint42Y=-10000000,
  WayPoint42Curvature=-0.0667,
  WayPoint43YawAngle=-179.99,
  WayPoint43X=-10000000,
  WayPoint43Y=-10000000,
  WayPoint43Curvature=-0.0667,
  WayPoint44YawAngle=-179.99,
  WayPoint44X=-10000000,
  WayPoint44Y=-10000000,
  WayPoint44Curvature=-0.0667,
  WayPoint45YawAngle=-179.99,
  WayPoint45X=-10000000,
  WayPoint45Y=-10000000,
  WayPoint45Curvature=-0.0667,
  WayPoint46YawAngle=-179.99,
  WayPoint46X=-10000000,
  WayPoint46Y=-10000000,
  WayPoint46Curvature=-0.0667,
  WayPoint47YawAngle=-179.99,
  WayPoint47X=-10000000,
  WayPoint47Y=-10000000,
  WayPoint47Curvature=-0.0667,
  WayPoint48YawAngle=-179.99,
  WayPoint48X=-10000000,
  WayPoint48Y=-10000000,
  WayPoint48Curvature=-0.0667,
  WayPoint49YawAngle=-179.99,
  WayPoint49X=-10000000,
  WayPoint49Y=-10000000,
  WayPoint49Curvature=-0.0667,
  WayPoint50YawAngle=-179.99,
  WayPoint50X=-10000000,
  WayPoint50Y=-10000000,
  WayPoint50Curvature=-0.0667,
  WayPoint51YawAngle=-179.99,
  WayPoint51X=-10000000,
  WayPoint51Y=-10000000,
  WayPoint51Curvature=-0.0667,
  WayPoint52YawAngle=-179.99,
  WayPoint52X=-10000000,
  WayPoint52Y=-10000000,
  WayPoint52Curvature=-0.0667,
  WayPoint53YawAngle=-179.99,
  WayPoint53X=-10000000,
  WayPoint53Y=-10000000,
  WayPoint53Curvature=-0.0667,
  WayPoint54YawAngle=-179.99,
  WayPoint54X=-10000000,
  WayPoint54Y=-10000000,
  WayPoint54Curvature=-0.0667,
  WayPoint55YawAngle=-179.99,
  WayPoint55X=-10000000,
  WayPoint55Y=-10000000,
  WayPoint55Curvature=-0.0667,
  WayPoint56YawAngle=-179.99,
  WayPoint56X=-10000000,
  WayPoint56Y=-10000000,
  WayPoint56Curvature=-0.0667,
  WayPoint57YawAngle=-179.99,
  WayPoint57X=-10000000,
  WayPoint57Y=-10000000,
  WayPoint57Curvature=-0.0667,
  WayPoint58YawAngle=-179.99,
  WayPoint58X=-10000000,
  WayPoint58Y=-10000000,
  WayPoint58Curvature=-0.0667,
  WayPoint59YawAngle=-179.99,
  WayPoint59X=-10000000,
  WayPoint59Y=-10000000,
  WayPoint59Curvature=-0.0667,
  WayPoint60YawAngle=-179.99,
  WayPoint60X=-10000000,
  WayPoint60Y=-10000000,
  WayPoint60Curvature=-0.0667,
  ENUYawAngle=-179.99,
  ENUX=-10000000,
  ENUY=-10000000,
  WayPoint1SegmentIndex=1,
  WayPoint2SegmentIndex=1,
  WayPoint3SegmentIndex=1,
  WayPoint4SegmentIndex=1,
  WayPoint5SegmentIndex=1,
  WayPoint6SegmentIndex=1,
  WayPoint7SegmentIndex=1,
  WayPoint8SegmentIndex=1,
  WayPoint9SegmentIndex=1,
  WayPoint10SegmentIndex=1,
  WayPoint11SegmentIndex=1,
  WayPoint12SegmentIndex=1,
  WayPoint13SegmentIndex=1,
  WayPoint14SegmentIndex=1,
  WayPoint15SegmentIndex=1,
  WayPoint16SegmentIndex=1,
  WayPoint17SegmentIndex=1,
  WayPoint18SegmentIndex=1,
  WayPoint19SegmentIndex=1,
  WayPoint20SegmentIndex=1,
  WayPoint21SegmentIndex=1,
  WayPoint22SegmentIndex=1,
  WayPoint23SegmentIndex=1,
  WayPoint24SegmentIndex=1,
  WayPoint25SegmentIndex=1,
  WayPoint26SegmentIndex=1,
  WayPoint27SegmentIndex=1,
  WayPoint28SegmentIndex=1,
  WayPoint29SegmentIndex=1,
  WayPoint30SegmentIndex=1,
  WayPoint31SegmentIndex=1,
  WayPoint32SegmentIndex=1,
  WayPoint33SegmentIndex=1,
  WayPoint34SegmentIndex=1,
  WayPoint35SegmentIndex=1,
  WayPoint36SegmentIndex=1,
  WayPoint37SegmentIndex=1,
  WayPoint38SegmentIndex=1,
  WayPoint39SegmentIndex=1,
  WayPoint40SegmentIndex=1,
  WayPoint41SegmentIndex=1,
  WayPoint42SegmentIndex=1,
  WayPoint43SegmentIndex=1,
  WayPoint44SegmentIndex=1,
  WayPoint45SegmentIndex=1,
  WayPoint46SegmentIndex=1,
  WayPoint47SegmentIndex=1,
  WayPoint48SegmentIndex=1,
  WayPoint49SegmentIndex=1,
  WayPoint50SegmentIndex=1,
  WayPoint51SegmentIndex=1,
  WayPoint52SegmentIndex=1,
  WayPoint53SegmentIndex=1,
  WayPoint54SegmentIndex=1,
  WayPoint55SegmentIndex=1,
  WayPoint56SegmentIndex=1,
  WayPoint57SegmentIndex=1,
  WayPoint58SegmentIndex=1,
  WayPoint59SegmentIndex=1,
  WayPoint60SegmentIndex=1,
  TrajectoryUpdateEnable=0,
  NearLateralOffsetOriginal=-10000000)

TRDP_SIGNALS_MC2_MMU2IDS_SEGMENT = struct(
  Segment1VisioinPriority=0,
  Segment1GNSSPriority=0,
  Segment2VisioinPriority=0,
  Segment2GNSSPriority=0,
  Segment3VisioinPriority=0,
  Segment3GNSSPriority=0,
  Segment4VisioinPriority=0,
  Segment4GNSSPriority=0,
  Segment5VisioinPriority=0,
  Segment5GNSSPriority=0,
  Segment6VisioinPriority=0,
  Segment6GNSSPriority=0,
  Segment7VisioinPriority=0,
  Segment7GNSSPriority=0,
  Segment8VisioinPriority=0,
  Segment8GNSSPriority=0,
  Segment9VisioinPriority=0,
  Segment9GNSSPriority=0,
  Segment10VisioinPriority=0,
  Segment10GNSSPriority=0,
  Segment11VisioinPriority=0,
  Segment11GNSSPriority=0,
  Segment12VisioinPriority=0,
  Segment12GNSSPriority=0,
  Segment13VisioinPriority=0,
  Segment13GNSSPriority=0,
  Segment14VisioinPriority=0,
  Segment14GNSSPriority=0,
  Segment15VisioinPriority=0,
  Segment15GNSSPriority=0,
  Segment16VisioinPriority=0,
  Segment16GNSSPriority=0,
  Segment17VisioinPriority=0,
  Segment17GNSSPriority=0,
  Segment18VisioinPriority=0,
  Segment18GNSSPriority=0,
  Segment19VisioinPriority=0,
  Segment19GNSSPriority=0,
  Segment20VisioinPriority=0,
  Segment20GNSSPriority=0,
  Segment21VisioinPriority=0,
  Segment21GNSSPriority=0,
  Segment22VisioinPriority=0,
  Segment22GNSSPriority=0,
  Segment23VisioinPriority=0,
  Segment23GNSSPriority=0,
  Segment24VisioinPriority=0,
  Segment24GNSSPriority=0,
  Segment25VisioinPriority=0,
  Segment25GNSSPriority=0,
  Segment26VisioinPriority=0,
  Segment26GNSSPriority=0,
  Segment27VisioinPriority=0,
  Segment27GNSSPriority=0,
  Segment28VisioinPriority=0,
  Segment28GNSSPriority=0,
  Segment29VisioinPriority=0,
  Segment29GNSSPriority=0,
  Segment30VisioinPriority=0,
  Segment30GNSSPriority=0,
  Segment31VisioinPriority=0,
  Segment31GNSSPriority=0,
  Segment32VisioinPriority=0,
  Segment32GNSSPriority=0,
  Segment33VisioinPriority=0,
  Segment33GNSSPriority=0,
  Segment34VisioinPriority=0,
  Segment34GNSSPriority=0,
  Segment35VisioinPriority=0,
  Segment35GNSSPriority=0,
  Segment36VisioinPriority=0,
  Segment36GNSSPriority=0,
  Segment37VisioinPriority=0,
  Segment37GNSSPriority=0,
  Segment38VisioinPriority=0,
  Segment38GNSSPriority=0,
  Segment39VisioinPriority=0,
  Segment39GNSSPriority=0,
  Segment40VisioinPriority=0,
  Segment40GNSSPriority=0,
  Segment41VisioinPriority=0,
  Segment41GNSSPriority=0,
  Segment42VisioinPriority=0,
  Segment42GNSSPriority=0,
  Segment43VisioinPriority=0,
  Segment43GNSSPriority=0,
  Segment44VisioinPriority=0,
  Segment44GNSSPriority=0,
  Segment45VisioinPriority=0,
  Segment45GNSSPriority=0,
  Segment46VisioinPriority=0,
  Segment46GNSSPriority=0,
  Segment47VisioinPriority=0,
  Segment47GNSSPriority=0,
  Segment48VisioinPriority=0,
  Segment48GNSSPriority=0,
  Segment49VisioinPriority=0,
  Segment49GNSSPriority=0,
  Segment50VisioinPriority=0,
  Segment50GNSSPriority=0,
  Segment51VisioinPriority=0,
  Segment51GNSSPriority=0,
  Segment52VisioinPriority=0,
  Segment52GNSSPriority=0,
  Segment53VisioinPriority=0,
  Segment53GNSSPriority=0,
  Segment54VisioinPriority=0,
  Segment54GNSSPriority=0,
  Segment55VisioinPriority=0,
  Segment55GNSSPriority=0,
  Segment56VisioinPriority=0,
  Segment56GNSSPriority=0,
  Segment57VisioinPriority=0,
  Segment57GNSSPriority=0,
  Segment58VisioinPriority=0,
  Segment58GNSSPriority=0,
  Segment59VisioinPriority=0,
  Segment59GNSSPriority=0,
  Segment60VisioinPriority=0,
  Segment60GNSSPriority=0,
  Segment61VisioinPriority=0,
  Segment61GNSSPriority=0,
  Segment62VisioinPriority=0,
  Segment62GNSSPriority=0,
  Segment63VisioinPriority=0,
  Segment63GNSSPriority=0,
  Segment64VisioinPriority=0,
  Segment64GNSSPriority=0,
  Segment65VisioinPriority=0,
  Segment65GNSSPriority=0,
  Segment66VisioinPriority=0,
  Segment66GNSSPriority=0,
  Segment67VisioinPriority=0,
  Segment67GNSSPriority=0,
  Segment68VisioinPriority=0,
  Segment68GNSSPriority=0,
  Segment69VisioinPriority=0,
  Segment69GNSSPriority=0,
  Segment70VisioinPriority=0,
  Segment70GNSSPriority=0,
  Segment71VisioinPriority=0,
  Segment71GNSSPriority=0,
  Segment72VisioinPriority=0,
  Segment72GNSSPriority=0,
  Segment73VisioinPriority=0,
  Segment73GNSSPriority=0,
  Segment74VisioinPriority=0,
  Segment74GNSSPriority=0,
  Segment75VisioinPriority=0,
  Segment75GNSSPriority=0,
  Segment76VisioinPriority=0,
  Segment76GNSSPriority=0,
  Segment77VisioinPriority=0,
  Segment77GNSSPriority=0,
  Segment78VisioinPriority=0,
  Segment78GNSSPriority=0,
  Segment79VisioinPriority=0,
  Segment79GNSSPriority=0,
  Segment80VisioinPriority=0,
  Segment80GNSSPriority=0,
  Segment81VisioinPriority=0,
  Segment81GNSSPriority=0,
  Segment82VisioinPriority=0,
  Segment82GNSSPriority=0,
  Segment83VisioinPriority=0,
  Segment83GNSSPriority=0,
  Segment84VisioinPriority=0,
  Segment84GNSSPriority=0,
  Segment85VisioinPriority=0,
  Segment85GNSSPriority=0,
  Segment86VisioinPriority=0,
  Segment86GNSSPriority=0,
  Segment87VisioinPriority=0,
  Segment87GNSSPriority=0,
  Segment88VisioinPriority=0,
  Segment88GNSSPriority=0,
  Segment89VisioinPriority=0,
  Segment89GNSSPriority=0,
  Segment90VisioinPriority=0,
  Segment90GNSSPriority=0,
  Segment91VisioinPriority=0,
  Segment91GNSSPriority=0,
  Segment92VisioinPriority=0,
  Segment92GNSSPriority=0,
  Segment93VisioinPriority=0,
  Segment93GNSSPriority=0,
  Segment94VisioinPriority=0,
  Segment94GNSSPriority=0,
  Segment95VisioinPriority=0,
  Segment95GNSSPriority=0,
  Segment96VisioinPriority=0,
  Segment96GNSSPriority=0,
  Segment97VisioinPriority=0,
  Segment97GNSSPriority=0,
  Segment98VisioinPriority=0,
  Segment98GNSSPriority=0,
  Segment99VisioinPriority=0,
  Segment99GNSSPriority=0,
  Segment100VisioinPriority=0,
  Segment100GNSSPriority=0,
  Segment101VisioinPriority=0,
  Segment101GNSSPriority=0,
  Segment102VisioinPriority=0,
  Segment102GNSSPriority=0,
  Segment103VisioinPriority=0,
  Segment103GNSSPriority=0,
  Segment104VisioinPriority=0,
  Segment104GNSSPriority=0,
  Segment105VisioinPriority=0,
  Segment105GNSSPriority=0,
  Segment106VisioinPriority=0,
  Segment106GNSSPriority=0,
  Segment107VisioinPriority=0,
  Segment107GNSSPriority=0,
  Segment108VisioinPriority=0,
  Segment108GNSSPriority=0,
  Segment109VisioinPriority=0,
  Segment109GNSSPriority=0,
  Segment110VisioinPriority=0,
  Segment110GNSSPriority=0,
  Segment111VisioinPriority=0,
  Segment111GNSSPriority=0,
  Segment112VisioinPriority=0,
  Segment112GNSSPriority=0,
  Segment113VisioinPriority=0,
  Segment113GNSSPriority=0,
  Segment114VisioinPriority=0,
  Segment114GNSSPriority=0,
  Segment115VisioinPriority=0,
  Segment115GNSSPriority=0,
  Segment116VisioinPriority=0,
  Segment116GNSSPriority=0,
  Segment117VisioinPriority=0,
  Segment117GNSSPriority=0,
  Segment118VisioinPriority=0,
  Segment118GNSSPriority=0,
  Segment119VisioinPriority=0,
  Segment119GNSSPriority=0,
  Segment120VisioinPriority=0,
  Segment120GNSSPriority=0,
  GridOriginLatitude=-90,
  GridOriginLongitude=-180,
  GridOriginLongitude_2=-180)

MC1_OutputTRDP = Simulink.Bus()  % MC1_OutputTRDP

MC1_InputTRDP = Simulink.Bus()  % MC1_InputTRDP
  MC1_IDS2CCU_bus: Bus: MC1_IDS2CCU  % MC1_IDS2CCU
  MC1_CCU2IDS_bus: Bus: MC1_CCU2IDS  % MC1_CCU2IDS
  MC1_MMU2IDS_SEGMENT_bus: Bus: MC1_MMU2IDS_SEGMENT  % MC1_MMU2IDS_SEGMENT
  MC1_MMU2IDS_POINT_bus: Bus: MC1_MMU2IDS_POINT  % MC1_MMU2IDS_POINT

MC2_OutputTRDP = Simulink.Bus()  % MC2_OutputTRDP

MC2_InputTRDP = Simulink.Bus()  % MC2_InputTRDP
  MC2_IDS2CCU_bus: Bus: MC2_IDS2CCU  % MC2_IDS2CCU
  MC2_CCU2IDS_bus: Bus: MC2_CCU2IDS  % MC2_CCU2IDS
  MC2_MMU2IDS_SEGMENT_bus: Bus: MC2_MMU2IDS_SEGMENT  % MC2_MMU2IDS_SEGMENT
  MC2_MMU2IDS_POINT_bus: Bus: MC2_MMU2IDS_POINT  % MC2_MMU2IDS_POINT

InputPort = Simulink.Bus()  % 总的输入端口
  InputEthernet_bus: Bus: InputEthernet  % 以太网输入端口

InputEthernet = Simulink.Bus()  % 以太网输入端口
  InputTRDP_bus: Bus: InputTRDP  % TRDP输入端口

InputTRDP = Simulink.Bus()  % TRDP输入端口
  MC1_InputTRDP_bus: Bus: MC1_InputTRDP  % MC1端TRDP输入报文
  MC2_InputTRDP_bus: Bus: MC2_InputTRDP  % MC2端TRDP输入报文

TRDP_COM_ID_CCU2IDS = Simulink.Parameter(1102, DataType="uint32")  % CCU发给IDS的TRDP过程数据COM ID（正整数，无量纲）
TRDP_COM_ID_MC1_IDS2CCU = Simulink.Parameter(1132, DataType="uint32")  % MC1端IDS发给CCU的TRDP过程数据COM ID（正整数，无量纲）
TRDP_COM_ID_MC2_IDS2CCU = Simulink.Parameter(3132, DataType="uint32")  % MC2端IDS发给CCU的TRDP过程数据COM ID（正整数，无量纲）