% Simulink data dictionary Common_Code_Generation.sldd

int8 = Simulink.AliasType(BaseType="int8", DataScope="Imported", HeaderFile="types_definition.h")
uint16 = Simulink.AliasType(BaseType="uint16", DataScope="Imported", HeaderFile="types_definition.h")
uint32 = Simulink.AliasType(BaseType="uint32", DataScope="Imported", HeaderFile="types_definition.h")
uint64 = Simulink.AliasType(BaseType="uint64", DataScope="Imported", HeaderFile="types_definition.h")
uint8 = Simulink.AliasType(BaseType="uint8", DataScope="Imported", HeaderFile="types_definition.h")
int64 = Simulink.AliasType(BaseType="int64", DataScope="Imported", HeaderFile="types_definition.h")
int32 = Simulink.AliasType(BaseType="int32", DataScope="Imported", HeaderFile="types_definition.h")
int16 = Simulink.AliasType(BaseType="int16", DataScope="Imported", HeaderFile="types_definition.h")
float32 = Simulink.AliasType(BaseType="double", DataScope="Imported", HeaderFile="types_definition.h")
temp_index = Simulink.Signal(DataType="int32")  % 临时索引，自然数，无量纲