% Simulink data dictionary Common_Definition.sldd

Key_Life_Info = Simulink.Bus()  % 关键生命信号
  value_current: uint32  % 本周期数值(正整数,无量纲)
  value_previous: uint32  % 上周期数值(正整数,无量纲)
  unchanged_abnormal_check_times: uint32  % 不变异常检测次数(正整数,无量纲)
  unchanged_abnormal_fault: Enum: Validation  % 不变异常故障(正整数,无量纲)

Key_Signal_Info = Simulink.Bus()  % 关键信号
  input_value: double  % 输入数值(实数,无量纲)
  input_value_lock: Enum: Validation  % 输入数值锁(正整数,无量纲)
  original_value_current: double  % 本周期原始值(实数,无量纲)
  original_value_previous: double  % 上周期原始值(实数,无量纲)
  original_value_queue: double[10]  % 原始值队列(实数,无量纲)
  refitted_value_current: double  % 本周期滤波后的数值(实数,无量纲)
  refitted_value_previous: double  % 上周期滤波后的数值(实数,无量纲)
  refitted_value_queue: double[10]  % 滤波后的数值队列(实数,无量纲)
  processed_value_lock: Enum: Validation  % 处理后的数值锁(正整数,无量纲)
  processed_value_current: double  % 本周期处理后的数值(实数,无量纲)
  processed_value_previous: double  % 上周期处理后的数值(实数,无量纲)
  processed_value_queue: double[10]  % 处理后的数值队列(实数,无量纲)
  unit_converter_factor: double, Min=0  % 单位换算系数(实数,无量纲)
  processing_mode: Enum: SignalProcessingMode  % 信号处理模式(正整数,无量纲)
  increment_limit: double, Min=0  % 增量限幅(正实数,无量纲)
  value_offset: double  % 数值偏置(实数,无量纲)
  absolute_amplitude_limit_mode: Enum: Validation  % 绝对幅值限制模式(正整数,无量纲)
  max_value: double  % 最大值(实数,无量纲)
  min_value: double  % 最小值(实数,无量纲)
  jump_abnormal_tolerance: double, Min=0  % 突变异常阈值(正实数,无量纲)
  recovery_check_times: uint32  % 突变异常恢复检测次数(正整数,无量纲)
  jump_abnormal_fault: Enum: Validation  % 异常突变故障（正整数，无量纲）

SignalProcessingMode = enum(DefaultValue="NoFilter")  % 信号处理模式
  NoFilter = 0  % 无滤波
  IncrementLimitFilter = 1  % 增量限幅滤波

MAX_GLOBAL_TRAJECTORY_WAY_POINT_NUMBER = Simulink.Parameter(20001, DataType="int32")  % 全局轨迹的最大路点数量，正整数，无量纲
DEG2RAD = Simulink.Parameter(0.01745329, StorageClass="Define", DataType="double")  % 度转换为弧度的单位换算系数（=pi/180），正实数，无量纲
RAD2DEG = Simulink.Parameter(57.29578, StorageClass="Define", DataType="double")  % 弧度转换为度的单位换算系数（=180/pi），正实数，无量纲
EPSILON = Simulink.Parameter(1.0e-6, StorageClass="Define", DataType="double")  % 判断浮点数是否为零的阈值，实数，无量纲。
ZERO_SPEED_THRESHOLD = Simulink.Parameter(0.1388889, StorageClass="Define", DataType="double", Unit="m/s")  % 判断车辆是否为零速的速度阈值（0.5km/h = 0.5/3.6 m/s），实数，m/s。
MAX_LOCAL_TRAJECTORY_WAY_POINT_NUMBER = Simulink.Parameter(60, StorageClass="Define", DataType="int32")  % 地图管理模型传输给控制模型的局部参考轨迹最大路点个数，正整数，无量纲。
MAX_TRAJECTORY_WAY_POINT_NUMBER = Simulink.Parameter(6001, StorageClass="Define", DataType="int32")  % 控制模型中使用的参考轨迹最大路点个数，正整数，无量纲。