% Simulink data dictionary Local_Trajectory_Export.sldd
% references Model_Config.sldd
% references Common_Definition.sldd
% references Common_Code_Generation.sldd

START_END_DISTANCE_THRESHOLD = Simulink.Parameter(0.5, StorageClass="Define", DataType="double", Unit="m")  % 起点终点距离阈值，距离大于阈值，代表非闭合环线,正实数，m。
LATERAL_DISTANCE_THRESHOLD = Simulink.Parameter(4, StorageClass="Define", DataType="double", Unit="m")  % 横向距离阈值，距离大于阈值开启全局搜索,正实数，m。
MAX_TRAJECTORY_LENGTH = Simulink.Parameter(60, StorageClass="Define", DataType="double", Unit="m")  % 最大轨迹长度，按最小1m间隔可适配MAX_LOCAL_TRAJECTORY_WAY_POINT_NUMBER,正实数，m。
closest_segment_start_point_index_current = Simulink.Signal(StorageClass="SimulinkGlobal", DataType="int32")  % 当前周期的最近线段起始点索引，自然数，无量纲。
trajectory_index_previous = Simulink.Signal(StorageClass="SimulinkGlobal", DataType="int8")  % 上周期所选的参考轨迹索引，自然数，无量纲。
start_end_distance = Simulink.Signal(StorageClass="Localizable", DataType="double", Unit="m")  % 参考轨迹起点与终点之间的距离，正实数，m。
rest_point_number = Simulink.Signal(StorageClass="Localizable", DataType="int32")  % 参考轨迹最近点与终点之间的剩余点数，正整数，无量纲。
rest_distance = Simulink.Signal(StorageClass="Localizable", DataType="double", Unit="m")  % 参考轨迹最近点与终点之间的剩余距离，正实数，m。
closest_segment_start_point_index_previous = Simulink.Signal(DataType="int32")  % 上周期的最近线段起始点索引，自然数，无量纲。
output_way_point_number = Simulink.Signal(DataType="int32")  % 输出的局部轨迹有效路点个数，自然数，无量纲。
specific_index_range1 = Simulink.Signal(StorageClass="Localizable", DataType="int32")  % 最近点到闭合环线的终点的索引范围，自然数，无量纲。
specific_index_range2 = Simulink.Signal(StorageClass="Localizable", DataType="int32")  % 闭合环线的起点到剩余点处的索引范围，自然数，无量纲。
specific_index_range = Simulink.Signal(StorageClass="Localizable", DataType="int32")  % 最近点到非闭合环线的指定总点数的结束点的索引范围，自然数，无量纲。
specific_index_range3 = Simulink.Signal(StorageClass="Localizable", DataType="int32")  % 最近点到非闭合环线的指定总点数的结束点的索引范围，自然数，无量纲。
closest_point_cumulative_length = Simulink.Signal(StorageClass="Localizable", DataType="double", Unit="m")  % 参考轨迹最近点与起点之间的累计距离，正实数，m。
near_lateral_offset_previous = Simulink.Signal(StorageClass="SimulinkGlobal", DataType="double", Unit="m")  % 上周期最近点处横向偏差，实数，m。
temp_closest_point_curvature = Simulink.Signal(StorageClass="SimulinkGlobal", DataType="double", Unit="1/m")  % 最近点处曲率临时变量（仅增加代码可读性），实数，1/m。