% Simulink data dictionary Model_Config.sldd

ART_1G_IDS_SPEEDGOAT_CYCLE_TIME = Simulink.Parameter(0.05, Unit="s")  % 用于智轨一代车IDS的Speedgoat real-time的求解器步长
SLDRT_CYCLE_TIME = Simulink.Parameter(0.05, Unit="s")  % 用于Desktop real-time的求解器步长
ADK_IDS_SPEEDGOAT_CYCLE_TIME = Simulink.Parameter(0.05, Unit="s")  % 用于Apollo开发者套件小车IDS的Speedgoat real-time的求解器步长
Code_Generation = Simulink.ConfigSet(StartTime="0", StopTime="2", FixedStep="SLDRT_CYCLE_TIME", Solver="FixedStepDiscrete", ProdHWDeviceType="Intel->x86-64 (Windows64)", SystemTargetFile="ert.tlc", TargetLang="C")  % 代码生成专用配置。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
Normal_SLDRT = Simulink.ConfigSet(StartTime="0", StopTime="inf", FixedStep="SLDRT_CYCLE_TIME", Solver="FixedStepDiscrete", ProdHWDeviceType="Intel->x86-64 (Windows64)", SystemTargetFile="grt.tlc", TargetLang="C")  % Desktop real-time Normal模式专用配置。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
General_Test = Simulink.ConfigSet(StartTime="0", StopTime="2", FixedStep="SLDRT_CYCLE_TIME", Solver="FixedStepDiscrete", ProdHWDeviceType="Intel->x86-64 (Windows64)", SystemTargetFile="ert.tlc", TargetLang="C")  % 普通测试专用配置。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
ADK_IDS_Speedgoat = Simulink.ConfigSet(StartTime="0", StopTime="inf", Solver="FixedStepAuto", ProdHWDeviceType="Intel->x86-64 (Linux 64)", SystemTargetFile="slrealtime.tlc", TargetLang="C++")  % Apollo开发套件小车智能驾驶系统配套Speedgoat专用配置。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
ART_1G_IDS_Speedgoat = Simulink.ConfigSet(StartTime="0", StopTime="inf", Solver="FixedStepAuto", ProdHWDeviceType="Intel->x86-64 (Linux 64)", SystemTargetFile="slrealtime.tlc", TargetLang="C++")  % 智轨电车智能驾驶系统配套Speedgoat专用配置。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
AION_IDS_Speedgoat = Simulink.ConfigSet(StartTime="0", StopTime="inf", Solver="FixedStepAuto", ProdHWDeviceType="Intel->x86-64 (Linux 64)", SystemTargetFile="slrealtime.tlc", TargetLang="C++")  % AION车配套Speedgoat专用配置。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
AION_IDS_SPEEDGOAT_CYCLE_TIME = Simulink.Parameter(0.02, Unit="s")  % 用于Apollo开发者套件小车IDS的Speedgoat real-time的求解器步长