% Simulink data dictionary Trajectory_Closest_Point_Info_Get.sldd
% references Common_Definition.sldd
% references Model_Config.sldd
% references Common_Code_Generation.sldd

yaw_angle_rad = Simulink.Signal(StorageClass="Localizable", DataType="double", Unit="rad")  % 当前车辆横摆角，实数，rad
vehicle_y1 = Simulink.Signal(StorageClass="Localizable", DataType="double", Unit="m")  % 车辆坐标系下的参考轨迹最近点y坐标，实数，m
temp_near_lateral_offset = Simulink.Signal(DataType="double", Unit="m")  % 最近处横向偏差中间变量，实数，m
vehicle_x1 = Simulink.Signal(StorageClass="Localizable", DataType="double", Unit="m")  % 车辆坐标系下的参考轨迹最近点x坐标，实数，m
next_to_last_point_x = Simulink.Signal(StorageClass="Localizable", DataType="double", Unit="m")  % 参考轨迹倒数第二个路点x坐标，实数，m
next_to_last_point_y = Simulink.Signal(StorageClass="Localizable", DataType="double", Unit="m")  % 参考轨迹倒数第二个路点y坐标，实数，m
last_point_x = Simulink.Signal(StorageClass="Localizable", DataType="double", Unit="m")  % 参考轨迹倒数第一个路点x坐标，实数，m
last_point_y = Simulink.Signal(StorageClass="Localizable", DataType="double", Unit="m")  % 参考轨迹倒数第一个路点y坐标，实数，m
output_closest_point_curvature = Simulink.Signal(DataType="double", Unit="1/m")  % 最近点曲率中间输出变量，实数，1/m
output_closest_point_x = Simulink.Signal(DataType="double", Unit="m")  % 最近点x坐标中间输出变量，实数，m
output_closest_point_y = Simulink.Signal(DataType="double", Unit="m")  % 最近点y坐标中间输出变量，实数，m
output_near_lateral_offset = Simulink.Signal(DataType="double", Unit="m")  % 最近处横向偏差中间输出变量，实数，m
head_arc_length_current = Simulink.Signal(StorageClass="Localizable", DataType="double", Unit="m")  % 本次循环计算的参考轨迹最近点往头部延伸弧长，实数，m
tail_arc_length_current = Simulink.Signal(StorageClass="Localizable", DataType="double", Unit="m")  % 本次循环计算的参考轨迹最近点往尾部延伸弧长，实数，m
head_arc_length_previous = Simulink.Signal(StorageClass="SimulinkGlobal", DataType="double", Unit="m")  % 上一次循环计算的参考轨迹最近点向头部延伸弧长，实数，m
tail_arc_length_previous = Simulink.Signal(StorageClass="SimulinkGlobal", DataType="double", Unit="m")  % 上一次循环计算的参考轨迹最近点向尾部延伸弧长，实数，m
global_search_enable_flag = Simulink.Signal(StorageClass="Localizable", DataType="boolean")  % 使能全局搜索的标志，布尔量，无量纲
temp_delta_angle1 = Simulink.Signal(StorageClass="Localizable", DataType="double", Unit="deg")  % 当前车辆横摆角与参考轨迹起点横摆角的角度偏差中间变量，实数，deg
specific_range_delta_angle1 = Simulink.Signal(StorageClass="SimulinkGlobal", DataType="double", Unit="deg")  % -180~180度范围内的当前车辆横摆角与参考轨迹起点横摆角的角度偏差，实数，deg
specific_near_lateral_offset1 = Simulink.Signal(StorageClass="Localizable", DataType="double", Unit="m")  % 车辆当前点与参考轨迹起点的距离，正实数，m
closest_point_invalid_flag = Simulink.Signal(StorageClass="SimulinkGlobal", DataType="boolean", InitialValue="1")  % 局部搜索最近点无效标志，布尔量，无量纲
DELTA_ANGLE_COMPENSATION1 = Simulink.Parameter(540, StorageClass="Define", DataType="double", Unit="deg")  % 将角度偏差换算到-180~180度范围内的补偿值1，实数，deg
DELTA_ANGLE_COMPENSATION2 = Simulink.Parameter(-180, StorageClass="Define", DataType="double", Unit="deg")  % 将角度偏差换算到-180~180度范围内的补偿值2，实数，deg
DELTA_ANGLE_DIVISOR360 = Simulink.Parameter(360, StorageClass="Define", DataType="double", Unit="deg")  % 将角度偏差换算到-180~180度范围内的除数，实数，deg
N_ALTERNATIVE_CLOSEST_POINT_QUEUE = Simulink.Parameter(100, StorageClass="Define", DataType="int32")  % 备选最近点序列的长度，正整数，无量纲
specific_range_delta_angle2 = Simulink.Signal(StorageClass="SimulinkGlobal", DataType="double", Unit="deg")  % -180~180度范围内的当前车辆横摆角与参考轨迹倒数第二点横摆角的角度偏差，实数，deg
temp_delta_angle2 = Simulink.Signal(StorageClass="Localizable", DataType="double", Unit="deg")  % 当前车辆横摆角与参考轨迹倒数第二点横摆角的角度偏差中间变量，实数，deg
specific_near_lateral_offset2 = Simulink.Signal(StorageClass="Localizable", DataType="double", Unit="m")  % 车辆当前点与参考轨迹倒数第二点的距离，正实数，m
traverse_delta_angle = Simulink.Signal(StorageClass="Localizable", DataType="double", Unit="deg")  % 当前车辆横摆角与参考轨迹当前遍历路点横摆角的角度偏差中间变量，实数，deg
specific_range_traverse_delta_angle = Simulink.Signal(DataType="double", Unit="deg")  % -180~180度范围内的当前车辆横摆角与参考轨迹当前遍历路点横摆角的角度偏差中间变量，实数，deg
traverse_point_x = Simulink.Signal(StorageClass="Localizable", DataType="double", Unit="m")  % 当前遍历路点x坐标，实数，m
traverse_point_y = Simulink.Signal(StorageClass="Localizable", DataType="double", Unit="m")  % 当前遍历路点y坐标，实数，m
projection_rate1 = Simulink.Signal(DataType="double")  % 车辆当前点到当前遍历路点和下一个路点组成的前一个线段上的向量投影占比，实数，无量纲
projection_rate2 = Simulink.Signal(DataType="double")  % 车辆当前点到当前遍历路点的下一个路点和下下个路点组成的后一个线段上的向量投影占比，实数，无量纲
neighboring_segment_closest_point2_x = Simulink.Signal(DataType="double", Unit="m")  % 车辆当前点到当前遍历路点的下一个路点和下下个路点组成的后一个线段上的最近点x坐标，实数，m
neighboring_segment_closest_point2_y = Simulink.Signal(DataType="double", Unit="m")  % 车辆当前点到当前遍历路点的下一个路点和下下个路点组成的后一个线段上的最近点y坐标，实数，m
neighboring_segment_closest_point1_x = Simulink.Signal(DataType="double", Unit="m")  % 车辆当前点到当前遍历路点和下一个路点组成的前一个线段上的最近点x坐标，实数，m
neighboring_segment_closest_point1_y = Simulink.Signal(DataType="double", Unit="m")  % 车辆当前点到当前遍历路点和下一个路点组成的前一个线段上的最近点y坐标，实数，m
closer_point_x_queue = Simulink.Signal(StorageClass="SimulinkGlobal", DataType="double", Unit="m", Dimensions="[N_ALTERNATIVE_CLOSEST_POINT_QUEUE,1]", InitialValue="zeros(N_ALTERNATIVE_CLOSEST_POINT_QUEUE, 1)")  % 备选最近点x坐标序列，实数，m
delta_angle_queue = Simulink.Signal(StorageClass="SimulinkGlobal", DataType="double", Unit="deg", Dimensions="[N_ALTERNATIVE_CLOSEST_POINT_QUEUE,1]", InitialValue="zeros(N_ALTERNATIVE_CLOSEST_POINT_QUEUE, 1)")  % 备选最近点对应的横摆角偏差序列，实数，deg
closer_point_index_queue = Simulink.Signal(StorageClass="SimulinkGlobal", DataType="int32", Dimensions="[N_ALTERNATIVE_CLOSEST_POINT_QUEUE,1]", InitialValue="zeros(N_ALTERNATIVE_CLOSEST_POINT_QUEUE, 1)")  % 备选最近点索引序列，自然数，无量纲
near_lateral_offset_queue = Simulink.Signal(StorageClass="SimulinkGlobal", DataType="double", Unit="m", Dimensions="[N_ALTERNATIVE_CLOSEST_POINT_QUEUE,1]", InitialValue="zeros(N_ALTERNATIVE_CLOSEST_POINT_QUEUE, 1)")  % 备选最近点横向偏差序列，实数，m
valid_queue_length = Simulink.Signal(StorageClass="SimulinkGlobal", DataType="int32")  % 备选序列有效长度，自然数，无量纲
distance_relationship_transition_flag = Simulink.Signal(StorageClass="SimulinkGlobal", DataType="boolean", InitialValue="0")  % 距离关系转移标志，在由远及近与由近及远的转折处存在一个极近点，通过该标志的变化筛选出来，布尔量，无量纲
absolute_delta_angle = Simulink.Signal(StorageClass="SimulinkGlobal", DataType="double", Unit="deg")  % 当前车辆横摆角与参考轨迹当前遍历路点横摆角的角度偏差绝对值，实数，deg
traverse_index = Simulink.Signal(DataType="int32")  % 遍历到的当前索引，自然数，无量纲
distance1 = Simulink.Signal(DataType="double", Unit="m")  % 车辆当前点到当前遍历路点和下一个路点组成的前一个线段上的最近点的距离，正实数，m
distance2 = Simulink.Signal(DataType="double", Unit="m")  % 车辆当前点到当前遍历路点的下一个路点和下下个路点组成的后一个线段上的最近点的距离，正实数，m
closest_distance_index = Simulink.Signal(StorageClass="SimulinkGlobal", DataType="int32")  % 备选最近点序列中与车辆当前点之间的距离最近的路点索引，自然数，无量纲
min_delta_angle = Simulink.Signal(StorageClass="SimulinkGlobal", DataType="double", Unit="deg")  % 备选最近点序列中与当前车辆横摆角的最小偏差，正实数，deg
min_delta_angle_index = Simulink.Signal(StorageClass="SimulinkGlobal", DataType="int32")  % 备选最近点序列中与当前车辆横摆角偏差最小的路点索引，自然数，无量纲
CLOSEST_DISTANCE_THRESHOLD = Simulink.Parameter(2, StorageClass="Define", DataType="double", Unit="m")  % 最近距离阈值，距离小于阈值的最近点才考虑横摆角偏差，正实数，m
output_valid_queue_length = Simulink.Signal(DataType="int32")  % 备选序列有效长度中间输出变量，自然数，无量纲
DELTA_ANGLE_THRESHOLD = Simulink.Parameter(90, StorageClass="Define", DataType="double", Unit="deg")  % 横摆角度偏差阈值，最近距离的点的横摆夹角大于等于阈值才选择横摆夹角最小的点，正实数，deg
closest_point_index = Simulink.Signal(StorageClass="Localizable", DataType="int32")  % 最近点索引，自然数，无量纲
closer_point_curvature_queue = Simulink.Signal(StorageClass="SimulinkGlobal", DataType="double", Unit="1/m", Dimensions="[N_ALTERNATIVE_CLOSEST_POINT_QUEUE,1]", InitialValue="zeros(N_ALTERNATIVE_CLOSEST_POINT_QUEUE, 1)")  % 备选最近点曲率序列，实数，1/m
output_closest_segment_start_point_index = Simulink.Signal(DataType="int32")  % 最近点线段起始点索引中间输出变量，自然数，无量纲
closest_distance = Simulink.Signal(StorageClass="SimulinkGlobal", DataType="double", Unit="m")  % 备选最近点序列中与车辆当前点之间的最近距离，正实数，m
output_closest_distance = Simulink.Signal(StorageClass="SimulinkGlobal", DataType="double", Unit="m")  % 备选最近点序列中与车辆当前点之间的最近距离中间输出变量，正实数，m
SINGLE_STEP_MOTION_ARC_LENGTH_THRESHOLD = Simulink.Parameter(1.111111, StorageClass="Define", DataType="double", Unit="m")  % 单周期内车辆运动延伸弧长阈值，按最高80km/h车速均分到50ms程序运行周期内粗略估计（=80*1000*50/60/60/1000），正实数，m
closer_point_y_queue = Simulink.Signal(StorageClass="SimulinkGlobal", DataType="double", Unit="m", Dimensions="[N_ALTERNATIVE_CLOSEST_POINT_QUEUE,1]", InitialValue="zeros(N_ALTERNATIVE_CLOSEST_POINT_QUEUE, 1)")  % 备选最近点y坐标序列，实数，m
valid_way_point_number = Simulink.Signal(StorageClass="Localizable", DataType="int32")  % 有效的参考轨迹路点数量，自然数，无量纲
start_index = Simulink.Signal(DataType="int32")  % 搜索局部搜索起始点索引时遍历到的当前索引（从1开始计数），自然数，无量纲
end_index = Simulink.Signal(DataType="int32")  % 搜索局部搜索结束点索引时遍历到的当前索引（从1开始计数），自然数，无量纲
next_to_traverse_point_curvature = Simulink.Signal(StorageClass="Localizable", DataType="double", Unit="1/m")  % 参考轨迹上当前遍历路点的下一个路点的曲率中间变量，实数，1/m
temp_next_to_traverse_point_curvature = Simulink.Signal(StorageClass="Localizable", DataType="double", Unit="1/m")  % 参考轨迹上当前遍历路点的下一个路点的曲率中间变量，实数，1/m