% Simulink data dictionary Two_Point_Distance_Calculate.sldd
% references Common_Definition.sldd
% references Model_Config.sldd
% references Common_Code_Generation.sldd

delta_x = Simulink.Signal(StorageClass="Localizable", DataType="double", Unit="m")  % 两点之间的x坐标增量，实数，m
delta_y = Simulink.Signal(StorageClass="Localizable", DataType="double", Unit="m")  % 两点之间的y坐标增量，实数，m