% Simulink data dictionary Vector_Projection_Get_Closest_Point.sldd
% references Common_Definition.sldd
% references Model_Config.sldd
% references Common_Code_Generation.sldd

delta_x_P1P2 = Simulink.Signal(StorageClass="Localizable", DataType="double", Unit="m")  % 线段P1P2的x坐标增量，实数，m
delta_y_P1P2 = Simulink.Signal(StorageClass="Localizable", DataType="double", Unit="m")  % 线段P1P2的y坐标增量，实数，m
delta_x_P1P = Simulink.Signal(StorageClass="Localizable", DataType="double", Unit="m")  % 线段P1P的x坐标增量，实数，m
delta_y_P1P = Simulink.Signal(StorageClass="Localizable", DataType="double", Unit="m")  % 线段P1P的y坐标增量，实数，m
square_P1P2 = Simulink.Signal(StorageClass="Localizable", DataType="double", Unit="m^2")  % 线段P1P2的距离平方，实数，m^2
closest_point_x = Simulink.Signal(DataType="double", Unit="m")  % 路点线段上距离当前点P最近的点C的x坐标，实数，m
closest_point_y = Simulink.Signal(DataType="double", Unit="m")  % 路点线段上距离当前点P最近的点C的y坐标，实数，m
temp_projection_rate = Simulink.Signal(DataType="double")  % 当前点P与线段起始点P1连线在两个路点P1、P2连线上的投影占总长度的比例中间变量，用于条件判断，实数，无量纲