% Simulink data dictionary Vehicle_Coordinate_Transfer.sldd
% references Common_Definition.sldd
% references Model_Config.sldd
% references Common_Code_Generation.sldd

delta_x_P0Pe = Simulink.Signal(StorageClass="Localizable", DataType="double", Unit="m")  % 线段P0Pe的x坐标增量，实数，m
delta_y_P0Pe = Simulink.Signal(StorageClass="Localizable", DataType="double", Unit="m")  % 线段P0Pe的y坐标增量，实数，m
cos_theta = Simulink.Signal(StorageClass="Localizable", DataType="double")  % 车辆横摆角的余弦值，实数，无量纲
sin_theta = Simulink.Signal(StorageClass="Localizable", DataType="double")  % 车辆横摆角的正弦值，实数，无量纲